# Grasshopper definition Countouring.gh (Grasshopper 1.0.7)
# plug-ins: Bifocals

# Aswin Indraprastha
# 
# Program Studi Arsitektur
# Sekolah Arsitektur, Perencanaan, dan Pengembangan Kebijakan
# Institut Teknologi Bandung
# 
# aswin@itb.ac.id
# Bifocals
# Obyek 3D referensi yang akan diiris
brep = Brep(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)  # disabled

# ----
# 1. BUAT OBYEK
# 1.1 Buat lingkaran-lingkaran profil
number_slider = Slider(12, range=0..100)
addition = Addition(A=number_slider, B=Slider(7, range=0..10))
unit_z = UnitZ(Factor=Slider(39, range=0..100))
unit_z_2 = UnitZ(Factor=Slider(50, range=0..100))
circle = Circle(Plane=PlaneXY(0, 0, 0), Radius=addition)
circle_2 = Circle(Plane=PlaneXY(0, 0, 0), Radius=number_slider)
move = Move(Geometry=circle, Motion=unit_z)  # -> Geometry, Transform
move_2 = Move(Geometry=circle_2, Motion=unit_z_2)  # -> Geometry, Transform
circle_3 = Circle(Plane=PlaneXY(0, 0, 0), Radius=number_slider)
lower_circle = Curve(circle_3)
middle_circle = Curve(move.Geometry)
upper_circle = Curve(move_2.Geometry)

# ----
# 1.2 Buat profil Arc
lower_circle_2 = Curve(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)
middle_circle_2 = Curve(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)
upper_circle_2 = Curve(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)
point_on_curve = PointOnCurve(lower_circle_2, parameter=0)
point_on_curve_2 = PointOnCurve(middle_circle_2, parameter=0)
point_on_curve_3 = PointOnCurve(upper_circle_2, parameter=0)
interpolate = Interpolate(Vertices=[point_on_curve, point_on_curve_2, point_on_curve_3], Degree=3, Periodic=False, KnotStyle=1)  # -> Curve, Length, Domain
sweep2 = Sweep2(Rail1=lower_circle_2, Rail2=middle_circle_2, Sections=interpolate.Curve, SameHeight=False)
brep_2 = Brep(sweep2)

# ----
# Contours. Mengiris obyek 3D berdasarkan ketebalan irisan dan arah irisan.
panel = Panel("5")  # disabled
contour = Contour(Shape=brep, Point=Point(0, 0, 0), Direction=Vector(0, 0, 1), Distance=panel)  # disabled
group = Group(Objects=contour)  # disabled
brep_3 = Brep(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)  # disabled
bbox = BoundingBox(Content=brep_3, Plane=PlaneXY(0, 0, 0))  # -> Box, Box_2; disabled
panel_2 = Panel("Tentukan jumlah irisan")  # disabled
# Bounding Box-Per Object. Membuat kerangka (Bounding Box) per obyek irisan.
bbox_2 = BoundingBox(Content=group, Plane=PlaneXY(0, 0, 0))  # -> flatten(Box), Box_2; disabled
lng = ListLength(List=flatten(group))  # disabled
# Mengiris obyek 3D referensi, menentgukan arah irisan dan ketebalan.
tebal_kontur = Slider(0.2, range=0..4)  # disabled
explode = BrepComponents(Brep=bbox.Box)  # -> Faces, Edges, Vertices; disabled
# Tentukan dimensi bidang setiap irisan (seharusnya sama nilainya, tambahkan dengan suatu konstanta untuk menentukan besar kotak setiap irisan.
debox = DeconstructBox(Box=bbox_2.Box)  # -> Plane, X, Y, Z; disabled
num = Number(flatten(debox.X))  # disabled
series = Series(Start=0, Step=panel, Count=lng)  # disabled
item = ListItem(List=explode.Vertices, Index=0, Wrap=True)  # disabled

X = UnitX(Factor=1)  # disabled

panel_3 = Panel("10")  # disabled
addition_2 = Addition(A=num, B=panel_3)  # disabled
pt = ConstructPoint(XCoordinate=0, YCoordinate=0, ZCoordinate=series)  # disabled
# Tentukan posisi X dengan rentang jarak tertentu untuk meletakkan irisan-irisan pada bidang XY.
ma = MassAddition(Input=addition_2)  # -> Result, PartialResults; disabled
contour_2 = Contour(Shape=brep_3, Point=item, Direction=X, Distance=tebal_kontur)  # disabled
pt_2 = ConstructPoint(XCoordinate=ma.PartialResults, YCoordinate=0, ZCoordinate=0)  # disabled

# ---- group: Letak Tag
number_slider_2 = Slider(0, range=0..10)  # disabled

# ----
# 2.MEMBUAT BILAH VERTIKAL DAN BILAH HORIZONTAL
# 2.1 Membuat bilah-bilah vertikal
reference_brep = Brep(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)
# Buat vektor perpindahan untuk setiap irisan.
vec2pt = Vector2Pt(PointA=pt, PointB=pt_2, Unitize=False)  # -> Vector, Length; disabled
deconstruct_brep = DeconstructBrep(Brep=reference_brep)  # -> Faces, Edges, Vertices
explode_2 = Explode(Curve=contour_2, Recursive=True)  # -> Segments, Vertices; disabled
wires = BrepWireframe(Brep=reference_brep, Density=-1)
# Pindahkan setiap irisan ke bidang XY
move_3 = Move(Geometry=flatten(group), Motion=vec2pt.Vector)  # -> Geometry, Transform; disabled
# Ekstrak salah satu kurva dari Surface, bagi menjadi beberapa segmen, produksi Perpendicular Frame dari setiap titik segmen.
panel_4 = Panel("0")
# Menentukan teks untuk label/tag.
lng_2 = ListLength(List=flatten(contour_2))  # disabled
Y = UnitY(Factor=-2.8)  # disabled
# Menentukan titik untuk meletakkan tag setiap irisan.
item_2 = ListItem(List=explode_2.Vertices, Index=number_slider_2, Wrap=True)  # disabled
list_item = ListItem(List=deconstruct_brep.Edges, Index=panel_4, Wrap=True)
# Konversi setiap irisan menjadi Surface.
planar = PlanarSrf(Edges=contour_2)  # disabled

# ----
# 2.2 Define numbers of horizontal ribs
# Numbers of Horizontal Ribs
reference_brep_2 = Brep(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)
# 1. Bending-active Plate
number_slider_3 = Slider(2, range=0..10)
deconstruct_brep_2 = DeconstructBrep(Brep=reference_brep_2)  # -> Faces, Edges, Vertices
list_item_2 = ListItem(List=deconstruct_brep_2.Edges, Index=number_slider_3, Wrap=True)
list_item_3 = ListItem(List=deconstruct_brep_2.Edges, Index="0", Wrap=True)
area = Area(Geometry=list_item_3)  # -> Area, Centroid
# Rod
area_2 = Area(Geometry=list_item_2)  # -> Area, Centroid
line = Line(StartPoint=area.Centroid, EndPoint=area_2.Centroid)
# Grab
number_slider_4 = Slider(12, range=0..60)
curve = Curve(line)
# Anchor
divide_curve = DivideCurve(Curve=curve, Count=number_slider_4, Kinks=False)  # -> Points, Tangents, Parameters
perp_frame = PerpFrame(Curve=curve, Parameter=divide_curve.Parameters)
brep_plane = BrepPlane(Brep=reference_brep_2, Plane=perp_frame)  # -> Curves, Points

series_2 = Series(Start=0, Step=1, Count=lng_2)  # disabled
panel_5 = Panel("Label No:")  # disabled
panel_6 = Panel(deconstruct_brep.Edges)
move_4 = Move(Geometry=item_2, Motion=Y)  # -> Geometry, Transform; disabled
# Buat Bounding Box untuk setiap irisan.
project = Project(Geometry=move_3.Geometry, Plane=PlaneXY(0, 0, 0))  # -> Geometry, Transform; disabled
series_3 = Series(Start=1, Step=1, Count=lng)  # disabled
panel_7 = Panel(deconstruct_brep_2.Edges)
flip_curve = FlipCurve(Curve=list_item)  # -> Curve, Flag
int = Integer(series_2)  # disabled
bbox_3 = BoundingBox(Content=project.Geometry, Plane=PlaneXY(0, 0, 0))  # -> Box, Box_2; disabled
# Label adalah teks banyaknya irisan yang diurutkan.
int_2 = Integer(series_3)  # disabled
# Proyeksikan tag pada bidang YZ.
yz = YZPlane(Origin=flatten(move_4.Geometry))  # disabled
concat = Concatenate(A=panel_5, B=int)  # disabled
curve_2 = Curve(flip_curve.Curve)
rec = Rectangle(bbox_3.Box)  # disabled
panel_8 = Panel(flip_curve.Curve)
divide_curve_2 = DivideCurve(Curve=curve_2, Count=Slider(12, range=1..61), Kinks=False)  # -> Points, Tangents, Parameters
# Offset Bounding Box dan tentukan titik Vertices untuk meletakkan label.
offset = Offset(Curve=rec, Distance=4, Plane=PlaneXY(0, 0, 0), Corners=1)  # disabled

# ---- group: Besar huruf
ukuran_teks = Slider(0.12, range=0..1)  # disabled

# ----
move_text_x = Slider(3.56, range=0..10)  # disabled
move_text_y = Slider(0.52, range=0..10)  # disabled
cellsiny = Slider(4, range=0..100)  # disabled
cellsinx = Slider(9, range=0..10)  # disabled
cell_y_size = Slider(5, range=0..100)  # disabled
cell_x_size = Slider(6, range=0..100)  # disabled
explode_3 = Explode(Curve=offset, Recursive=True)  # -> Segments, Vertices; disabled
perp_frame_2 = PerpFrame(Curve=curve_2, Parameter=divide_curve_2.Parameters)
swatch = ColourSwatch(SwatchColor=RGB(25, 0, 255))  # disabled
number_slider_5 = Slider(19, range=0..40)
number_slider_6 = Slider(60, range=0..60)
item_3 = ListItem(List=explode_3.Vertices, Index=0, Wrap=True)  # disabled
panel_9 = Panel("10")  # disabled
tag = TextTag3D(Location=yz, Text=concat, Size=ukuran_teks, Colour=swatch, Justification=7)  # disabled
panel_10 = Panel("Bake geometry.")  # disabled
panel_11 = Panel("pelabelan")  # disabled
merge = Merge(Data1=project.Geometry, Data2=offset)  # disabled
negative = Negative(Value=number_slider_5)
tag_2 = TextTag3D(Location=simplify(item_3), Text=graft(int_2), Size=panel_9, Justification=7)  # disabled
X_2 = UnitX(Factor=move_text_x)  # disabled
Y_2 = UnitY(Factor=move_text_y)  # disabled
# Buat grid untuk meletakkan irisan-irisan pada bidang XY.
recgrid = Rectangular(Plane=PlaneXY(15.82681003, 0.04555155177, 0), SizeX=cell_x_size, SizeY=cell_y_size, ExtentX=cellsinx, ExtentY=cellsiny)  # -> Cells, Points; disabled
# Koordinat untuk lokasi teks.
addition_3 = Addition(A=X_2, B=Y_2)  # disabled
explode_4 = Explode(Curve=recgrid.Cells, Recursive=True)  # -> Segments, Vertices; disabled
construct_domain = ConstructDomain(DomainStart=negative, DomainEnd=number_slider_5)
construct_domain_2 = ConstructDomain(DomainStart=Slider(0, range=0..40), DomainEnd=number_slider_6)
panel_12 = Panel("A. GEOMETRI IRISAN")  # disabled
panel_13 = Panel(contour_2)  # disabled
item_4 = ListItem(List=explode_4.Vertices, Index=0, Wrap=True)  # disabled
xy = XYPlane(Origin=item_4)  # disabled
# Pindahkan bidang-bidang ini agar dapat dipotong.
unit_z_3 = UnitZ(Factor=number_slider_6)
# Obyek Plane Surface digunakan untuk membuat bidang-bidang radial vertikal.
plane_surface = PlaneSurface(Plane=perp_frame_2, XSize=construct_domain, YSize=construct_domain_2)
panel_14 = Panel("B. TEKS")  # disabled
panel_15 = Panel(yz)  # disabled
move_5 = Move(Geometry=xy, Motion=addition_3)  # -> Geometry, Transform; disabled
ukuran_teks_2 = Slider(0.25, range=0..1)  # disabled
short = ShortList(ListA=flatten(contour_2), ListB=yz, ListC=flatten(xy), TrimMode=2)  # -> ListA, ListB, ListC; disabled
short_2 = ShortList(ListA=flatten(move_5.Geometry), ListB=concat, TrimMode=2)  # -> ListA, ListB; disabled
move_6 = Move(Geometry=plane_surface, Motion=unit_z_3)  # -> Geometry, Transform
panel_16 = Panel("C. GRID")  # disabled
panel_17 = Panel(xy)  # disabled
short_3 = ShortestList(TrimMode=2)  # -> ListA, ListB; disabled
# Potong bidang agar dapat diproduksi bilah-bilah vertikal.
brep_brep = BrepBrep(BrepA=reference_brep, BrepB=move_6.Geometry)  # -> Curves, Points

# ---- group: Geometri Irisan
orient = Orient(Geometry=short.ListA, Source=short.ListB, Target=short.ListC)  # -> Geometry, Transform; disabled

# ---- group: Teks Irisan
tag_3 = TextTag3D(Location=short_2.ListA, Text=short_2.ListB, Size=ukuran_teks_2, Justification=7)  # disabled

# ----
integer = Integer(number_slider_4)
# 2.3 Cull the top and bottom ribs
integer_2 = Integer(0)
cull_index = CullIndex(List=flatten(brep_plane.Curves), Indices=[integer, integer_2], Wrap=True)

panel_18 = Panel(brep_brep.Curves)
item_5 = ListItem(List=flatten(brep_brep.Curves), Index="0", Wrap=True)
item_6 = ListItem(List=cull_index, Index="6", Wrap=True)
# 3.2 Membuat bilah horizontal dan bidang sambungan (Subtractor),
curve_3 = Curve(flatten(cull_index))
# 3. MEMBUAT BILAH VERTIKAL DAN BIDANG SAMBUNGAN (SUBTRACTOR)
# 3.1 Membuat bilah vertikal dan bidang sambungan (Subtractor),
curve_4 = Curve(flatten(brep_brep.Curves))
planar_2 = Planar(Curve=curve_4)  # -> Planar, Plane, Deviation
number_slider_7 = Slider(2, range=0..20)
planar_3 = Planar(Curve=curve_3)  # -> Planar, Plane, Deviation
number_slider_8 = Slider(2, range=0..20)
division = Division(A=number_slider_7, B=Slider(2.5, range=0..10))
# Kurva Tengah
offset_2 = Offset(Curve=curve_4, Distance=division, Plane=planar_2.Plane, Corners=1)
# Kurva Luar 2
offset_3 = Offset(Curve=curve_4, Distance=Slider(3, range=0..20), Plane=planar_2.Plane, Corners=1)
# Kurva Luar
offset_4 = Offset(Curve=curve_4, Distance=number_slider_7, Plane=planar_2.Plane, Corners=1)
# Kurva dalam (Graft)
graft_tree = GraftTree(Tree=curve_4, IncludeEmptyLists=True, IncludeNullItems=True)
negative_2 = Negative(Value=Slider(3, range=0..20))
division_2 = Division(A=number_slider_8, B=Slider(2, range=0..10))
# Kurva Luar
offset_5 = Offset(Curve=curve_3, Distance=number_slider_8, Plane=planar_3.Plane, Corners=1)
# Kurva Tengah
offset_6 = Offset(Curve=curve_3, Distance=division_2, Plane=planar_3.Plane, Corners=1)
# Kurva dalam 2
offset_7 = Offset(Curve=curve_3, Distance=negative_2, Plane=planar_3.Plane, Corners=1)
# Kurva dalam (Graft)
graft_tree_2 = GraftTree(Tree=curve_3, IncludeEmptyLists=True, IncludeNullItems=True)
panel_19 = Panel(graft_tree)
# Bidang Vertikal
loft = Loft(
    Curves=[offset_4, graft_tree],
    Options={Adjust=False, Closed=False, LoftEnds=0, LoftSimp=0, LoftType=0, Rebuild=10, Refit=0.01})
# Pengurang (Substractor)
loft_2 = Loft(
    Curves=[offset_2, offset_3],
    Options={Adjust=False, Closed=False, LoftEnds=0, LoftSimp=0, LoftType=0, Rebuild=10, Refit=0.01})
# Bidang horizontal
loft_3 = Loft(
    Curves=[offset_5, graft_tree_2],
    Options={Adjust=False, Closed=False, LoftEnds=0, LoftSimp=0, LoftType=0, Rebuild=10, Refit=0.01})
# Pengurang (Substractor)
loft_4 = Loft(
    Curves=[offset_6, offset_7],
    Options={Adjust=False, Closed=False, LoftEnds=0, LoftSimp=0, LoftType=0, Rebuild=10, Refit=0.01})
# 4. MEMBUAT SAMBUNGAN SLIT ANTAR BIDANG-BIDANG
# 4.1 Slit pada bidang-bidang vertikal dengan ketebalan material bidang horizontal
# Bidang Vertikal
data = Data(loft)
# Pengurang (Substractor)
# Horizontal
# Parameter ketebalan material bilah (1 sisi)
data_2 = Data(loft_4)
# Bidang horizontal
data_3 = Data(loft_3)
# Pengurang (Substractor)
# Vertikal
# Parameter ketebalan material bilah (1 sisi)
data_4 = Data(loft_2)
wires_2 = BrepWireframe(Brep=[data, data_2], Density=-1)
brep_4 = Brep(flatten(data_2))
brep_5 = Brep(flatten(data))
# Ambil kurva bilah horizontal. Dengan parameter 1/2 ketebalan material, pindahkan ke bawah (sumbu Z).
# Nilai dari paramter ketebalan dikalikan 2 sebagai parameter extrude bilah horizontal.
number_slider_9 = Slider(0.2, range=0..1)
# 4.2 Slit pada bidang-bidang horizontal dengan ketebalan material bidang vertikal
brep_6 = Brep(flatten(data_3))
brep_7 = Brep(flatten(data_4))
is_planar = IsPlanar(Surface=brep_4, Interior=True)  # -> Planar, Plane
is_planar_2 = IsPlanar(Surface=brep_7, Interior=True)  # -> Planar, Plane
deconstruct_plane = DeconstructPlane(Plane=is_planar.Plane)  # -> Origin, XAxis, YAxis, ZAxis
amplitude = Amplitude(Vector=deconstruct_plane.ZAxis, Amplitude=number_slider_9)
deconstruct_plane_2 = DeconstructPlane(Plane=is_planar_2.Plane)  # -> Origin, XAxis, YAxis, ZAxis
negative_3 = Negative(Value=amplitude)
amplitude_2 = Amplitude(Vector=deconstruct_plane_2.ZAxis, Amplitude=Slider(0.2, range=0..1))
move_7 = Move(Geometry=brep_4, Motion=negative_3)  # -> Geometry, Transform
negative_4 = Negative(Value=amplitude_2)
multiplication = Multiplication(A=amplitude, B="2")
multiplication_2 = Multiplication(A=amplitude_2, B="2")
move_8 = Move(Geometry=brep_7, Motion=negative_4)  # -> Geometry, Transform
extrude = Extrude(Base=move_7.Geometry, Direction=multiplication)
extrude_2 = Extrude(Base=move_8.Geometry, Direction=multiplication_2)
trim_solid = TrimSolid(Shape=brep_5, Cutters=extrude)  # -> flatten(Result)
trim_solid_2 = TrimSolid(Shape=brep_6, Cutters=extrude_2)  # -> flatten(Result)

# ----
# 5.3 Buat kotak untuk panduan obyek potong
number_slider_10 = Slider(60, range=0..100)
rectangular = Rectangular(
    Plane=PlaneXY(0, 0, 0),
    SizeX=number_slider_10,
    SizeY=number_slider_10,
    ExtentX=Slider(15, range=0..100),
    ExtentY=Slider(1, range=0..100))  # -> Cells, Points

# ----
# 5. MENYUSUN GEOMETRI UNTUK PEMOTONGAN
# 5.1 Buat kotak untuk panduan obyek potong
number_slider_11 = Slider(60, range=0..100)
rectangular_2 = Rectangular(
    Plane=PlaneXY(0, 0, 0),
    SizeX=number_slider_11,
    SizeY=number_slider_11,
    ExtentX=Slider(12, range=0..100),
    ExtentY=Slider(1, range=0..100))  # -> Cells, Points

move_9 = Move(Geometry=rectangular.Cells, Motion="0,60,0")  # -> Geometry, Transform

# ----
# 5.4 Menyusun bidang-bidang horizontal
area_3 = Area(Geometry=move_9.Geometry)  # -> Area, Centroid
unit_y = UnitY(Factor=number_slider_10)
xy_plane = XYPlane(Origin=area_3.Centroid)
move_10 = Move(Geometry=xy_plane, Motion=unit_y)  # -> Geometry, Transform
orient_2 = Orient(Geometry=trim_solid_2, Source=is_planar.Plane, Target=flatten(xy_plane))  # -> Geometry, Transform

# ----
# 5.2 Menyusun bidang-bidang vertikal
area_4 = Area(Geometry=rectangular_2.Cells)  # -> Area, Centroid
xy_plane_2 = XYPlane(Origin=area_4.Centroid)
orient_3 = Orient(Geometry=trim_solid, Source=is_planar_2.Plane, Target=flatten(xy_plane_2))  # -> Geometry, Transform
