# Grasshopper definition Dasar Form Finding.gh (Grasshopper 1.0.7)
# plug-ins: MeshEdit Components, Pufferfish, Kangaroo Components, Bifocals, Weaverbird, Kangaroo2 Components

# ----
# Membuat kurva dari persamaan untuk kemudian menghasilkan titik-titik
# Faktor yang menentukan lebar kelengkungan
# Faktor yang menentukan panjang kelengkungan
# Banyaknya titik segmen pada lengkungan.
# Nilai ini akan mempengaruhi posisi Anchor
number_slider = Slider(6.5, range=0..100)
number_slider_2 = Slider(36, range=4..64)
pi = Pi(Factor=Slider(0.78, range=0..6))
range = Range(Domain=pi, Steps=number_slider_2)
expression = Expression(A=number_slider, t=range, Expression="A*t*sin(t)")
expression_2 = Expression(A=number_slider, t=range, Expression="A*t*cos(t)")

# ----
# Bifocals
panel = Panel("Parameter grid Mesh")  # disabled
number_slider_3 = Slider(10, range=4..12)  # disabled
number_slider_4 = Slider(10, range=4..12)  # disabled
# Simple Tensile adalah bentuk konstruksi permukaan/ bidang yang dihasilkan dari beban-beban tarik yang bekerja pada titik-titik angkur. Bidang yang dihasilkan merupkan konvergensi dari elastisitas material dan kekuatan tarik.
# 1. Simple Tensile Structure
panel_2 = Panel("Geoemetri berupa Rectangle")  # disabled

number_slider_5 = Slider(11, range=0..100)
panel_3 = Panel("Ukuran rectangle")
rectangle = Rectangle(Plane=PlaneXY(0, 0, 0), XSize=number_slider_5, YSize=number_slider_5, Radius=0)  # -> Rectangle, Length

# ----
# CATENARY
# STRUCTURE
number_slider_6 = Slider(10, range=0..100)

# ----
# Base geometry berupa Ractangle
geo = Geometry(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)  # disabled
# BASIC
# FORM-FINDING
# TENSILE STRUCTURE
geo_2 = Geometry(<curve referenced from the Rhino model>)  # disabled

# ----
# 4. Tensile Cone
# Buat Rectangle Mesh dengan lubang menggunakan MeshPatch pada Rhinoceros
mesh = Mesh(<mesh referenced from the Rhino model>)  # disabled
combine_clean = CombineClean(Meshes=mesh)  # disabled
number_slider_7 = Slider(3, range=1..6)  # disabled
refine = Refine(Mesh=combine_clean, Level=number_slider_7)  # disabled
mesh_2 = Mesh(refine)  # disabled
medges = MeshEdges(Mesh=mesh_2)  # -> NakedEdges, InteriorEdges, NonManifoldEdges; disabled

number_slider_8 = Slider(18, range=0..100)  # disabled

# ----
# Jika akan memetakan posisi Z pada setiap titik
number_slider_9 = Slider(0, range=0..100)
multiplication = Multiplication(A=range, B=number_slider_9)

mplane = MeshPlane(Boundary=geo, WidthCount=number_slider_3, HeightCount=number_slider_4)  # -> Mesh, Area; disabled
# Aswin Indraprastha
# 
# Program Studi Arsitektur
# Sekolah Arsitektur, Perencanaan, dan Pengembangan Kebijakan
# Institut Teknologi Bandung
# 
# aswin@itb.ac.id
# 1. Obyek Simulasi
# DASAR-DASAR
# PEMAHAMAN
# Kangaroo - Springs
geo_3 = Geometry(<curve referenced from the Rhino model>)
# Kangaroo - Show Mesh
# Buat Line dari Point sepanjang 10 ke arah Z
number_slider_10 = Slider(10, range=0..10)
# Ini adalah Multiple Points yang menjadi TARGET ANCHOR untuk kontraksi/ relaksasi LENGTH dari edge pada permukaan mesh.
pt = Point([<point referenced from the Rhino model> x4])  # disabled
panel_4 = Panel("Rectangle sebagai referensi")

# ----
# Mesh Edge menentukan tiga jenis Edge dari sebuah Mesh:
# 1. Naked Edge: Edge pada perimeter
# 2. Interior Edge: Edge pada bagian dalam mesh
# 3. Non maniforld: Edge yang terduplikasi
# Mesh Corner menentukan koordinat setiap titik sudut mesh
corners = Corners(mesh=mplane.Mesh)  # disabled
medges_2 = MeshEdges(Mesh=mplane.Mesh)  # -> NakedEdges, InteriorEdges, NonManifoldEdges; disabled
panel_5 = Panel(".6")  # disabled
points = PointList(Points=corners, Size=panel_5)  # disabled

pt_2 = Point(<point referenced from the Rhino model>)
# MeshPlane dengan input boundary dan jumlah grid
mplane_2 = MeshPlane(Boundary=geo_2, WidthCount=number_slider_8, HeightCount=number_slider_8)  # -> Mesh, Area; disabled
line = Line(geo_3)

# ----
# Stiffness, Nilai default=500. Kekakuan spring. Semakin tinggi nilai, semakin cepat kembali ke bentuk asal/rest length
# DAMPING, NIlai Default=10. Nilai bouncing spring. Semakin rendah nilainya, semakin bouncing.
# Kangaroo - Anchor Points
# REST LENGTH adalah panjang yang menjadi goal/tujuan.
panel_6 = Panel("2")
# 2. Beban/ Gaya yang Bekerja
panel_7 = Panel("250")
# F1:Spring Force
springs = SpringsFromLine(
    Connection=line,
    Stiffness=panel_7,
    Damping=panel_6,
    RestLength=Slider(4, range=0..25),
    UpperCutoff=0,
    LowerCutoff=0,
    Plasticity=0)

Z = UnitZ(Factor=1)
geo_4 = Geometry(<curve referenced from the Rhino model>)

# ----
# Geometri untuk meletakkan titik-titik anchor
geo_5 = Geometry(<brep referenced from the Rhino model>)  # disabled
wires = BrepWireframe(Brep=geo_5, Density=-1)  # disabled

panel_8 = Panel("Banyaknya titik random")
# Membuat permukaan dari kombinasi lingkaran random
number_slider_11 = Slider(7, range=0..10)
panel_9 = Panel("Domain radius Circle")
pop2d = Populate2D(Region=rectangle.Rectangle, Count=number_slider_11, Seed=1)
dom = ConstructDomain(DomainStart=Slider(0.85, range=0..1), DomainEnd=Slider(2.5, range=0..10))
lng = ListLength(List=pop2d)
random = Random(Range=lng, Number=dom, Seed=2)
cir = Circle(Plane=pop2d, Radius=random)

# ----
# Ini adalah parameter menentukan panjang final (rest length)
number_slider_12 = Slider(5, range=0..10)
# Ini adalah parameter menentukan kekuatan mempertahankan panjang awal (default=10)
number_slider_13 = Slider(7.3, range=0.5..10)

# ----
# Buat lingkaran yang akan menjadi puncak
curve = Curve(<curve referenced from the Rhino model>)  # disabled

# ----
# Buat empat titik pada sudut-sudut Rectangle
point = Point([<point referenced from the Rhino model> x4])  # disabled

# ----
# Jadikan Mesh Plane dengan parameter grid W dan grid H
mplane_3 = MeshPlane(Boundary=geo_4, WidthCount=number_slider_6, HeightCount=Slider(10, range=0..100))  # -> Mesh, Area

# ----
# Konversi titik-titik menjadi kurva
pt_3 = ConstructPoint(XCoordinate=expression, YCoordinate=expression_2, ZCoordinate=multiplication)
intcrv = Interpolate(Vertices=pt_3, Degree=3, Periodic=False, KnotStyle=1)  # -> Curve, Length, Domain

# ----
# Cek panjang setiap edge
# Ini adalah parameter untuk mengontrol sejauh mana kontraksi/pemendekan atau relaksasi/pemanjangan interior edges
crv = Curve(medges_2.NakedEdges)  # disabled
crv_2 = Curve(medges_2.InteriorEdges)  # disabled
number_slider_14 = Slider(0.45, range=0.1..1.2)  # disabled
len = Length(Curve=[crv, crv_2])  # disabled
multiplication_2 = Multiplication(A=len, B=number_slider_14)  # disabled

# ----
# Ini adalah parameter untuk mengontrol sejauh mana kontraksi/pemendekan atau relaksasi/pemanjangan perimeter edges
number_slider_15 = Slider(0.4, range=0.1..1)  # disabled
len_2 = Length(Curve=crv)  # disabled
multiplication_3 = Multiplication(A=len_2, B=number_slider_15)  # disabled

number_slider_16 = Slider(1, range=0..1)  # disabled
join_curves = JoinCurves(Curves=medges.NakedEdges, Preserve=False)  # disabled
panel_10 = Panel("Tentukan perimeter edge")  # disabled
item = ListItem(List=join_curves, Index=number_slider_16, Wrap=True)  # disabled

flipm = FlipMesh(VertexNormals=True, FaceNormals=True, FaceOrientation=True)

# ----
# Gaya tekan ke atas yang bekerja pada setiap titik vertices pada mesh
number_slider_17 = Slider(1, range=0..10)  # disabled
Z_2 = UnitZ(Factor=number_slider_17)  # disabled
# Pressure
pressure = Pressure(M=mplane_2.Mesh, Strength=Z_2)  # disabled

number_slider_18 = Slider(0.5, range=0..1.5)  # disabled
number_slider_19 = Slider(6, range=0..10)  # disabled

number_slider_20 = Slider(48, range=0..100)  # disabled

pt_4 = Point([<point referenced from the Rhino model> x4])  # disabled

# ----
# Tentukan Mesh Corner yang akan menjadi titik-titik angkur
# Komponen Anchor bekerja dengan menetapkan mana saja Points yang menjadi angkur dan mana saja point yang bisa dimodifikasi lokasinya
# Ini adalah empat titik yang lokasinya dapat diubah-ubah menggunakan fasilitas Gumball di Rhinoceros
number_slider_21 = Slider(1000, range=0..1000)  # disabled
mc = MeshCorners(Mesh=mplane_2.Mesh, Angle=2.35619449)  # disabled
# Anchor
anchor = Anchor(Point=mc, Target=pt_4, Strength=number_slider_21)  # disabled

line_2 = LineSDL(Start=pt_2, Direction=Z, Length=number_slider_10)

# ----
# Temukan keempat pojok obyek Mesh dan tetapkan sebagai angkur.
number_slider_22 = Slider(175, range=0..200)
# Anchor
mc_2 = MeshCorners(Mesh=mplane_3.Mesh, Angle=2.35619449)
anchor_2 = Anchor(Point=mc_2, Strength=number_slider_22)

runion = RegionUnion(Curves=cir)

panel_11 = Panel("Tinggi balok cincin")
Z_3 = UnitZ(Factor=Slider(3, range=0..10))
move = Move(Geometry=runion, Motion=Z_3)  # -> Geometry, Transform

# ----
# Tentukan nilai t dari kurva
# Tentukan nilai tangen setiap titik dari kurva
crv_cp = CurveClosestPoint(Point=pt_3, Curve=intcrv.Curve)  # -> Point, Parameter, Distance
# Modifikasi points untuk memproduksi Mesh
eval = EvaluateCurve(Curve=intcrv.Curve, Parameter=crv_cp.Parameter)  # -> Point, Tangent, Angle

# ----
# Generate points dari Mesh dan tentukan Uniary Force di setiap titik
demesh = DeconstructMesh(Mesh=mplane_3.Mesh)  # -> Vertices, Faces, Colours, Normals
Z_4 = UnitZ(Factor=Slider(-0.383, range=-10..10))
# Unary
load = Load(Point=demesh.Vertices, ForceVector=Z_4)

# ----
# Edge Length
# Edge Length adalah komponen yang akan memodifikasi mesh berdasarkan panjang edge-nya
edgelengths = EdgeLengths(Mesh=mplane_2.Mesh, LengthFactor=number_slider_18, Strength=number_slider_19)  # disabled

# ----
# Length
# Komponen Length akan membuat setiap segmen/edge akan mempertahankan panjangnya
medges_3 = MeshEdges(Mesh=mplane_3.Mesh)  # -> NakedEdges, InteriorEdges, NonManifoldEdges
length_line = LengthLine(Line=[medges_3.NakedEdges, medges_3.InteriorEdges], Length=Slider(0.6, range=0..1), Strength=Slider(19, range=0..100))

# ----
# Rotasikan vektor tangen setiap titik sehingga tegak lurus titik
panel_12 = Panel("90")
Z_5 = UnitZ(Factor=1)
vrot = Rotate(Vector=eval.Tangent, Axis=Z_5, Angle=degrees(panel_12))

anchor_3 = Anchor(Point=pt_2, Strength=10000)

# ----
# Constraints
length_line_2 = LengthLine(Line=line_2, Length=number_slider_12, Strength=number_slider_13)

# ----
# Interior Edges Constraints
# Control pada Interior Edge:
# Line= panjang edge eksisting
# Length= panjang rest length
length_line_3 = LengthLine(Line=crv_2, Length=multiplication_2, Strength=10)  # disabled

# ----
# Anchor Constraints
# Kontrol pada angkur dan titik-titik angkur baru yang ditentukan sendiri
anchor_4 = Anchor(Point=corners, Target=pt, Strength=10000)  # disabled

# ----
# Naked Edges Constraints
# Control pada Naked Edge/ Perimeter Edge:
# Line= panjang edge eksisting
# Length= panjang rest length
length_line_4 = LengthLine(Line=crv, Length=multiplication_3, Strength=number_slider_20)  # disabled

explode = Explode(Curve=item, Recursive=True)  # -> Segments, Vertices; disabled
number_slider_23 = Slider(969.805, range=0..2000)  # disabled
# OnCurve
end_points = EndPoints(Curve=explode.Segments)  # -> Start, End; disabled
oncurve = OnCurve(Points=end_points.Start, Curve=curve, Strength=number_slider_23)  # disabled

show = Show(G=mplane.Mesh)  # disabled

panel_13 = Panel("Tombol RESET/ SIMULASI")
# Ini adalah mesin fisik (Physics Engine) untuk simulasi beban dan gaya. Semua beban masuk dalam input Force Objects (Flatten)
kangaroo = KangarooPhysics(ForceObjects=springs, Settings=null, Geometry=line, SimulationReset=Button())  # -> Out, Iterations, ParticlesOut, GeometryOut, KE
panel_14 = Panel("TIMER, lama simulasi")
timer = Timer(TimerInterval=20, Target=kangaroo)

number_slider_24 = Slider(2, range=0..100)  # disabled
number_slider_25 = Slider(0.122, range=0..1)  # disabled

number_slider_26 = Slider(32, range=0..100)  # disabled
number_slider_27 = Slider(0.122, range=0..1)  # disabled

# ----
# Lantai paviliun
boundary = BoundarySurfaces(Edges=runion)
number_slider_28 = Slider(0.18, range=0..1)
Z_6 = UnitZ(Factor=number_slider_28)
extr = Extrude(Base=boundary, Direction=Z_6)

# ----
# Anchor
anchor_5 = Anchor(Point=point, Strength=10000)  # disabled

# ----
# Banyaknya titik array. Ini akan berhubungan juga dengan penentuan titik-titik Anchor
# Array linier setiap titik sesuai vektor tegak lurus terhadap kurva.
panel_15 = Panel("Tebal array")
number_slider_29 = Slider(13, range=4..16)
amp = Amplitude(Vector=vrot, Amplitude=Slider(0.6, range=0.25..10))
arrlinear = LinearArray(Geometry=eval.Point, Direction=amp, Count=number_slider_29)  # -> Geometry, Transform

show_2 = Show(G=mplane_3.Mesh)

# ----
# Atap Paviliun
# Konversi surface menjadi Mesh
boundary_2 = BoundarySurfaces(Edges=move.Geometry)
mesh_3 = Mesh(boundary_2)

# ----
# Mesin Solver
# Perhatikan: Simulasi mencapai kestabilan dan hasil final ketika sudah CONVERGED
panel_16 = Panel(".8")
bouncysolver = BouncySolver(
    GoalObjects=[length_line_2, anchor_3],
    Reset=Button(),
    Threshold=1e-15,
    Tolerance=0.01,
    Damping=panel_16,
    Iterations=10,
    On=True)  # -> I, V, O

# ----
# Mesin Solver
button = Button()
solver = Solver(GoalObjects=[length_line_2, anchor_3], Reset=button, Threshold=1e-15, Tolerance=0.01, On=True)  # -> I, V, O

# ----
# Length
length_line_5 = LengthLine(Line=medges.NakedEdges, Length=number_slider_27, Strength=number_slider_26)  # disabled

# ----
# Length
length_line_6 = LengthLine(Line=medges.InteriorEdges, Length=number_slider_25, Strength=number_slider_24)  # disabled

# ----
# Susun semua Constraints dalam satu cabang, dan yang lain (Show) pada cabang lain menggunakan Entwine
entwine = Entwine(Branch00=show, Branch01=[length_line_3, anchor_4, length_line_4], FlattenInputs=True)  # disabled

# ----
# Banyaknya titik segmen pada bentuk gabungan lingkaran
number_slider_30 = Slider(30, range=0..100)

# ----
# Jadikan obyek hasil solver menjadi surface
# SOLVER merupakan komponen engine yang akan mencari bentuk berdasarkan beberapa beban yang bekerja sehingga konvergen
button_2 = Button()  # disabled
solver_2 = Solver(GoalObjects=flatten([edgelengths, anchor, pressure]), Reset=button_2, Threshold=1e-15, Tolerance=0.01, On=True)  # -> I, V, O; disabled
wbweave = WeaverbirdsMeshFromLinesWeaveBack(Lines=solver_2.O, MaximumValence=flatten(4))  # disabled

button_3 = Button()  # disabled
toggle = BooleanToggle(True)  # disabled

# ----
# Ekstrak mesh menjadi vertices
nv = NakedVertices(Mesh=mesh_3)  # -> ClothedIndex, NakedIndex, ClothedPts, NakedPts
x_plus_one = XPlusOne(NumberX=number_slider_2)
# Pilih titik segmen secara selang-seling
divide = DivideCurve(Curve=move.Geometry, Count=number_slider_30, Kinks=False)  # -> Points, Tangents, Parameters

reset = Button()

merge = Merge(Data1=length_line, Data2=anchor_2, Data3=load)
solver_3 = Solver(GoalObjects=flatten(merge), Reset=reset, Threshold=1e-15, Tolerance=0.01, On=Toggle(True))  # -> I, V, O
data = Data(solver_3.O)
wbweave_2 = WeaverbirdsMeshFromLinesWeaveBack(Lines=data, MaximumValence=4)

panel_17 = Panel("Tebal balok cincin")
# Balok cincin
number_slider_31 = Slider(0.08, range=0..0.1)
pipe = Pipe(Curve=move.Geometry, Radius=number_slider_31, Caps=0)

frompoints = MeshFromPoints(Points=flatten(arrlinear.Geometry), UDirection=x_plus_one, VDirection=number_slider_29)

# ----
# Seleksi segmen tengah berdasarkan jumlah titik array
# Formula membulatkan ke bawah hasil pembagian
x_minus_one = XMinusOne(NumberX=number_slider_29)
# Menentukan  Segmen Tengah Mesh
explode_2 = MeshExplode(Mesh=frompoints, Interpolate=False)
partition = PartitionList(List=explode_2, Size=x_minus_one)
expression_3 = Expression(x=number_slider_29, Expression="floor(x/2)")
panel_18 = Panel("Segmen terpilih")
item_2 = ListItem(List=partition, Index=expression_3, Wrap=True)  # -> flatten(Item)

# ----
# Menentukan Titik Anchor Points dari Titik Segmen
# Ekstrak hanya edge pada perimeter
# Ekstrak vertices pada edges
# Seleksi vertices sesuai pola Boolean untuk menentukan titik-titik anchor.
# 
# Perhatikan bahwa titik-titik itu harus sedemikian rupa sehingga ada titik-titik di setiap sudut.
wbnaked = WeaverbirdsNakedBoundary(MeshClosedPolylines=frompoints)
explode_3 = Explode(Curve=wbnaked, Recursive=True)  # -> Segments, Vertices
panel_19 = Panel("""True
False
False
False""")
cull = CullPattern(List=explode_3.Vertices, CullPattern=panel_19)

bouncysolver_2 = BouncySolver(GoalObjects=flatten(entwine), Reset=button_3, Threshold=1e-15, Tolerance=0.01, Damping=0.99, Iterations=10, On=toggle)  # -> I, V, O; disabled
show_3 = Show(G=mesh_3)
# Panjang LINE menjadi 4.00m (sesuai REST LENGTH)
geo_6 = Geometry(kangaroo.GeometryOut)
dispatch = Dispatch(List=divide.Points, DispatchPattern=[True, False])  # -> ListA, ListB

panel_20 = Panel("Rest Length")
# Length
edgelengths_2 = EdgeLengths(Mesh=mesh_3, LengthFactor=Slider(0.8, range=0..1), Strength=1)

panel_21 = Panel(geo_6)

# ----
# Faktor kekuatan gaya tekan
number_slider_32 = Slider(1, range=0.5..10)
# Load
Z_7 = UnitZ(Factor=number_slider_32)
load_2 = Load(Point=nv.ClothedPts, ForceVector=Z_7, Weighting=1)

panel_22 = Panel("Hasil geometri")
geo_7 = Geometry(solver.O)

# ----
# Proyeksikan titik-titik ke lantai paviliun
pt_5 = ConstructPoint(XCoordinate=0, YCoordinate=0, ZCoordinate=number_slider_28)
geo_8 = Geometry(dispatch.ListA)
project = Project(Geometry=geo_8, Plane=pt_5)  # -> Geometry, Transform

toggle_2 = BooleanToggle(False)  # disabled
button_4 = Button()  # disabled

merge_2 = Merge(Data1=anchor_5, Data2=length_line_5, Data3=length_line_6, Data4=oncurve)  # disabled
solver_4 = Solver(GoalObjects=merge_2, Reset=button_4, Threshold=1e-15, Tolerance=0.01, On=toggle_2)  # -> I, V, O; disabled
wbweave_3 = WeaverbirdsMeshFromLinesWeaveBack(Lines=solver_4.O, MaximumValence=4)  # disabled

# ----
# Nilai Shift List sehingga titik-titik akan membentuk "V" ketika dihubungkan dengan komponen Line
geo_9 = Geometry(dispatch.ListB)
shift = ShiftList(List=geo_9, Shift=Slider(14, range=0..100), Wrap=True)

boundary_3 = BoundarySurfaces(Edges=wbnaked)

# ----
# Meng-organisasikan keluaran, menyaring keluaran berupa Mesh dan Curves
lng_2 = ListLength(List=entwine)  # -> flatten(Length); disabled
partition_2 = PartitionList(List=bouncysolver_2.O, Size=lng_2)  # disabled
bang = ExplodeTree(Data=partition_2)  # -> Branch0, Branch1; disabled
mesh_4 = Mesh(bang.Branch0)  # disabled
crv_3 = Curve(bang.Branch1)  # disabled

panel_23 = Panel(geo_7)

# ----
# Anchor
# Anchor pada semua titik-titik segmen perimeter
anchor_6 = Anchor(Point=nv.NakedPts, Strength=10000)

banyak_segmen = Slider(12, range=4..24)

# ----
# Menentukan  Titik-Titik Pada Segmen Tengah Mesh
wbjoin = WeaverbirdsJoinMeshesAndWeld(Mesh=item_2, Weld=False)
wbnaked_2 = WeaverbirdsNakedBoundary(MeshClosedPolylines=wbjoin)
series = Series(Start=0, Step=1, Count=x_plus_one)
explode_4 = Explode(Curve=wbnaked_2, Recursive=True)  # -> Segments, Vertices
addition = Addition(A=series, B=Slider(1, range=-1..1))
item_3 = ListItem(List=explode_4.Vertices, Index=addition, Wrap=True)
panel_24 = Panel("Titik-titik terpilih")

# ----
# 1. Obyek Simulasi
crv_4 = Curve(<curve referenced from the Rhino model>)
# Bagi Line menjadi beberapa segmen dan jadikan multisegmen menggunakan komponen Shatter
divide_2 = DivideCurve(Curve=crv_4, Count=banyak_segmen, Kinks=False)  # -> Points, Tangents, Parameters
shatter = Shatter(Curve=crv_4, Parameters=divide_2.Parameters)

# ----
# Jika kita memasukkan gravitasi...
# F2:Unary Force
# Parameter nilai gravitasi.
# Semakin tinggi (+ atau -) berarti semakin cepat simulasinya.
number_slider_33 = Slider(-10, range=-50..50)
Y = UnitY(Factor=number_slider_33)
uforce = UnaryForce(Point=divide_2.Points, Force=Y)

# ----
# Titik-Titik Angkur
# Tentukan Start dan End point untuk menjadi angkur
end = EndPoints(Curve=crv_4)  # -> Start, End

# ----
# Seleksi Titik Tengah dan Pindahkan ke Atas
panel_25 = Panel("""True
False
False
False
False""")
button_5 = Button()
panel_26 = Panel("Titik-titik terseleksi")
not = GateNot(A=button_5)
cull_2 = CullPattern(List=item_3, CullPattern=panel_25)
multiplication_4 = Multiplication(A=Slider(6, range=0..10), B=not)
Z_8 = UnitZ(Factor=multiplication_4)
move_2 = Move(Geometry=cull_2, Motion=Z_8)  # -> Geometry, Transform

# ----
# Casting Geometry ke Line (satu segmen)
line_3 = Line(crv_4)
# Segmen dengan panjang yang sama
line_4 = Line(shatter)

# ----
# 2. Beban/ Gaya yang Bekerja
# Default=500. Kekakuan spring. Semakin tinggi nilai, semakin cepat kembali ke bentuk asal/rest length
# Default=10. Nilai bouncing spring. Semakin rendah nilainya, semakin bouncing.
# Menentukan rest length setiap segmen
panel_27 = Panel("500")
# F1:Spring Force
panel_28 = Panel("8")
springs_2 = SpringsFromLine(
    Connection=line_4,
    Stiffness=panel_27,
    Damping=panel_28,
    RestLength=Slider(1, range=0..25),
    UpperCutoff=0,
    LowerCutoff=0,
    Plasticity=0)

# ----
# Diperlukan jika menggunakan Unary Forces
merge_3 = Merge(Data1=end.Start, Data2=end.End)

# ----
# 3. Simulasi Perilaku Komponen
toggle_3 = BooleanToggle(False)
button_6 = Button()
# Ini adalah mesin fisik (Physics ENgine) untuk simulasi beban dan gaya. Semua beban masuk dalam input Force Objects (Flatten)
kangaroo_2 = KangarooPhysics(
    ForceObjects=flatten([springs_2, uforce]),
    AnchorPoints=merge_3,
    Settings=null,
    Geometry=line_4,
    SimulationReset=toggle_3)  # -> Out, Iterations, ParticlesOut, GeometryOut, KE
timer_2 = Timer(TimerInterval=20, Target=kangaroo_2)

# ----
# Beban pada setiap vertices dari mesh
mesh_5 = Mesh(frompoints)
panel_29 = Panel("Faktor kekuatan beban")
# Load
demesh_2 = DeconstructMesh(Mesh=mesh_5)  # -> Vertices, Faces, Colours, Normals
Z_9 = UnitZ(Factor=Slider(31.6, range=0..100))
uforce_2 = UnaryForce(Point=demesh_2.Vertices, Force=Z_9)

# ----
# Konversi mesh menjadi mesh edges (Weaverbird)
# Parameter kontrol terhadap rest length. Semakin kecil nilainya, semakin kuat kontraksi terhadap panjang eksisting.
mesh_6 = Mesh(frompoints)
wbedges = WeaverbirdsMeshEdges(MeshOrPolylines=mesh_6)
panel_30 = Panel("Panjang setiap edge")
# Length
len_3 = Length(Curve=wbedges)
multiplication_5 = Multiplication(A=len_3, B=Slider(0.598, range=0..1))
springs_3 = SpringsFromLine(Connection=wbedges, Stiffness=1000, Damping=10, RestLength=multiplication_5, UpperCutoff=0, LowerCutoff=0, Plasticity=0)

# ----
# Anchor
titik_tengah = Point(move_2.Geometry)
titik_pinggir = Point(cull)

geo_10 = Geometry(kangaroo_2.GeometryOut)
solver_5 = Solver(GoalObjects=[show_3, edgelengths_2, load_2, anchor_6], Reset=Button(), Threshold=1e-15, Tolerance=0.01, On=Toggle(True))  # -> I, V, O

geo_11 = Geometry(frompoints)
kangaroo_3 = KangarooPhysics(
    ForceObjects=flatten([springs_3, uforce_2]),
    AnchorPoints=[titik_tengah, titik_pinggir],
    Settings=null,
    Geometry=geo_11,
    SimulationReset=button_5)  # -> Out, Iterations, ParticlesOut, GeometryOut, KE
timer_3 = Timer(TimerInterval=20, Target=kangaroo_3)

# ----
# 2. Struktur Tenda 1
geo_12 = Geometry(<curve referenced from the Rhino model>)  # disabled

# ----
# Membuat Bidang Mesh
# MeshPlane dengan input boundary dan jumlah grid
# Ekstrak semua edge pada bidang mesh
number_slider_34 = Slider(24, range=0..100)  # disabled
mplane_4 = MeshPlane(Boundary=geo_12, WidthCount=number_slider_34, HeightCount=number_slider_34)  # -> Mesh, Area; disabled
mesh_7 = Mesh(mplane_4.Mesh)  # disabled
medges_4 = MeshEdges(Mesh=mesh_7)  # -> NakedEdges, InteriorEdges, NonManifoldEdges; disabled

# ----
# Kolom paviliun
ln = Line(StartPoint=project.Geometry, EndPoint=geo_9)
ln_2 = Line(StartPoint=project.Geometry, EndPoint=shift)
join = JoinCurves(Curves=flatten([ln, ln_2]), Preserve=False)

panel_31 = Panel("Kolom \"V\"")
bang_2 = ExplodeTree(Data=solver_5.O)  # -> _0000, _00000

# ----
# Explode sehingga didapatkan Edge, buat line dari mid point edge yang berhadapan
# Move line ke atas dan scale
explode_5 = Explode(Curve=geo_12, Recursive=True)  # -> Segments, Vertices; disabled
number_slider_35 = Slider(3, range=0..10)  # disabled
number_slider_36 = Slider(1, range=0..1)  # disabled
item_4 = ListItem(List=explode_5.Segments, Index=number_slider_36, Wrap=True)  # disabled
item_5 = ListItem(List=explode_5.Segments, Index=number_slider_35, Wrap=True)  # disabled
tinggi_puncak_tenda = Slider(6, range=0..10)  # disabled
# Menentukan Puncak Tenda
curvepoint = PointOnCurve(item_5, parameter=0.5)  # disabled
curvepoint_2 = PointOnCurve(item_4, parameter=0.5)  # disabled
ln_3 = Line(StartPoint=curvepoint, EndPoint=curvepoint_2)  # disabled
panjang_puncak_tenda = Slider(1.2, range=0..10)  # disabled
Z_10 = UnitZ(Factor=tinggi_puncak_tenda)  # disabled
curvepoint_3 = PointOnCurve(ln_3, parameter=0.5)  # disabled
move_3 = Move(Geometry=ln_3, Motion=Z_10)  # -> Geometry, Transform; disabled
scale = Scale(Geometry=move_3.Geometry, Center=curvepoint_3, Factor=panjang_puncak_tenda)  # -> Geometry, Transform; disabled
end_2 = EndPoints(Curve=scale.Geometry)  # -> Start, End; disabled
end_3 = EndPoints(Curve=ln_3)  # -> Start, End; disabled
merge_4 = Merge(Data1=end_2.Start, Data2=end_2.End)  # disabled

mesh_8 = Mesh(bang_2._0000)

# ----
# Besarnya nilai offset dari setiap rangka mesh
# Besarnya nilai subdivisi mesh
# Besarnya nilai ketebalan setiap rangka mesh
number_slider_37 = Slider(6, range=0..10)
wbloop = WeaverbirdsLoopSubdivision(MeshCurves=mesh_8, Level=1, SmoothNakedEdges=1)
wbframe = WeaverbirdsPictureFrame(MeshPolylines=wbloop, Distance=number_slider_37, InsetType=0)
wbthicken = WeaverbirdsMeshThicken(MeshCurves=wbframe, Distance=Slider(0.06, range=0..0.1), OffsetType=0)
wbcatmullclark = WeaverbirdsCatmullClarkSubdivision(MeshCurves=wbthicken, Level=Slider(3, range=0..10), SmoothNakedEdges=1)

panel_32 = Panel("Diameter kolom \"V\"")
mesh_9 = Mesh(kangaroo_3.GeometryOut)
pipe_2 = Pipe(Curve=join, Radius=Slider(0.05, range=0..0.1), Caps=0)
wbloop_2 = WeaverbirdsLoopSubdivision(MeshCurves=mesh_9, Level="3", SmoothNakedEdges=Slider(1, range=0..2))

balok_cincin_paviliun = Geometry(pipe)
lantai_paviliun = Geometry(extr)
atap_dome = Geometry(wbcatmullclark)
kolom_v = Geometry(pipe_2)

# ----
# Titik-titik midpoint pada alas tenda
merge_5 = Merge(Data1=end_3.Start, Data2=end_3.End)  # disabled
panel_33 = Panel("Titik-titik puncak tenda")  # disabled
# Anchor
pt_6 = Point(merge_4)  # disabled
# Anchor
pt_7 = Point(merge_5)  # disabled
anchor_7 = Anchor(Point=pt_7, Target=pt_6, Strength=10000)  # disabled

number_slider_38 = Slider(6.984, range=0..10)  # disabled
panel_34 = Panel("Parameter kelenturan tenda")  # disabled
number_slider_39 = Slider(0.984, range=0..5)  # disabled
# Length
length_line_7 = LengthLine(Line=medges_4.NakedEdges, Length=0, Strength=number_slider_38)  # disabled
length_line_8 = LengthLine(Line=medges_4.InteriorEdges, Length=0, Strength=number_slider_39)  # disabled

# ----
# Tentukan Mesh Corner yang akan menjadi titik-titik angkur
mc_3 = MeshCorners(Mesh=mesh_7, Angle=2.35619449)  # disabled
anchor_8 = Anchor(Point=mc_3, Strength=10000)  # disabled

button_7 = Button()  # disabled
toggle_4 = BooleanToggle(True)  # disabled

merge_6 = Merge(Data1=anchor_7, Data2=anchor_8, Data3=length_line_7, Data4=length_line_8)  # disabled
# Goal Solver
solver_6 = Solver(GoalObjects=flatten(merge_6), Reset=button_7, Threshold=1e-15, Tolerance=0.01, On=toggle_4)  # -> I, V, O; disabled
wbweave_4 = WeaverbirdsMeshFromLinesWeaveBack(Lines=solver_6.O, MaximumValence=4)

# ----
# 2. Struktur Tenda 2
# Geoemetri berupa Rectangle sebagai basis tenda
# MeshPlane dengan input boundary dan jumlah grid
geo_13 = Geometry(<curve referenced from the Rhino model>)  # disabled
number_slider_40 = Slider(12, range=0..100)  # disabled
mplane_5 = MeshPlane(Boundary=geo_13, WidthCount=number_slider_40, HeightCount=number_slider_40)  # -> Mesh, Area; disabled
mesh_10 = Mesh(mplane_5.Mesh)  # disabled

number_slider_41 = Slider(3, range=0..3)  # disabled
number_slider_42 = Slider(1, range=0..3)  # disabled
explode_6 = Explode(Curve=geo_13, Recursive=True)  # -> Segments, Vertices; disabled
item_6 = ListItem(List=explode_6.Segments, Index=number_slider_41, Wrap=True)  # disabled
# Menentukan Lengkung di Tengah Rectangle
item_7 = ListItem(List=explode_6.Segments, Index=number_slider_42, Wrap=True)  # disabled
tinggi_puncak = Slider(6, range=0..16)  # disabled
curvepoint_4 = PointOnCurve(item_7, parameter=0.5)  # disabled
curvepoint_5 = PointOnCurve(item_6, parameter=0.5)  # disabled
Z_11 = UnitZ(Factor=tinggi_puncak)  # disabled
ln_4 = Line(StartPoint=curvepoint_4, EndPoint=curvepoint_5)  # disabled
banyak_points_pada_alas_tenda = Slider(24, range=0..100)  # disabled
move_4 = Move(Geometry=ln_4, Motion=Z_11)  # -> Geometry, Transform; disabled
merge_7 = Merge(Data1=curvepoint_4, Data2=curvepoint_5)  # disabled
curvepoint_6 = PointOnCurve(move_4.Geometry, parameter=0.5)  # disabled

panel_35 = Panel("Rangka Arc")  # disabled
panel_36 = Panel("Points pada alas")  # disabled
arc = Arc3Pt(PointA=curvepoint_4, PointB=curvepoint_6, PointC=curvepoint_5)  # -> Arc, Plane, Radius; disabled
divide_3 = DivideCurve(Curve=ln_4, Count=banyak_points_pada_alas_tenda, Kinks=False)  # -> Points, Tangents, Parameters; disabled
number_slider_43 = Slider(10, range=1..20)  # disabled
oncurve_2 = OnCurve(Points=divide_3.Points, Curve=arc.Arc, Strength=number_slider_43)  # disabled

number_slider_44 = Slider(0.239, range=0..10)  # disabled
number_slider_45 = Slider(1.172, range=0..10)  # disabled

medges_5 = MeshEdges(Mesh=mesh_10)  # -> NakedEdges, InteriorEdges, NonManifoldEdges; disabled
# OnCurve
length_line_9 = LengthLine(Line=medges_5.InteriorEdges, Length=0, Strength=number_slider_44)  # disabled
# Length
length_line_10 = LengthLine(Line=medges_5.NakedEdges, Length=0, Strength=number_slider_45)  # disabled

mc_4 = MeshCorners(Mesh=mesh_10, Angle=2.35619449)  # disabled
# Anchor 2
anchor_9 = Anchor(Point=mc_4, Strength=10000)  # disabled

pt_8 = Point(merge_7)  # disabled
# Anchor 1
anchor_10 = Anchor(Point=pt_8, Strength=10000)  # disabled

toggle_5 = BooleanToggle(True)  # disabled
button_8 = Button()  # disabled

merge_8 = Merge(Data1=anchor_10, Data2=anchor_9, Data3=length_line_10, Data4=length_line_9, Data5=oncurve_2)  # disabled
solver_7 = Solver(GoalObjects=merge_8, Reset=button_8, Threshold=1e-15, Tolerance=0.01, On=toggle_5)  # -> I, V, O; disabled
wbweave_5 = WeaverbirdsMeshFromLinesWeaveBack(Lines=solver_7.O, MaximumValence=4)  # disabled

# ==== cluster Corners: Find the boundary corner points of a quad mesh
mesh = ClusterInput()
mesh_2 = Mesh(mesh)
nv = NakedVertices(Mesh=mesh_2)  # -> ClothedIndex, NakedIndex, ClothedPts, NakedPts
vn = VertexNeighbours(Mesh=mesh_2, VertexNumber=nv.NakedIndex)  # -> graft(Vertex), Neighbours, Normal
lng = ListLength(List=vn.Neighbours)
equals = Equality(FirstNumber=lng, SecondNumber=3)  # -> Equality, Inequality
cull = CullPattern(List=vn.Vertex, CullPattern=equals.Inequality)
pshift = ShiftPaths(Data=cull, Offset=-1)
D = ClusterOutput(pshift)
