# Grasshopper definition Dasar Form-Finding 2.gh (Grasshopper 1.0.7)
# plug-ins: Pufferfish, Kangaroo Components, Bifocals, Kangaroo2 Components

# Bifocals
number_slider = Slider(3, range=0..10)  # disabled
# Aswin Indraprastha
# 
# Program Studi Arsitektur
# Sekolah Arsitektur, Perencanaan, dan Pengembangan Kebijakan
# Institut Teknologi Bandung
# 
# aswin@itb.ac.id
# MODEL
# TENSEGRITY
number_slider_2 = Slider(1.5, range=0..10)  # disabled
number_slider_3 = Slider(2.4, range=0..10)  # disabled
panel = Panel("Profil geometri Tensegrity")  # disabled
panel_2 = Panel("Duplikasi profil")  # disabled
# Geometri dasar berupa Polygon
number_slider_4 = Slider(7, range=3..24)  # disabled
number_slider_5 = Slider(5, range=5..12)  # disabled
# Copy Polygon ke sumbu Z
number_slider_6 = Slider(12, range=5..24)  # disabled

# ----
# Menentukan garis-garis horizontal dengan parameter jarak antar garis, panjang garis
number_slider_7 = Slider(15, range=10..20)  # disabled
# GRIDSHELL
# 3. Gridshell
number_slider_8 = Slider(1, range=1..5)  # disabled
panel_3 = Panel("10")  # disabled
panel_4 = Panel("0")  # disabled
series = Series(Start=panel_4, Step=number_slider_8, Count=panel_3)  # disabled
X = UnitX(Factor=1)  # disabled
pt = ConstructPoint(XCoordinate=0, YCoordinate=series, ZCoordinate=0)  # disabled
line = LineSDL(Start=pt, Direction=X, Length=number_slider_7)  # disabled

number_slider_9 = Slider(22, range=6..36)
# PNEUMATIC
number_slider_10 = Slider(13, range=6..36)
# 3. Pneumatic
rectangle = Rectangle(Plane=PlaneXY(0, 0, 0), XSize=number_slider_10, YSize=number_slider_9, Radius=0)  # -> Rectangle, Length
mplane = MeshPlane(Boundary=rectangle.Rectangle, WidthCount=number_slider_10, HeightCount=number_slider_9)  # -> Mesh, Area

pt_2 = Point(<point referenced from the Rhino model>)  # disabled
polygon = Polygon(Plane=PlaneXY(0, 0, 0), Radius=number_slider_2, Segments=number_slider, FilletRadius=0)  # -> Polygon, Length; disabled
Z = UnitZ(Factor=number_slider_3)  # disabled

# ----
# Membagi semua Edge pada Mesh Plane menjadi dua kelompok: Warp dan Weft (horizontal dan vertikal)
# Tentukan titik-titik pojok Mesh Plane
number_slider_11 = Slider(12, range=6..36)  # disabled
number_slider_12 = Slider(24, range=6..36)  # disabled
panel_5 = Panel("Menentukan bidang planar")  # disabled
# BENDING
# ACTIVE
# PLATE
# 1. Bending-active Plate
pt_3 = Point(Point(0, 0, 0))  # disabled
rectangle_2 = Rectangle(Plane=pt_3, XSize=number_slider_12, YSize=number_slider_11, Radius=0)  # -> Rectangle, Length; disabled
mplane_2 = MeshPlane(Boundary=rectangle_2.Rectangle, WidthCount=number_slider_12, HeightCount=number_slider_11)  # -> Mesh, Area; disabled
warpweft = WarpWeft(Mesh=mplane_2.Mesh)  # -> Warp, Weft, NakedA, NakedB; disabled
number_slider_13 = Slider(0.6, range=0..1)  # disabled
corners = Corners(mesh=mplane_2.Mesh)  # disabled
points = PointList(Points=corners, Size=number_slider_13)  # disabled

# ----
# HYBRID
# 2. Hybrid (Tension & Compression)
# Tentukan Mesh Plane dengan batas/ border dari Rectangle
# tentukan Naked Edges sebagai compression member dan Interior Edges sebagai flexible tensile fabric
number_slider_14 = Slider(12, range=6..36)  # disabled
number_slider_15 = Slider(24, range=6..36)  # disabled
rectangle_3 = Rectangle(Plane=PlaneXY(0, 0, 0), XSize=number_slider_14, YSize=number_slider_15, Radius=0)  # -> Rectangle, Length; disabled
mplane_3 = MeshPlane(Boundary=rectangle_3.Rectangle, WidthCount=number_slider_14, HeightCount=number_slider_15)  # -> Mesh, Area; disabled
medges = MeshEdges(Mesh=mplane_3.Mesh)  # -> NakedEdges, InteriorEdges, NonManifoldEdges; disabled

polygon_2 = Polygon(Plane=pt_2, Radius=number_slider_5, Segments=number_slider_4, FilletRadius=0)  # -> Polygon, Length; disabled
Z_2 = UnitZ(Factor=number_slider_6)  # disabled
# BENDING
# ACTIVE
# 1. Rod/ Batang dengan karakter Bending Active
panel_6 = Panel("-1")  # disabled
move = Move(Geometry=polygon.Polygon, Motion=Z)  # -> Geometry, Transform; disabled
# Explode masing-masing Polygon agar menghasilkan Vertices dan Segment
geo = Geometry(polygon_2.Polygon)  # disabled
pt_4 = ConstructPoint(XCoordinate=panel_6, YCoordinate=0, ZCoordinate=0)  # disabled
move_2 = Move(Geometry=geo, Motion=Z_2)  # -> Geometry, Transform; disabled
Y = UnitY(Factor=1)  # disabled
panel_7 = Panel("10")  # disabled
number_slider_16 = Slider(15, range=0..100)  # disabled

explode = Explode(Curve=move_2.Geometry, Recursive=True)  # -> Segments, Vertices; disabled
explode_2 = Explode(Curve=geo, Recursive=True)  # -> Segments, Vertices; disabled

cp = ControlPoints(Curve=move.Geometry)  # -> Points, Weights, Knots; disabled
# Tentukan Control Points masing-masing profil, lalu hilangkan duplikasi Points.
cp_2 = ControlPoints(Curve=polygon.Polygon)  # -> Points, Weights, Knots; disabled
duppt = RemoveDuplicatePts(Points=cp.Points, Tolerance=0.01)  # disabled
duppt_2 = RemoveDuplicatePts(Points=cp_2.Points, Tolerance=0.01)  # disabled

line_2 = LineSDL(Start=pt_4, Direction=Y, Length=panel_7)  # disabled
panel_8 = Panel(".7")  # disabled
domain = Domain(line_2)  # disabled
number_slider_17 = Slider(0.2, range=0..1)  # disabled
end = EndPoints(Curve=line_2)  # -> Start, End; disabled
number_slider_18 = Slider(0.2, range=0..1)  # disabled
# Semua naked points dijadikan angkur
nv = NakedVertices(Mesh=mplane.Mesh)  # -> ClothedIndex, NakedIndex, ClothedPts, NakedPts
range = Range(Domain=domain, Steps=number_slider_16)  # disabled
points_2 = PointList(Points=explode.Vertices, Size=panel_8)  # disabled

# ----
# Bagi menjadi beberapa segmen sesuai panjang garis horizontal. Jika ingin menaikkan resolusi, jumlah titik-titik segmen dapat diperbanyak
jumlah_segmen = Slider(2, range=1..5)  # disabled
len = Length(Curve=line)  # disabled
multiplication = Multiplication(A=len, B=jumlah_segmen)  # disabled
divide = DivideCurve(Curve=line, Count=multiplication, Kinks=False)  # -> Points, Tangents, Parameters; disabled

shatter = Shatter(Curve=reparameterize(line_2), Parameters=range)  # disabled
panel_9 = Panel(shatter)  # disabled
cull_i = CullIndex(List=explode.Vertices, Indices=number_slider_4, Wrap=True)  # disabled
cull_i_2 = CullIndex(List=explode_2.Vertices, Indices=number_slider_4, Wrap=True)  # disabled
panel_10 = Panel(".7")  # disabled

panel_11 = Panel("Grup segmen n-1")  # disabled
panel_12 = Panel("Grup segmen n")  # disabled
cull_i_3 = CullIndex(List=reverse(shatter), Indices=0, Wrap=True)  # -> reverse(List); disabled
cull_i_4 = CullIndex(List=shatter, Indices=0, Wrap=True)  # disabled

# ----
# 2 Rod/ Batang dengan karakter Bending Active
# yang berbeda tingkat kekuatan kelengkungannya.
number_slider_19 = Slider(1, range=0..10)  # disabled
lng = ListLength(List=cull_i_4)  # disabled
panel_13 = Panel("1")  # disabled
series_2 = Series(Start=panel_13, Step=number_slider_19, Count=lng)  # disabled

panel_14 = Panel(".7")  # disabled
points_3 = PointList(Points=duppt_2, Size=number_slider_18)  # disabled
points_4 = PointList(Points=cull_i_2, Size=panel_10)  # disabled
points_5 = PointList(Points=cull_i, Size=panel_14)  # disabled
shift = ShiftList(List=duppt, Shift=1, Wrap=True)  # disabled
points_6 = PointList(Points=shift, Size=number_slider_17)  # disabled
shift_2 = ShiftList(List=cull_i, Shift=1, Wrap=True)  # disabled
join = JoinCurves(Curves=medges.NakedEdges, Preserve=False)  # disabled
number_slider_20 = Slider(0.3, range=0.1..5)  # disabled
# Buat garis-garis yang akan menjadi salah satu komponen Tension dan komponen Compression
ln = Line(StartPoint=shift_2, EndPoint=cull_i_2)  # disabled
ln_2 = Line(StartPoint=cull_i, EndPoint=cull_i_2)  # disabled
crv_segmen_bawah = Curve(explode_2.Segments)  # disabled
crv_segmen_atas = Curve(explode.Segments)  # disabled

panel_15 = Panel("0")  # disabled
panel_16 = Panel(".25")  # disabled
panel_17 = Panel("40")  # disabled
length_line = LengthLine(Line=line_2, Length=panel_15, Strength=panel_16)  # disabled
length_line_2 = LengthLine(Line=shatter, Strength=panel_17)  # disabled

# ----
# Buat garis antara Points kurva atas yang indeksnya sudah digeser dengan Points pada kurva bawah.
ln_3 = Line(StartPoint=duppt_2, EndPoint=shift)  # disabled
# Buat garis antara Points pada kurva atas dan Points pada kurva bawah.
ln_4 = Line(StartPoint=duppt_2, EndPoint=duppt)  # disabled
explode_3 = Explode(Curve=polygon.Polygon, Recursive=True)  # -> Segments, Vertices; disabled
# Explode kurva atas dan kurva bawah
explode_4 = Explode(Curve=move.Geometry, Recursive=True)  # -> Segments, Vertices; disabled
kurva_vertikal = Curve(ln_2)  # disabled

# ----
# Rest Angle: besar sudut antara vektor pada Line. Nilai dalam Radian.
panel_18 = Panel("5")  # disabled
panel_19 = Panel("0")  # disabled
# Angle
angle = Angle(LineA=cull_i_3, LineB=cull_i_4, Strength=panel_18)  # disabled

panel_20 = Panel("Tentukan elastisitas mesh")
edgelengths = EdgeLengths(Mesh=mplane.Mesh, LengthFactor=1, Strength=1)

# ----
# Anchor
anchor = Anchor(Point=nv.NakedPts, Strength=10000)

# ----
# Tentukan dua Edge yang akan diberikan gaya kontraksi elastik panjang
item = ListItem(List=corners, Index=0, Wrap=True)  # -> Item, Item1, Item2, Item3; disabled
ln_5 = Line(StartPoint=item.Item, EndPoint=item.Item1)  # disabled
ln_6 = Line(StartPoint=item.Item2, EndPoint=item.Item3)  # disabled
merge = Merge(Data1=ln_5, Data2=ln_6)  # disabled

panel_21 = Panel("0")  # disabled
panel_22 = Panel("35")  # disabled
# Rod
rod = Rod(Polyline=join, LengthFactor=1, AngleFactor=panel_21, AxialStrength=10, BendStrength=panel_22)  # disabled

# ----
# Masing-masing digabung menggunakan Join Curves
crv = Curve(warpweft.Warp)  # disabled
crv_2 = Curve(warpweft.Weft)  # disabled
join_2 = JoinCurves(Curves=crv, Preserve=False)  # disabled
join_3 = JoinCurves(Curves=crv_2, Preserve=False)  # disabled

# ----
# Grab
# Tekan Tombol kiri mouse pada Rhino untuk melihat efek pada obyek.
grab = Grab(On=True, Strength=1, Range=3)  # disabled

panel_23 = Panel("0.2")  # disabled
# Length
length_line_3 = LengthLine(Line=medges.InteriorEdges, Length=panel_23, Strength=number_slider_20)  # disabled

# ----
# Pressure
# Masukkan beban Pressure pada mesh
pressure = Pressure(M=mplane.Mesh, Strength=Slider(0.15, range=0.01..0.5))
# Length
show = Show(G=mplane.Mesh)
# Length
show_2 = Show(G=shatter)  # disabled
show_3 = Show(G=line_2)  # disabled
panel_24 = Panel("Komponen kabel tarik")  # disabled
panel_25 = Panel("Komponen batang tekan")  # disabled

kurva_diagonal = Curve(ln)  # disabled

merge_2 = Merge(Data1=crv_segmen_atas, Data2=crv_segmen_bawah, Data3=kurva_vertikal)  # -> flatten(Result); disabled

# ----
# Grab
grab_2 = Grab(On=True, Strength=1, Range=3)  # disabled

# ----
# Tentukan titik pusat semua titik
avr = Average(Input=flatten(divide.Points))  # disabled

show_4 = Show(G=mplane_3.Mesh)  # disabled
show_5 = Show(G=join)  # disabled

panel_26 = Panel("Kurva HOR")  # disabled
pline = PolyLine(Vertices=divide.Points, Closed=False)  # disabled
# Duplikasi garis-garis horizontal menjadi garis-garis vertikal
panel_27 = Panel("90")  # disabled
rad = Radians(Degrees=panel_27)  # disabled
panel_28 = Panel("Kurva VER")  # disabled
rotate = Rotate(Geometry=pline, Angle=rad, Plane=avr)  # -> Geometry, Transform; disabled
panel_29 = Panel("Kurva HOR+VER")  # disabled
crv_3 = Curve(flatten([rotate.Geometry, pline]))  # disabled

# ----
# Gabungan semua kurva.
merge_3 = Merge(Data1=flatten(polygon.Polygon), Data2=flatten(move.Geometry), Data3=flatten(ln_4), Data4=flatten(ln_3))  # disabled
# Gabungan kurva-kurva sebagai kabel tarik.
merge_4 = Merge(Data1=ln_4, Data2=explode_3.Segments, Data3=explode_4.Segments)  # -> flatten(Result); disabled
crv_4 = Curve([join_2, join_3])  # disabled

end_2 = EndPoints(Curve=cull_i_3)  # -> Start, End; disabled
vec2pt = Vector2Pt(PointA=end_2.Start, PointB=end_2.End, Unitize=False)  # -> Vector, Length; disabled
panel_30 = Panel(".2")  # disabled
points_7 = PointList(Points=end_2.Start, Size=panel_30)  # disabled
vdis = VectorDisplay(Anchor=end_2.Start, Vector=vec2pt.Vector)  # disabled

len_2 = Length(Curve=merge_2)  # disabled

number_slider_21 = Slider(0.8, range=0..1)  # disabled
division = Division(A=len_2, B=number_slider_21)  # disabled
divide_2 = DivideCurve(Curve=merge_2, Count=division, Kinks=False)  # -> Points, Tangents, Parameters; disabled
pline_2 = PolyLine(Vertices=divide_2.Points, Closed=False)  # disabled
explode_5 = Explode(Curve=pline_2, Recursive=True)  # -> Segments, Vertices; disabled
crv_5 = Curve(explode_5.Segments)  # disabled

bouncysolver = BouncySolver(
    GoalObjects=flatten([pressure, anchor, show, edgelengths]),
    Reset=Button(),
    Threshold=1e-15,
    Tolerance=0.01,
    Damping=0.99,
    Iterations=10,
    On=Toggle(True))  # -> I, V, O
panel_31 = Panel("Visualisasi")  # disabled
merge_5 = Merge(Data2=rod, Data3=length_line_3, Data4=grab_2)  # disabled
mesh = Mesh(bouncysolver.O)

# ----
# Tentukan dua titik angkur pada salah satu sisi bidang
pt_5 = Point([item.Item, item.Item2])  # disabled
# Anchor
anchor_2 = Anchor(Point=pt_5, Strength=10000)  # disabled

# ----
# Kontraksi elastik dua buah Line (memendek, berusaha panjang=0)
panel_32 = Panel("0")  # disabled
panel_33 = Panel("1")  # disabled
# Length
length_line_4 = LengthLine(Line=merge, Length=panel_32, Strength=panel_33)  # disabled

entwine = Entwine(Branch00=show_4, Branch01=show_5, Branch02=merge_5, FlattenInputs=True)  # disabled
button = Button()  # disabled
clean = CleanTree(RemoveNulls=True, RemoveInvalid=True, RemoveEmpty=False, Tree=mesh)

# ----
# Rod
# Setiap line (Warp maupun Weft) menjadi batang-batang Rod (Bending)
rod_2 = Rod(Polyline=crv_4, LengthFactor=1, AngleFactor=1, AxialStrength=10, BendStrength=1)  # disabled

number_slider_22 = Slider(0.308, range=0..1)  # disabled
len_3 = Length(Curve=merge_4)  # disabled
multiplication_2 = Multiplication(A=len_3, B=number_slider_22)  # disabled
# Length
length_line_5 = LengthLine(Line=merge_4, Length=multiplication_2, Strength=10)  # disabled

# ----
# Grab
grab_3 = Grab(On=True, Strength=1, Range=3)  # disabled

entwine_2 = Entwine(Branch00=show_3, Branch01=show_2, Branch02=[length_line, length_line_2, angle, grab], FlattenInputs=True)  # disabled

show_6 = Show(G=mplane_2.Mesh)  # disabled

number_slider_23 = Slider(1000, range=0..1000)  # disabled
# Length
length_line_6 = LengthLine(Line=ln_3, Length=ln_3, Strength=number_slider_23)  # disabled

mesh_2 = Mesh(clean)
crv_6 = Curve(crv_3)  # disabled
bouncysolver_2 = BouncySolver(GoalObjects=entwine_2, Reset=button, Threshold=1e-15, Tolerance=0.01, Damping=0.99, Iterations=10, On=True)  # -> I, V, O; disabled
xy = XYPlane(Origin=Point(0, 0, 0))
lng_2 = ListLength(List=entwine_2)  # -> flatten(Length); disabled

number_slider_24 = Slider(0.6, range=0.2..1.5)  # disabled
len_4 = Length(Curve=crv_5)  # disabled
multiplication_3 = Multiplication(A=len_4, B=number_slider_24)  # disabled
# Length
length_line_7 = LengthLine(Line=crv_5, Length=multiplication_3, Strength=10)  # disabled

toggle = BooleanToggle(True)  # disabled
button_2 = Button()  # disabled
bouncysolver_3 = BouncySolver(GoalObjects=flatten(entwine), Reset=button_2, Threshold=1e-15, Tolerance=0.01, Damping=0.99, Iterations=10, On=toggle)  # -> I, V, O; disabled
mesh_3 = Mesh(bouncysolver_3.O)  # disabled
clean_2 = CleanTree(RemoveNulls=True, RemoveInvalid=True, RemoveEmpty=False, Tree=mesh_3)  # disabled
mesh_4 = Mesh(clean_2)  # disabled

mirror = Mirror(Geometry=mesh_2, Plane=xy)  # -> Geometry, Transform

# ----
# Menentukan titik-titik angkur dan titik-titik target
flip = FlipCurve(Curve=crv_6)  # -> Curve, Flag; disabled
end_3 = EndPoints(Curve=[flip.Curve, crv_6])  # -> Start, End; disabled
vec2pt_2 = Vector2Pt(PointA=end_3.Start, PointB=end_3.End, Unitize=True)  # -> Vector, Length; disabled
vdis_2 = VectorDisplay(Anchor=end_3.Start, Vector=vec2pt_2.Vector)  # disabled

partition = PartitionList(List=bouncysolver_2.O, Size=lng_2)  # disabled
show_7 = Show(G=merge_3)  # disabled
bang = ExplodeTree(Data=partition)  # -> Branch0, Branch1, Branch2; disabled
mesh_5 = Mesh([mesh_2, mirror.Geometry])

titik_pusat_dari_semua_titik = Point(avr)  # disabled
explode_6 = Explode(Curve=crv_6, Recursive=True)  # -> Segments, flatten(Vertices); disabled
cullpt = CullDuplicates(Points=explode_6.Vertices, Tolerance=0.1, CullMode=3)  # -> Points, Indices, Valence; disabled
number_slider_25 = Slider(24, range=10..24)  # disabled
cps = ClosestPoints(Point=titik_pusat_dari_semua_titik, Cloud=cullpt.Points, Count=number_slider_25)  # -> ClosestPoint, CPIndex, Distance; disabled

toggle_2 = BooleanToggle(False)  # disabled
button_3 = Button()  # disabled
entwine_3 = Entwine(Branch00=show_6, Branch01=[length_line_4, rod_2, grab_3, anchor_2], FlattenInputs=True)  # disabled
bouncysolver_4 = BouncySolver(GoalObjects=entwine_3, Reset=button_3, Threshold=1e-15, Tolerance=0.01, Damping=0.99, Iterations=10, On=toggle_2)  # -> I, V, O; disabled

merge_6 = Merge(Data1=flatten(length_line_6), Data2=flatten(length_line_5))  # disabled
explode_7 = Explode(Curve=bang.Branch1, Recursive=True)  # -> Segments, Vertices; disabled

number_slider_26 = Slider(3, range=0.1..10)  # disabled
amp = Amplitude(Vector=vec2pt_2.Vector, Amplitude=number_slider_26)  # disabled
move_3 = Move(Geometry=end_3.Start, Motion=amp)  # -> Geometry, Transform; disabled

show_compression = Show(G=kurva_diagonal)  # disabled

# ----
# Length
length_line_8 = LengthLine(Line=kurva_diagonal, Strength=10)  # disabled

show_tension = Show(G=merge_2)  # disabled
swatch = ColourSwatch(SwatchColor=RGB(27, 166, 255))  # disabled
intcrv = Interpolate(Vertices=explode_7.Vertices, Degree=3, Periodic=False, KnotStyle=1)  # -> Curve, Length, Domain; disabled
panel_35 = Panel("15")  # disabled
entwine_4 = Entwine(Branch00=show_7, Branch01=merge_6, FlattenInputs=True)  # disabled
ketinggian = Slider(0.1, range=0.1..10)  # disabled
mesh_6 = Mesh(bouncysolver_4.O)  # disabled
entwine_5 = Entwine(Branch00=show_tension, Branch01=show_compression, Branch02=[length_line_7, length_line_8], FlattenInputs=True)  # disabled
Z_3 = UnitZ(Factor=ketinggian)  # disabled

button_4 = Button()  # disabled
toggle_3 = BooleanToggle(False)  # disabled
panel_36 = Panel(".99")  # disabled
bouncysolver_5 = BouncySolver(
    GoalObjects=flatten(entwine_4),
    Reset=button_4,
    Threshold=1e-15,
    Tolerance=0.01,
    Damping=panel_36,
    Iterations=10,
    On=toggle_3)  # -> I, V, O; disabled

button_5 = Button()  # disabled
timer = Timer(TimerInterval=20, Target=bouncysolver_6)  # disabled
bouncysolver_6 = BouncySolver(GoalObjects=entwine_5, Reset=button_5, Threshold=1e-15, Tolerance=0.01, Damping=0.99, Iterations=10, On=True)  # -> I, V, O; disabled

# ----
# Rod
rod_3 = Rod(Polyline=crv_6, LengthFactor=1, AngleFactor=1, AxialStrength=10, BendStrength=1)  # disabled

# ----
# Grab
# Gaya-gaya yang bekerja (non angkur dan beban terpusat)
grab_4 = Grab(On=True, Strength=1, Range=3)  # disabled

# ----
# Anchor
anchor_3 = Anchor(Point=end_3.Start, Target=move_3.Geometry, Strength=10000)  # disabled

show_8 = Show(G=crv_6)  # disabled
show_9 = Show(G=cps.ClosestPoint)  # disabled

# ----
# Load
# Tambahkan beban terpusat pada beberapa titik di dekat titik pusat
load = Load(Point=cps.ClosestPoint, ForceVector=Z_3, Weighting=1)  # disabled

clean_3 = CleanTree(RemoveNulls=True, RemoveInvalid=True, RemoveEmpty=False, Tree=mesh_6)  # disabled

# ----
# Ubah Mesh menjadi Surface dengan Surface from Points. Paraeter U didaat dari salah satu pareter W atau H di Mesh Plane
data = Data(number_slider_11)  # disabled
panel_37 = Panel("1")  # disabled
addition = Addition(A=data, B=panel_37)  # disabled

mesh_7 = Mesh(clean_3)  # disabled
demesh = DeconstructMesh(Mesh=mesh_7)  # -> Vertices, Faces, Colours, Normals; disabled
bang_2 = ExplodeTree(Data=bouncysolver_5.O)  # -> Branch0, Branch1; disabled
lng_3 = ListLength(List=merge_3)  # -> expr("x-1", Length); disabled
lng_4 = ListLength(List=entwine_5)  # -> flatten(Length); disabled
merge_7 = Merge(Data1=load, Data2=rod_3, Data3=grab_4, Data4=anchor_3)  # disabled
srfgrid = SurfaceFromPoints(Points=demesh.Vertices, UCount=addition, Interpolate=False)  # disabled
subset = SubList(List=bang_2.Branch0, Domain=lng_3, Wrap=True)  # -> List, Index; disabled
partition_2 = PartitionList(List=bouncysolver_6.O, Size=lng_4)  # disabled
# Untuk analisis kelengkungan, perlu UV dari setiap titik grid. Gunakan komponen Surface Closest Point
srf_cp = SurfaceClosestPoint(Point=demesh.Vertices, Surface=srfgrid)  # -> Point, UVPoint, Distance; disabled
number_slider_27 = Slider(5, range=0..10)  # disabled
bang_3 = ExplodeTree(Data=partition_2)  # -> Branch0, Branch1, Branch2; disabled
entwine_6 = Entwine(Branch00=show_8, Branch01=show_9, Branch02=merge_7, FlattenInputs=True)  # disabled
number_slider_28 = Slider(0.2, range=0..1)  # disabled
curvature = SurfaceCurvature(Surface=srfgrid, Point=srf_cp.UVPoint)  # -> Frame, Gaussian, Mean; disabled

abs = Absolute(Value=curvature.Gaussian)  # disabled
bnd = Bounds(Numbers=abs)  # disabled
dedomain = DeconstructDomain(Domain=bnd)  # -> Start, End; disabled
panel_38 = Panel("3")  # disabled
roundd = RoundToDecimalPlace(NumberX=dedomain.Start, DecimalPlace=panel_38, RoundType=0)  # -> Rounded, Difference; disabled
roundd_2 = RoundToDecimalPlace(NumberX=dedomain.End, DecimalPlace=panel_38, RoundType=0)  # -> Rounded, Difference; disabled

number_slider_29 = Slider(1, range=0..1)  # disabled
button_6 = Button()  # disabled
toggle_4 = BooleanToggle(False)  # disabled
bouncysolver_7 = BouncySolver(
    GoalObjects=entwine_6,
    Reset=button_6,
    Threshold=1e-15,
    Tolerance=0.01,
    Damping=number_slider_29,
    Iterations=10,
    On=toggle_4)  # -> I, V, O; disabled

# ---- group: Tension
crv_7 = Curve(bang_3.Branch0)  # disabled

# ---- group: Compression
crv_8 = Curve(bang_3.Branch1)  # disabled

# ----
split = SplitList(List=subset.List, Index=number_slider_27)  # -> ListA, ListB; disabled

number_slider_30 = Slider(0.046, range=0..1)  # disabled
swatch_2 = ColourSwatch(SwatchColor=RGB(255, 56, 56))  # disabled
pipe = Pipe(Curve=split.ListB, Radius=number_slider_30, Caps=0)  # disabled
preview = CustomPreview(Geometry=pipe, Shader=swatch_2)  # disabled

pipe_2 = Pipe(Curve=crv_8, Radius=number_slider_28, Caps=1)  # disabled
gradient = Gradient(
    LowerLimit=roundd.Rounded,
    UpperLimit=roundd_2.Rounded,
    Parameter=curvature.Gaussian,
    stops=[0: RGB(136, 90, 166), 0: RGB(123, 202, 192), 0.5: RGB(255, 255, 0), 1: RGB(220, 0, 40)])  # disabled

swatch_3 = ColourSwatch(SwatchColor=RGB(0, 0, 0))  # disabled
geo_2 = Geometry(split.ListA)  # disabled
preview_2 = CustomPreview(Geometry=split.ListA, Shader=swatch_3)  # disabled

panel_39 = Panel("Kabel Tarik")  # disabled
panel_40 = Panel("Batang Tekan")  # disabled

lng_5 = ListLength(List=entwine_6)  # -> flatten(Length); disabled
partition_3 = PartitionList(List=bouncysolver_7.O, Size=lng_5)  # disabled
bang_4 = ExplodeTree(Data=partition_3)  # -> Branch0, Branch1, Branch2; disabled
crv_9 = Curve(bang_4.Branch0)  # disabled
pt_6 = Point(bang_4.Branch1)  # disabled

conmesh = ConstructMesh(Vertices=demesh.Vertices, Faces=demesh.Faces, Colours=gradient)  # disabled
panel_41 = Panel("Pengelompokan visualisasi")  # disabled
swatch_4 = ColourSwatch(SwatchColor=RGB(242, 12, 93))  # disabled
panel_42 = Panel("20")  # disabled
number_slider_31 = Slider(0.03, range=0..1)  # disabled
explode_8 = Explode(Curve=crv_9, Recursive=True)  # -> Segments, Vertices; disabled
# Eksplode hasil simulasi, buat sebagai polyline
number_slider_32 = Slider(148, range=50..400)  # disabled
intcrv_2 = Interpolate(Vertices=explode_8.Vertices, Degree=3, Periodic=False, KnotStyle=1)  # -> Curve, Length, Domain; disabled
pipe_3 = Pipe(Curve=intcrv_2.Curve, Radius=number_slider_31, Caps=0)  # disabled
# Tentukan nilai Curvature pada polyline, tentukan pembagian 'segmen' setiap polyline
range_2 = Range(Domain=Domain(0, 1), Steps=number_slider_32)  # disabled
# DATA DAM
# Men-delay proses eksekusi
dam = DataDam(DataA=intcrv_2.Curve, BufferDelay=10000000, BufferMode=0)  # disabled
curvature_2 = Curvature(Curve=reparameterize(dam), Parameter=range_2)  # -> P, K, C; disabled

# ----
# Membuat gradasi warna pada diagram curvature
bnd_2 = Bounds(Numbers=flatten(curvature_2.K))  # disabled
panel_43 = Panel(bnd_2)  # disabled
dedomain_2 = DeconstructDomain(Domain=bnd_2)  # -> Start, End; disabled
gradient_2 = Gradient(
    LowerLimit=dedomain_2.Start,
    UpperLimit=dedomain_2.End,
    Parameter=curvature_2.K,
    stops=[0: RGB(211, 219, 186), 0: RGB(0, 192, 0), 0: RGB(30, 174, 21), 0: RGB(165, 235, 247), 0: RGB(78, 215, 156), 0.5: RGB(255, 255, 0), 1: RGB(220, 0, 40)])  # disabled

panel_44 = Panel("Membuat diagram curvature")  # disabled
vlen = VectorLength(Vector=curvature_2.K)  # disabled
rev = Reverse(Vector=curvature_2.K)  # disabled
line_3 = LineSDL(Start=curvature_2.P, Direction=rev, Length=vlen)  # disabled

preview_3 = CustomPreview(Geometry=line_3, Material=gradient_2)  # disabled

# ==== cluster Corners: Find the boundary corner points of a quad mesh
mesh = ClusterInput()
mesh_2 = Mesh(mesh)
nv = NakedVertices(Mesh=mesh_2)  # -> ClothedIndex, NakedIndex, ClothedPts, NakedPts
vn = VertexNeighbours(Mesh=mesh_2, VertexNumber=nv.NakedIndex)  # -> graft(Vertex), Neighbours, Normal
lng = ListLength(List=vn.Neighbours)
equals = Equality(FirstNumber=lng, SecondNumber=3)  # -> Equality, Inequality
cull = CullPattern(List=vn.Vertex, CullPattern=equals.Inequality)
pshift = ShiftPaths(Data=cull, Offset=-1)
D = ClusterOutput(pshift)
