# Grasshopper definition Object & Data.gh (Grasshopper 1.0.7)
# plug-ins: Pufferfish

panel = Panel("Multiple Points")
# Input data berasal dari objek RH
panel_2 = Panel("Multiple Points")
# VOLATILE & PERSISTENT DATA
geo = Geometry(<brep referenced from the Rhino model>)
geo_2 = Geometry(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)
panel_4 = Panel("Reparameterized Curve")
pt = Point([<point referenced from the Rhino model> x5])
pt_2 = Point([<point referenced from the Rhino model> x5])
# Data pada komponen Geometry merujuk pada obyek di RH, ini dinamakan VOLATILE DATA.
panel_5 = Panel(geo)
# Data pada komponen Geometry di-INTERNALISASI sehingga tidak mengaju pada obyek di RH. Ini dinamakan sebagai PERSISTENT DATA.
panel_6 = Panel(geo_2)
# DATA ANALYSIS
panel_7 = Panel("0 to 10")
panel_8 = Panel("Satu Point")
# Lines
pt_3 = Point(<point referenced from the Rhino model>)
pt_4 = Point(<point referenced from the Rhino model>)
pt_5 = Point(<point referenced from the Rhino model>)
crv = Curve(<curve referenced from the Rhino model>)
pt_6 = Point([<point referenced from the Rhino model> x7])
# Closest Point
cloud_of_points = Point([<point referenced from the Rhino model> x192])
crv_2 = Curve(reparameterize(<curve referenced from the Rhino model>))
# Aswin Indraprastha
# 
# Program Studi Arsitektur
# Sekolah Arsitektur, Perencanaan, dan Pengembangan Kebijakan
# Institut Teknologi Bandung
# 
# aswin@itb.ac.id
# BEKERJA DENGAN DATA DI GRASSHOPPER
# Multiple Points &
# Multiple Points -
# REFERENCED
panel_10 = Panel(pt)
panel_11 = Panel(pt_2)
# Proximity Attractor
attractor = Point(Point(13.31808333, 26.85600001, 0))
pt_7 = Point([Point(18.11534985, 28.90986354, 0), Point(17.71298082, 20.69003902, 0), Point(18.52429793, 24.28867466, 0), Point(13.40188404, 33.16347903, 0), Point(15.93106082, 31.32407774, 0)])
ln = Line(StartPoint=pt, EndPoint=pt_2)
curvepoint = PointOnCurve(crv_2, parameter=0.35)

# ----
# Menentukan obyek (Point) yang paling dekat dengan kurva
number_slider = Slider(16, range=0..25)
cps = ClosestPoints(Point=curvepoint, Cloud=cloud_of_points, Count=number_slider)  # -> ClosestPoint, CPIndex, Distance

random = Random(Range=panel_7, Number="6", Seed=2)

line = LineSDL(Start=pt_5, Direction=crv, Length=Slider(8, range=0..10))
ln_2 = Line(StartPoint=pt_3, EndPoint=pt_4)
# Beberapa teknik membuat Line
fline = FitLine(Points=pt_6)

number_slider_2 = Slider(0.7, range=0..10)
preview = CustomPreview(
    Geometry=attractor,
    Shader={diffuse=RGB(255, 105, 180), emission=RGB(76, 32, 54), shine=0.5, specular=RGB(255, 255, 255), transparency=0})
# Ukur jarak dari satu Point ke setiap Point lain
dist = Distance(PointA=attractor, PointB=pt_7)
panel_12 = Panel("Menghitung Rerata")
panel_13 = Panel("Menghitung jumlah total")
graph = QuickGraph(random, SortOrder=0)
avr = Average(Input=random)
ma = MassAddition(Input=random)  # -> Result, PartialResults
# Menghitung Min dan Max
bnd = Bounds(Numbers=random)
panel_14 = Panel(random)
# Salah satu konsep penting dari pemrograman di GH adalah:
# Data vs data akan selalu dioperasikan berdasarkan NOMOR INDEX-nya.
# 
# Contoh data dari Multiple Points A, dihubungkan sesuai dengan urutan nomor indeksnya dengan data Multiple Points B
points = PointList(Points=pt, Size=number_slider_2)
points_2 = PointList(Points=pt_2, Size=number_slider_2)
panel_15 = Panel(avr)
dedomain = DeconstructDomain(Domain=bnd)  # -> Start, End
panel_16 = Panel(ma.Result)
panel_17 = Panel(bnd)

# ----
# Parameter pembagi, untuk mengontrol besarnya radius lingkaran, relatif terhadap jarak dengan satu Point
number_slider_3 = Slider(4.6, range=0..10)
division = Division(A=dist, B=number_slider_3)

preview_2 = CustomPreview(Geometry=[ln_2, line, fline], Shader=ColourSwatch(SwatchColor=RGB(54, 137, 255)))
preview_3 = CustomPreview(Geometry=crv, Shader=ColourSwatch(SwatchColor=RGB(173, 26, 186)))
ln_3 = Line(StartPoint=cps.ClosestPoint, EndPoint=curvepoint)
col = Colour(RGB(255, 0, 0))
# DATA  TYPES
num = Number(0.2)
bool = Boolean(False)
domain = Domain(Domain(0, 1))
domain² = Domain²(Domain2(u=0..10, v=0..10))
int = Integer(7)
txt = Text("Nama Lengkap")
geo_3 = Geometry(<brep referenced from the Rhino model>)
crv_3 = Curve(<curve referenced from the Rhino model>)
srf = Surface(<surface referenced from the Rhino model>)
brep = Brep(<brep referenced from the Rhino model>)
pt_8 = Point([<point referenced from the Rhino model> x4])
vec = Vector(Vector(0, 7, 0))
panel_18 = Panel(num)
panel_19 = Panel(int)
panel_20 = Panel(txt)
panel_21 = Panel(bool)
panel_22 = Panel(col)
panel_23 = Panel(ColourSwatch(SwatchColor=RGB(142, 128, 255)))
panel_24 = Panel(domain)
panel_25 = Panel(domain²)
panel_26 = Panel(geo_3)
panel_27 = Panel(crv_3)
panel_28 = Panel(srf)
panel_29 = Panel(brep)
panel_30 = Panel(pt_8)
panel_31 = Panel(vec)
preview_4 = CustomPreview(Geometry=ln_3, Shader=ColourSwatch(SwatchColor=RGB(26, 237, 255)))
preview_5 = CustomPreview(Geometry=curvepoint, Shader=ColourSwatch(SwatchColor=RGB(255, 0, 255)))
# DATA SORTING
panel_32 = Panel("0 to 10")
# Curves
pt_9 = Point([<point referenced from the Rhino model> x7])
crv_4 = Curve(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)
crv_5 = Curve(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)
circle = CircleCNR(Center=pt_7, Normal=Vector(0, 0, 1), Radius=division)
panel_33 = Panel(division)
random_2 = Random(Range=panel_32, Number="6", Seed=2)
# Membuat sekumpulan duplikasi interpolasi dari dua kurva
range = Range(Domain=Domain(0, 1), Steps=Slider(8, range=3..16))
# Menggeser urutan data: += ke atas, -= ke bawah
panel_34 = Panel("-1")
# Membuat Polyline dari sekumpulan Points
# Membuat Interpolate Polyline dari sekumpulan Points
panel_35 = Panel("3")
panel_36 = Panel("Menyortir data")
panel_37 = Panel("Membalikkan urutan data")
# Containment
cloud_of_points_2 = Point([<point referenced from the Rhino model> x323])

# ----
# Menentukan Points yang berada di dalam sebuah kurva tertutup. Hasilnya ada 3 pilihan: 0= di luar kurva; 1: pada kurva; 2: di dalam kurva
crv_6 = Curve(<curve referenced from the Rhino model>)
incurve = PointInCurve(Point=cloud_of_points_2, Curve=crv_6)  # -> Relationship, Point

pline = PolyLine(Vertices=pt_9, Closed=False)
intcrv = Interpolate(Vertices=pt_9, Degree=panel_35, Periodic=True, KnotStyle=2)  # -> Curve, Length, Domain
tweencrv = TweenCurve(CurveA=crv_5, CurveB=crv_4, Factor=range, BlendType=0)
sort = SortList(Keys=random_2)  # -> Keys, ValuesA
shift = ShiftList(List=sort.Keys, Shift=panel_34, Wrap=True)
rev = ReverseList(List=sort.Keys)
# Area & Center
crv_7 = Curve([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])
panel_38 = Panel("""0
1
2
3
4""")
panel_39 = Panel(shift)
panel_40 = Panel(sort.Keys)
panel_41 = Panel(rev)
series = Series(Start="0", Step=1, Count="5")
list = ValueList({"A": 1, "B": 2, "C": 2² - 1, "D": Sqrt(16)}, selected="B")
range_2 = Range(Domain="0 to 1", Steps="5")
graph_2 = GraphMapper(range_2, x0=0, x1=1, y0=0, y1=1, container_name="Bezier", cpx=[0, 0.6014492512, 0.3913043439, 1], cpy=[0, 0, 1, 1])
series_2 = Series(Start="10", Step="1", Count="11")
# Menentukan luas dan titik pusat kurva tertutup
area = Area(Geometry=crv_7)  # -> Area, Centroid
# Loft
crv_8 = Curve([<curve referenced from the Rhino model> x3])
panel_42 = Panel(incurve.Relationship)
# NUMBER GENERATOR
panel_43 = Panel("5")
panel_44 = Panel("Loft")

loft_opt = LoftOptions(Closed=False, Adjust=False, Rebuild=0, Refit=0, Type=0)
loft = Loft(Curves=crv_8, Options=loft_opt)

equals = Equality(FirstNumber=incurve.Relationship, SecondNumber=Slider(2, range=0..2))  # -> Equality, Inequality
panel_45 = Panel("Pembulatan")
pdecon = Deconstruct(Point=area.Centroid)  # -> expr("x+6", XComponent), YComponent, ZComponent

roundd = RoundToDecimalPlace(NumberX=area.Area, DecimalPlace="2", RoundType=0)  # -> Rounded, Difference

panel_46 = Panel(panel_43)
panel_47 = Panel(panel_38)
panel_48 = Panel(Slider(2.8, range=0..12.5))
panel_49 = Panel(list)
panel_50 = Panel(series)
panel_51 = Panel(range_2)
panel_52 = Panel(graph_2)
panel_53 = Panel(series_2)
graph_3 = GraphMapper(series_2, x0=10, x1=20, y0=10, y1=20, container_name="Bezier", cpx=[0, 0.6014492512, 0.3913043439, 1], cpy=[0, 0, 1, 1])
dispatch = Dispatch(List=cloud_of_points_2, DispatchPattern=equals.Equality)  # -> ListA, ListB
pt_10 = ConstructPoint(XCoordinate=pdecon.XComponent, YCoordinate=pdecon.YComponent, ZCoordinate=pdecon.ZComponent)
# DATA SELECTION
panel_54 = Panel("0 to 10")
panel_55 = Panel(graph_3)
preview_6 = CustomPreview(Geometry=dispatch.ListB, Shader=ColourSwatch(SwatchColor=RGB(255, 255, 255)))
tag = TextTag3D(Location=pt_10, Text=roundd.Rounded, Size=Slider(0.9, range=0..10), Justification=7)
random_3 = Random(Range=panel_54, Number="6", Seed=2)
larger = LargerThan(FirstNumber=random_3, SecondNumber="2")  # -> LargerThan, OrEqualTo
smaller = SmallerThan(FirstNumber=random_3, SecondNumber="5")  # -> SmallerThan, OrEqualTo
# Extrude
crv_9 = Curve(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)
pt_11 = Point([Point(75, 0, 8), Point(80, 0, 8), Point(85, 0, 8)])
and = GateAnd(A=larger.OrEqualTo, B=smaller.OrEqualTo)
# Parameter Space
panel_56 = Panel("0 To 1")
# Mengeksrak data dari suatu List
number_slider_4 = Slider(1, range=0..5)
# Mengekstrak data dari suatu list dengan kondisional
cull = CullPattern(List=random_3, CullPattern=and)
srf_2 = Surface(reparameterize(<surface referenced from the Rhino model>))
# Extrude terhada beberapa Points
extr = ExtrudePoint(Base=crv_9, Point=pt_11)
expression = Expression(x="2", y="3", Expression="(X+Y)^2")
# Formula juga bisa dimasukkan langsung pada parameter komponen
eval = Evaluate(F="(x+y)^2", x="2", y="3")
# Formula juga bisa dimasukkan langsung pada parameter komponen
range_3 = Range(Domain=Domain(0, 1), Steps=expr("x*2", "2"))
range_4 = Range(Domain=Domain(0, 1), Steps="2")
range_5 = Range(Domain=panel_56, Steps=Slider(5, range=0..10))

# ----
# Sebuah kurva direformat panjangnya menjadi satu unit (Reparameterized).
crv_10 = Curve(reparameterize(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))
eval_2 = EvaluateCurve(Curve=crv_10, Parameter=range_5)  # -> Point, Tangent, Angle

series_3 = Series(Start=0, Step=expr("(x+2)", 1), Count="3")
# NUMERIC OPERATION
addition = Addition()
subtraction = Subtraction()
multiplication = Multiplication()
division_2 = Division()
series_4 = Series(Start=0, Step=1, Count="3")
sort_2 = SortList(Keys=random_3)  # -> Keys, ValuesA
item = ListItem(List=sort_2.Keys, Index=number_slider_4, Wrap=True)
panel_57 = Panel(expression)
panel_58 = Panel(eval)
panel_59 = Panel(range_4)
panel_60 = Panel(range_3)
panel_61 = Panel(series_4)
panel_62 = Panel(series_3)

# ----
# Menentukan titik tengah/ center dari sebuah surface yang arbitrer dengan jalan menentukan nilai u dan v sebagai 0.5 dan 0.5 pada sebuah surface yang telah direparameterized.
panel_63 = Panel(".5,.5")
evalsrf = EvaluateSurface(Surface=srf_2, Point=panel_63)  # -> Point, Normal, UDirection, VDirection, Frame

panel_64 = Panel(sort_2.Keys)
panel_65 = Panel(item)
panel_66 = Panel(cull)
circle_2 = CircleCNR(Center=eval_2.Point, Normal=Vector(0, 0, 1), Radius=".5")
# Mekanisme seleksi hanya input angka: 3<= INPUT<=10 yang bernilai TRUE dan diproses selanjutnya.
number_slider_5 = Slider(5, range=0..20)
series_5 = Series(Start="-2", Step=1, Count="5")
# LOGICAL OPERATION
panel_67 = Panel("0.5")
# Gate AND adalah HANYA yang memenuhi kedua kondisi.
smaller_2 = SmallerThan(FirstNumber=number_slider_5, SecondNumber="10")  # -> SmallerThan, OrEqualTo
larger_2 = LargerThan(FirstNumber=number_slider_5, SecondNumber="3")  # -> LargerThan, OrEqualTo
larger_3 = LargerThan(FirstNumber=panel_67, SecondNumber="1")  # -> LargerThan, OrEqualTo
larger_4 = LargerThan(FirstNumber=series_5, SecondNumber="1")  # -> LargerThan, OrEqualTo
panel_68 = Panel(larger_3.LargerThan)
panel_69 = Panel(larger_3.OrEqualTo)
panel_70 = Panel(larger_4.LargerThan)
and_2 = GateAnd(A=larger_2.OrEqualTo, B=smaller_2.OrEqualTo)
srf_3 = Surface(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)

# ----
# Membagi surface menjadi grid domain
number_slider_6 = Slider(2, range=2..36)
divide = DivideDomain²(Domain=srf_3, UCount=Slider(2, range=2..12), VCount=number_slider_6)

# ----
# DATA MAPPING
num_2 = Number(random_3)
crv_11 = Curve(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)
# DISPATCH
# Komponen yang menyaring/memetakan list dan mengeluarkan hasil yang bernilai TRUE
panel_71 = Panel(and_2)
dispatch_2 = Dispatch(List=number_slider_5, DispatchPattern=and_2)  # -> ListA, ListB
sort_3 = SortList(Keys=num_2)  # -> Keys, ValuesA
bnd_2 = Bounds(Numbers=sort_3.Keys)
expression_2 = Expression(x=["30", "45", "60", "90"], Expression="Rad(x)")
rad = Radians(Degrees=["30", "45", "60", "90"])
cull_2 = CullPattern(List=series_5, CullPattern=panel_70)
panel_72 = Panel("Reparameterized")

crv_12 = Curve(reparameterize(crv_11))

sph = Sphere(Base=PlaneXY(0, 0, 0), Radius=dispatch_2.ListA)
domain_2 = Domain(crv_11)
panel_73 = Panel(cull_2)
subsrf = Isotrim(Surface=srf_3, Domain=divide)
panel_74 = Panel(sort_3.Keys)
panel_75 = Panel(bnd_2)
domain_3 = Domain(crv_12)
panel_76 = Panel(rad)
panel_77 = Panel(expression_2)
panel_78 = Panel(domain_2)
panel_79 = Panel(domain_3)

# ----
# Memformat ulang/ memetakan bilangan berdasarkan Domain Tujuan (Target)
remap = RemapNumbers(Value=sort_3.Keys, Source=panel_75, Target="0 To 1")  # -> Mapped, Clipped

bnd_3 = Bounds(Numbers=subsrf)
domain_4 = Domain(subsrf)
panel_80 = Panel(remap.Mapped)
panel_81 = Panel(domain_4)
dedomain_2 = DeconstructDomain(Domain=bnd_3)  # -> Start, End
gradient = Gradient(
    LowerLimit=dedomain_2.Start,
    UpperLimit=dedomain_2.End,
    Parameter=subsrf,
    stops=[0: RGB(234, 38, 0), 0.25: RGB(234, 126, 0), 0.5: RGB(254, 244, 84), 0.75: RGB(173, 203, 249), 1: RGB(75, 107, 169)])
preview_7 = CustomPreview(Geometry=subsrf, Material=gradient)
