# Grasshopper definition Paneling-Labeling.gh (Grasshopper 1.0.7)
# plug-ins: EleFront, Bifocals, LunchBox

panel = Panel("Empat titik sudut/ angkur")

# ----
# Aswin Indraprastha
# 
# Program Studi Arsitektur
# Sekolah Arsitektur, Perencanaan, dan Pengembangan Kebijakan
# Institut Teknologi Bandung
# 
# aswin@itb.ac.id
# 1. PERSIAPAN GEOMETRI
pt = Point(Point(-40, 0, 0))
pt_2 = Point(Point(-20, 0, 0))
pt_3 = Point(Point(-20, 20, 0))
pt_4 = Point(Point(-40, 20, 0))

panel_2 = Panel("Kurva-kurva Catenary")

cat = Catenary(PointA=pt, PointB=pt_2, Length=Slider(30, range=0..500), Gravity="0,0,1")
cat_2 = Catenary(PointA=pt_2, PointB=pt_3, Length=Slider(28, range=0..500), Gravity="0,0,1")
cat_3 = Catenary(PointA=pt_3, PointB=pt_4, Length=Slider(29, range=0..500), Gravity="0,0,1")
# Rebuild kurva untuk mengurangi jumlah segmen setiap kurva.
cat_4 = Catenary(PointA=pt_4, PointB=pt, Length=Slider(25, range=0..500), Gravity="0,0,1")

reb = RebuildCurve(Curve=cat, Degree="3", Count=10, Tangents=False)
reb_2 = RebuildCurve(Curve=cat_2, Degree="3", Count=10, Tangents=False)
reb_3 = RebuildCurve(Curve=cat_3, Degree="3", Count=10, Tangents=False)
reb_4 = RebuildCurve(Curve=cat_4, Degree="3", Count=10, Tangents=False)

edgesrf = EdgeSurface(CurveA=reb, CurveB=reb_2, CurveC=reb_3, CurveD=reb_4)
# 2A. PEMBUATAN
# PANEL
tria = TriangularPanelsA(Surface=edgesrf, UDivisions=Slider(4, range=2..20), VDivisions=Slider(4, range=2..20))
srf = Surface(tria)
panel_3 = Panel("Menghitung banyak panel")

area = Area(Geometry=srf)  # -> Area, Centroid
scale = Scale(Geometry=srf, Center=area.Centroid, Factor=0.5)  # -> Geometry, Transform
# Pada setiap panel segitiga, scale kurva ke arah dalam dan Loft sehingga setiap panel memiliki lubang.
debrep = DeconstructBrep(Brep=scale.Geometry)  # -> Faces, Edges, Vertices
join = JoinCurves(Curves=debrep.Edges, Preserve=False)  # -> flatten(Curves)
graft = GraftTree(Tree=join, IncludeEmptyLists=True, IncludeNullItems=True)

# ----
# Menentukan orientasi asal dari setiap panel. Dimulai dari menentukan koordinat uv dari setiap titik tengah panel, lalu memetakan Frame uv dari setiap panel yang digunakan sebagai orientasi asal setiap bidang panel.
area_2 = Area(Geometry=srf)  # -> Area, Centroid
srf_cp = SurfaceClosestPoint(Point=area_2.Centroid, Surface=srf)  # -> Point, UVPoint, Distance
evalsrf = EvaluateSurface(Surface=srf, Point=srf_cp.UVPoint)  # -> Point, Normal, UDirection, VDirection, Frame

# ----
# 3A. PROYEKSI KE BIDANG POTONG
lng = ListLength(List=srf)

# ----
# 3B. MEMBUAT BIDANG POTONG DAN GRID
panel_4 = Panel("-10,0,0")
# Membuat grid dengan jumlah grid maksimal sebanyak jumlah panel. Menentukan titik pusat setiap grid sebagai titik target orientasi setiap panel yang dipetakan dalam bidang grid. Dimensi Grid sesuai dengan dimensi material potong.
panel_5 = Panel("0 to 50")
rectangle = Rectangle(Plane=panel_4, XSize="0 to 80", YSize=panel_5, Radius=0)  # -> Rectangle, Length
sqrt = SquareRoot(Value=lng)
srf_2 = Surface(rectangle.Rectangle)
round = Round(Number=sqrt)  # -> Nearest, Floor, Ceiling
divide = DivideDomain²(Domain=srf_2, UCount=round.Nearest, VCount=round.Nearest)
subsrf = Isotrim(Surface=srf_2, Domain=divide)

# ----
# 2B. DESAIN PANEL
debrep_2 = DeconstructBrep(Brep=srf)  # -> Faces, Edges, Vertices
join_2 = JoinCurves(Curves=debrep_2.Edges, Preserve=False)  # -> flatten(Curves)
graft_2 = GraftTree(Tree=join_2, IncludeEmptyLists=True, IncludeNullItems=True)

debrep_3 = DeconstructBrep(Brep=subsrf)  # -> Faces, Edges, Vertices
area_3 = Area(Geometry=subsrf)  # -> Area, Centroid
join_3 = JoinCurves(Curves=debrep_3.Edges, Preserve=False)

loft = Loft(
    Curves=[graft_2, graft],
    Options={Adjust=False, Closed=False, LoftEnds=0, LoftSimp=0, LoftType=0, Rebuild=10, Refit=0.01})

orient = Orient(Geometry=srf, Source=evalsrf.Frame, Target=area_3.Centroid)  # -> Geometry, Transform
orient_2 = Orient(Geometry=scale.Geometry, Source=evalsrf.Frame, Target=area_3.Centroid)  # -> Geometry, Transform

srf_3 = Surface(srf)
debrep_4 = DeconstructBrep(Brep=orient.Geometry)  # -> Faces, Edges, Vertices
debrep_5 = DeconstructBrep(Brep=orient_2.Geometry)  # -> Faces, Edges, Vertices
debrep_6 = DeconstructBrep(Brep=srf_3)  # -> Faces, Edges, Vertices
panel_6 = Panel("Bidang potong-2")

join_4 = JoinCurves(Curves=debrep_4.Edges, Preserve=False)

# ----
# Bidang potong-1 (ini akan diptong lebih dulu oleh mesin)
join_5 = JoinCurves(Curves=debrep_5.Edges, Preserve=False)

item = ListItem(List=debrep_6.Vertices, Index=Slider(0, range=0..4), Wrap=True)

# ----
# Membuat label DOT otomatis pada obyek Rhino dengan Plugin Elfront. Ini penting agar ketika menyusun/merakit, kita tahu panel-panel yang akan dipasang.
panel_7 = Panel("1")
# 4. LABEL PADA
# OBYEK 3D
area_4 = Area(Geometry=srf)  # -> Area, Centroid
series = Series(Start=panel_7, Step=1, Count=lng)

# ----
# Label teks yang digrafir pada bidang potong.
pt_5 = Point(debrep_4.Vertices)
# 5. LABEL PADA BIDANG-BIDANG POTONG
area_5 = Area(Geometry=debrep_4.Faces)  # -> Area, Centroid
item_2 = ListItem(List=pt_5, Index="0", Wrap=True)
vec2pt = Vector2Pt(PointA=item_2, PointB=area_5.Centroid, Unitize=False)  # -> Vector, Length
multiplication = Multiplication(A=vec2pt.Vector, B=Slider(0.3, range=0.1..9))
move = Move(Geometry=item_2, Motion=multiplication)  # -> flatten(Geometry), Transform

textdot = DefineTextDot(Text=series, Location=area_4.Centroid, Font="Arial", Size=14)

tag = TextTag3D(Location=move.Geometry, Text=series, Size=Slider(0.4, range=0..1), Justification=1)
