# Grasshopper definition Selubung.gh (Grasshopper 1.0.7)
# plug-ins: Bifocals

number_slider = Slider(24, range=2..24)  # disabled
number_slider_2 = Slider(12, range=2..24)  # disabled

# ----
# Aswin Indraprastha
# 
# Program Studi Arsitektur
# Sekolah Arsitektur, Perencanaan, dan Pengembangan Kebijakan
# Institut Teknologi Bandung
# 
# aswin@itb.ac.id
# SKINS- WAFFLE GRID
# Menentukan Grid Pada Surface
# Surface treferensi yang di-reparameterize
srf = Surface(reparameterize(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))  # disabled
panel = Panel("Parameter Grid")  # disabled
divide = DivideDomain²(Domain=srf, UCount=number_slider_2, VCount=number_slider)  # disabled
subsrf = Isotrim(Surface=srf, Domain=divide)  # disabled
debrep = DeconstructBrep(Brep=subsrf)  # -> Faces, Edges, Vertices; disabled

# ----
# Memecah Brep/Surface dan Mengekstrak Segmen
srf_2 = Surface(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)  # disabled
panel_2 = Panel("Surface Referensi ")  # disabled
# SKINS- TWISTING LOUVRES
debrep_2 = DeconstructBrep(Brep=srf_2)  # -> Faces, Edges, Vertices; disabled
panel_3 = Panel("1")  # disabled
# Ekstrak hanya dua segmen/edges  yang saling berhadapan.
panel_4 = Panel("3")  # disabled
item = ListItem(List=debrep_2.Edges, Index=panel_3, Wrap=True)  # disabled
item_2 = ListItem(List=debrep_2.Edges, Index=panel_4, Wrap=True)  # disabled
points = PointList(Points=debrep_2.Vertices, Size=1)  # disabled

number_slider_3 = Slider(12, range=2..24)  # disabled
number_slider_4 = Slider(22, range=2..24)  # disabled

# ----
# SKINS- MAPPING-MORPHING
# Menentukan Grid Pada Surface
reference_surface = Surface(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)  # disabled
divide_2 = DivideDomain²(Domain=reference_surface, UCount=number_slider_3, VCount=number_slider_4)  # disabled
subsrf_2 = Isotrim(Surface=reference_surface, Domain=divide_2)  # disabled

# ----
# SKINS- INTERSECTING FIN
reference_surface_2 = Surface(reparameterize(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))  # disabled
# SKINS- WAVY PATTERN
surface = Surface(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)

# ----
# Menentukan Jarak Tebal Anyaman
# Parameter Jarak Tebal Anyaman
number_slider_5 = Slider(0.3, range=0.1..0.9)  # disabled
neg = Negative(Value=number_slider_5)  # disabled
merge = Merge(Data1=number_slider_5, Data2=neg)  # disabled

# ----
# SKINS- WEAVING
reference_surface_3 = Surface(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)  # disabled

# ----
# Menentukan Surface Planar
# Dari Surface Non-Planar
# Mengukur dimensi surface dengan dimensi uv. Plane Surface digunakan untuk membuat surface berdasarkan nilai uv, yang ukurannya sama dengan surface referensi.
dimensions = Dimensions(Surface=surface)  # -> UDimension, VDimension
# Menentukan Strip
plane_surface = PlaneSurface(Plane=PlaneXY(0, 0, 0), XSize=dimensions.VDimension, YSize=dimensions.UDimension)

# ----
# Menentukan Jumlah Grid
number_slider_6 = Slider(12, range=2..24)  # disabled
number_slider_7 = Slider(22, range=2..24)  # disabled

panel_6 = Panel("Buat parameter grid")  # disabled
divide_3 = DivideDomain²(Domain=reference_surface_2, UCount=number_slider_6, VCount=number_slider_7)  # disabled

number_slider_8 = Slider(12, range=2..24)  # disabled
number_slider_9 = Slider(24, range=2..24)  # disabled

# ----
# Memecah Segmen Menjadi Beberapa Segmen
# dengan Panjang
# Sesuai Pola Mapper
# Parameter jumlah segmen pada setiap Edge
jumlah_segmen = Slider(16, range=2..60)  # disabled
range = Range(Domain=Domain(0, 1), Steps=jumlah_segmen)  # disabled
graph = GraphMapper(
    range,
    x0=0,
    x1=1,
    y0=0,
    y1=1,
    container_name="Bezier",
    cpx=[0, 0.3694274426, 0.7041402459, 1],
    cpy=[0, 0.5308431387, 0.5709617734, 1])  # disabled

panel_7 = Panel(subsrf)  # disabled
sdivide = DivideSurface(Surface=reference_surface_3, UCount=number_slider_8, VCount=number_slider_9)  # -> Points, Normals, Parameters; disabled
# Menentukan Pola Grid
subsrf_3 = Isotrim(Surface=reference_surface_2, Domain=divide_3)  # disabled
panel_8 = Panel(divide_3)  # disabled

# ----
# Geometri Mapping
geo = Geometry(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)  # disabled
bbox = BoundingBox(Content=geo, Plane=PlaneXY(0, 0, 0), UnionBox=False)  # -> Box, Box_2; disabled

dedom2num = DeconstructDomain²(Domain=divide_3)  # -> UMin, UMax, VMin, VMax; disabled
merge_2 = Merge(Data1=dedom2num.UMin, Data2=dedom2num.UMax)  # disabled
lng = ListLength(List=dedom2num.UMax)  # disabled
graph_2 = GraphMapper(
    merge_2,
    x0=0,
    x1=1,
    y0=0,
    y1=1,
    container_name="Bezier",
    cpx=[0, 0.3533519804, 0.08634085953, 1],
    cpy=[0, 0.2146367431, 0.8010129929, 1])  # disabled
split = SplitList(List=graph_2, Index=lng)  # -> ListA, ListB; disabled
# Modifikasi struktur data agar pembuatan Line antar nomor indeks yang sama bisa dilakukan
dom²num = ConstructDomain²(UMin=split.ListA, UMax=split.ListB, VMin=dedom2num.VMin, VMax=dedom2num.VMax)  # disabled

number_slider_10 = Slider(0.05, range=0.05..0.48)  # disabled
number_slider_11 = Slider(0.5, range=0.01..0.5)  # disabled

# ----
# Jika Jarak Offset Berkorelasi
# dengan Jarak Terhadap Titik Atraktor
attractor_point = Point(Point(8, 12, 5))  # disabled

# ----
# Kurva Anyaman Pada Arah v
point01 = Point(flatten(sdivide.Points))  # disabled
point01_2 = Point(sdivide.Points)  # disabled
lng_2 = ListLength(List=point01)  # disabled
repeat = RepeatData(Data=merge, Length=lng_2)  # disabled
multiplication = Multiplication(A=flatten(sdivide.Normals), B=repeat)  # disabled
move = Move(Geometry=point01, Motion=multiplication)  # -> Geometry, Transform; disabled
unflatten = UnflattenTree(Tree=move.Geometry, Guide=point01_2)  # disabled
intcrv = Interpolate(Vertices=unflatten, Degree=3, Periodic=False, KnotStyle=1)  # -> Curve, Length, Domain; disabled

# ----
# Kurva Anyaman Pada Arah u
point01_3 = Point(sdivide.Points)  # disabled
flip = FlipMatrix(Data=point01_3)  # disabled
point02 = Point(flatten(flip))  # disabled
neg_2 = Negative(Value=multiplication)  # disabled
move_2 = Move(Geometry=point02, Motion=neg_2)  # -> Geometry, Transform; disabled
unflatten_2 = UnflattenTree(Tree=move_2.Geometry, Guide=flip)  # disabled
intcrv_2 = Interpolate(Vertices=unflatten_2, Degree=3, Periodic=False, KnotStyle=1)  # -> Curve, Length, Domain; disabled

# ----
# Parameter grid, dimana sisi panjang memiliki grid=1, dan sisi pendek memiliki segmen genap (diatur di parameter Number Slider= Even Number)
divide_domain² = DivideDomain²(Domain=plane_surface, UCount=Slider(1, range=0..24), VCount=Slider(12, range=1..20))
isotrim = Isotrim(Surface=plane_surface, Domain=divide_domain²)

# ----
# Proses ini memodifikasi parameter grid (jumlah grid u dan v) dengan menentukan dimensi grid berdasarkan pola dari Graph Mapper.
panel_9 = Panel(lng)  # disabled
morph = BoxMorph(Geometry=geo, Reference=bbox.Box, Target=subsrf_2)  # disabled
number_slider_12 = Slider(34, range=0..100)  # disabled
shatter = Shatter(Curve=reparameterize(item), Parameters=graph)  # disabled
# Bagi masing-masing segmen dengan Jitter agar menghasilkan segmen. Jarak antar segmen ditentukan oleh pola kurva pada Graph Mapper
shatter_2 = Shatter(Curve=reparameterize(item_2), Parameters=graph)  # disabled

# ----
# Mambagi Strip
dispatch = Dispatch(List=isotrim, DispatchPattern=[True, False])  # -> ListA, ListB
surface_2 = Surface(dispatch.ListA)
# Membagi strip menjadi dua bagian dengan pola T/F
surface_3 = Surface(dispatch.ListB)

item_3 = ListItem(List=shatter, Index=number_slider_12, Wrap=True)  # disabled
number_slider_13 = Slider(0.2, range=0..2)  # disabled
subsrf_4 = Isotrim(Surface=reference_surface_2, Domain=dom²num)  # disabled

# ----
# Modifikasi Struktur Data
debrep_3 = DeconstructBrep(Brep=subsrf_4)  # -> Faces, Edges, Vertices; disabled
flip_2 = FlipMatrix(Data=debrep_3.Vertices)  # disabled
bang = ExplodeTree(Data=simplify(flip_2))  # -> Branch0, Branch1, Branch2, Branch3; disabled

panel_10 = Panel("Parameter ketebalan waffle")  # disabled
number_slider_14 = Slider(0.4, range=-1..1.1)  # disabled

panel_11 = Panel(debrep_3.Vertices)  # disabled
pipe = Pipe(Curve=[intcrv.Curve, intcrv_2.Curve], Radius=number_slider_13, Caps=0)  # disabled

curvepoint = PointOnCurve(shatter, parameter=0.5)  # disabled
# Dari masing-masing segmen, tentukan titik tengah dan hubungkan sehingga menjadi garis.
# Komponen Reverse List digunakan untuk membalikkan urutan list pada segmen kedua.
curvepoint_2 = PointOnCurve(shatter_2, parameter=0.5)  # disabled
rev = ReverseList(List=curvepoint_2)  # disabled

# ----
# Parameter Jumlah Titik Per Segmen
number_slider_15 = Slider(20, range=0..100)

# ----
# Menentukan Pola Kurva Interpolasi Pada Strip A
deconstruct_brep = DeconstructBrep(Brep=surface_2)  # -> Faces, Edges, Vertices
list_item = ListItem(List=deconstruct_brep.Edges, Index=0, Wrap=False)  # -> Item, Item1, Item2
flip_curve = FlipCurve(Curve=list_item.Item)  # -> Curve, Flag
divide_curve = DivideCurve(Curve=flip_curve.Curve, Count=number_slider_15, Kinks=False)  # -> Points, Tangents, Parameters
divide_curve_2 = DivideCurve(Curve=list_item.Item2, Count=number_slider_15, Kinks=False)  # -> Points, Tangents, Parameters
dispatch_2 = Dispatch(List=divide_curve.Points, DispatchPattern=[True, False])  # -> ListA, ListB
dispatch_3 = Dispatch(List=divide_curve_2.Points, DispatchPattern=[True, False])  # -> ListA, ListB
weave = Weave(Pattern=[0, 1], Stream0=dispatch_2.ListA, Stream1=dispatch_3.ListB, NullGaps=False)

# ----
# Menentukan Pola Kurva Interpolasi Pada Strip B
deconstruct_brep_2 = DeconstructBrep(Brep=surface_3)  # -> Faces, Edges, Vertices
list_item_2 = ListItem(List=deconstruct_brep_2.Edges, Index=0, Wrap=False)  # -> Item, Item1, Item2
flip_curve_2 = FlipCurve(Curve=list_item_2.Item)  # -> Curve, Flag
divide_curve_3 = DivideCurve(Curve=list_item_2.Item2, Count=number_slider_15, Kinks=False)  # -> Points, Tangents, Parameters
divide_curve_4 = DivideCurve(Curve=flip_curve_2.Curve, Count=number_slider_15, Kinks=False)  # -> Points, Tangents, Parameters
dispatch_4 = Dispatch(List=divide_curve_4.Points, DispatchPattern=[True, False])  # -> ListA, ListB
dispatch_5 = Dispatch(List=divide_curve_3.Points, DispatchPattern=[True, False])  # -> ListA, ListB
weave_2 = Weave(Pattern=[0, 1], Stream0=dispatch_5.ListA, Stream1=dispatch_4.ListB, NullGaps=False)

panel_12 = Panel(flip_2)  # disabled

# ----
# Parameter skala puncak waffle
number_slider_16 = Slider(0.6, range=0.1..0.9)  # disabled

ln = Line(StartPoint=curvepoint, EndPoint=rev)  # disabled

# ----
# Ambil salah satu segmen utuh, copy ke tengah jarak antara dua segmen.
# Putar segmen yang ada di tengah.
curvepoint_3 = PointOnCurve(ln, parameter=0.5)  # disabled
# Mencari Titik Tengah Setiap Sub Segmen, Hubungkan Dengan Garis,
# Duplikasi Salah Satu Sub Segmen ke Titik Tengah Garis, Lalu Rotasikan
vec2pt = Vector2Pt(PointA=curvepoint, PointB=curvepoint_3, Unitize=False)  # -> Vector, Length; disabled
move_3 = Move(Geometry=shatter, Motion=vec2pt.Vector)  # -> graft(Geometry), Transform; disabled
panel_13 = Panel("Parameter Sudut Putar")  # disabled
rotation = Slider(30, range=-90..90)  # disabled
curvepoint_4 = PointOnCurve(move_3.Geometry, parameter=0.5)  # disabled
xz = XZPlane(Origin=curvepoint_4)  # disabled
rotate = Rotate(Geometry=move_3.Geometry, Angle=degrees(rotation), Plane=xz)  # -> Geometry, Transform; disabled

ln_2 = Line(StartPoint=bang.Branch0, EndPoint=bang.Branch2)  # disabled
# Join dan buat dua garis menjadi satu Control Point Curve
ln_3 = Line(StartPoint=bang.Branch1, EndPoint=bang.Branch3)  # disabled

# ----
# Menentukan Ketebalan
grid_surface_isotrim = Surface(subsrf_4)  # disabled
panel_14 = Panel("Parameter ketebalan Fin")  # disabled
panel_15 = Panel(".5,.5")  # disabled
number_slider_17 = Slider(0.5, range=0..1)  # disabled
evalsrf = EvaluateSurface(Surface=grid_surface_isotrim, Point=panel_15)  # -> Point, Normal, UDirection, VDirection, Frame; disabled
neg_3 = Negative(Value=number_slider_17)  # disabled
multiplication_2 = Multiplication(A=evalsrf.Normal, B=neg_3)  # disabled

# ----
# Interpolasi Kurva
join = JoinCurves(Curves=[ln_2, ln_3], Preserve=False)  # disabled
cp = ControlPoints(Curve=join)  # -> Points, Weights, Knots; disabled
panel_16 = Panel("2")  # disabled
prune = PruneTree(Tree=cp.Points, Minimum=panel_16, Maximum=0)  # disabled
intcrv_3 = Interpolate(Vertices=prune, Degree=3, Periodic=False, KnotStyle=1)  # -> Curve, Length, Domain; disabled

# ----
# Membuat Kurva Interpolasi
unit_x = UnitX(Factor=expr("-x", 1))
# Menentukan Ketebalan Pola
interpolate_t = InterpolateT(Vertices=weave, TangentStart=unit_x, TangentEnd=unit_x, KnotStyle=1)  # -> Curve, Length, Domain
interpolate_t_2 = InterpolateT(Vertices=weave_2, TangentStart=unit_x, TangentEnd=unit_x, KnotStyle=1)  # -> Curve, Length, Domain

panel_17 = Panel(intcrv_3.Curve)  # disabled
extr = Extrude(Base=intcrv_3.Curve, Direction=multiplication_2)  # disabled

# ----
# Loft Surface
segments_1 = Curve(shatter)  # disabled
segments_2 = Curve(shatter_2)  # disabled
# Gabungkan segmen 1, segmen tengah yang sudah diputar dan segmen 2, lalu buat permukaan dengan komponen Loft.
rev_2 = ReverseList(List=segments_2)  # disabled
merge_3 = Merge(Data1=graft(segments_1), Data2=rotate.Geometry, Data3=graft(rev_2))  # disabled
loft = Loft(Curves=merge_3, Options={Adjust=False, Closed=False, LoftEnds=0, LoftSimp=0, LoftType=0, Rebuild=10, Refit=0.01})  # disabled

panel_18 = Panel("Parameter Ketebalan Pola")
number_slider_18 = Slider(1.25, range=0..10)
unit_z = UnitZ(Factor=number_slider_18)
extrude = Extrude(Base=[interpolate_t.Curve, interpolate_t_2.Curve], Direction=unit_z)  # -> flatten(Extrusion)

# ----
# Memproyeksikan Pola ke Surface Referensi
bounding_box = BoundingBox(Content=extrude, Plane=PlaneXY(0, 0, 0), UnionBox=True)  # -> Box, Box_2
number_slider_19 = Slider(1, range=0..1)
surface_morph = SurfaceMorph(
    Geometry=extrude,
    Reference=bounding_box.Box,
    Surface=reparameterize(surface),
    UDomain=number_slider_19,
    VDomain=number_slider_19,
    WDomain=number_slider_18)

# ----
# Nilai offset jika tanpa parameter Attractor Point
# Offset Edge Rectangular dari Grid
gridface = Surface(debrep.Faces)  # disabled
crv01 = Curve(debrep.Edges)  # disabled
# Offset Pada Setiap Grid
number_slider_20 = Slider(0.35, range=0..1)  # disabled
join_2 = JoinCurves(Curves=crv01, Preserve=False)  # disabled

# ----
# Jika ada Attractor Point
# Parameter rentang offset jika ada Attractor Point
dom = ConstructDomain(DomainStart=number_slider_11, DomainEnd=number_slider_10)  # disabled

# ----
# Permukaan dengan lubang-lubang hasil offset Edge Rectangular Grid
simplify = SimplifyTree(Tree=crv01, Front=False)  # disabled
graft = GraftTree(Tree=simplify, IncludeEmptyLists=True, IncludeNullItems=True)  # disabled

# ----
# Duplikasi dan Skalakan Obyek Hasil Offset
gridface_2 = Surface(gridface)  # disabled
panel_19 = Panel("0.5,0.5")  # disabled
evalsrf_2 = EvaluateSurface(Surface=reparameterize(gridface_2), Point=panel_19)  # -> Point, Normal, UDirection, VDirection, Frame; disabled
point01_4 = Point(evalsrf_2.Point)  # disabled
multiplication_3 = Multiplication(A=evalsrf_2.Normal, B=number_slider_14)  # disabled

dist = Distance(PointA=point01_4, PointB=attractor_point)  # -> flatten(Distance); disabled
bnd = Bounds(Numbers=dist)  # disabled
remap = RemapNumbers(Value=dist, Source=bnd, Target=dom)  # -> graft(Mapped), Clipped; disabled

data = Data(remap.Mapped)  # disabled

offsets = OffsetOnSrf(Curve=join_2, Distance=data, Surface=gridface)  # disabled

panel_20 = Panel(dist)  # disabled
panel_21 = Panel(bnd)  # disabled

# ----
# Membuat Surface Dengan Lubang Offset
crv02 = Curve(offsets)  # disabled
explode = Explode(Curve=crv02, Recursive=True)  # -> Segments, Vertices; disabled
crv03 = Curve(explode.Segments)  # disabled
simplify_2 = SimplifyTree(Tree=crv03, Front=False)  # disabled
graft_2 = GraftTree(Tree=simplify_2, IncludeEmptyLists=True, IncludeNullItems=True)  # disabled
merge_4 = Merge(Data1=graft_2, Data2=graft)  # disabled
loft_2 = Loft(Curves=merge_4, Options={Adjust=False, Closed=False, LoftEnds=0, LoftSimp=0, LoftType=0, Rebuild=10, Refit=0.01})  # disabled

neg_4 = Negative(Value=multiplication_3)  # disabled

scale = Scale(Geometry=crv03, Center=point01_4, Factor=number_slider_16)  # -> Geometry, Transform; disabled
move_4 = Move(Geometry=scale.Geometry, Motion=neg_4)  # -> Geometry, Transform; disabled

curve03 = Curve(crv03)  # disabled
crv04 = Curve(move_4.Geometry)  # disabled

# ----
# Loft Objek
merge_5 = Merge(Data1=graft(curve03), Data2=graft(crv04))  # disabled
item_4 = ListItem(List=crv04, Index=0, Wrap=True)  # -> Item, Item1, Item2, Item3; disabled
loft_3 = Loft(Curves=merge_5, Options={Adjust=False, Closed=False, LoftEnds=0, LoftSimp=0, LoftType=0, Rebuild=10, Refit=0.01})  # disabled
edgesrf = EdgeSurface(CurveA=item_4.Item, CurveB=item_4.Item1, CurveC=item_4.Item2, CurveD=item_4.Item3)  # disabled
merge_6 = Merge(Data1=loft_2, Data2=loft_3, Data3=edgesrf)  # disabled
