# Grasshopper definition Struktur Data.gh (Grasshopper 1.0.7)

# Aswin Indraprastha
# 
# Program Studi Arsitektur
# Sekolah Arsitektur, Perencanaan, dan Pengembangan Kebijakan
# Institut Teknologi Bandung
# 
# aswin@itb.ac.id
# BEKERJA DENGAN DATA DI GRASSHOPPER
# DOMAIN
crv = Curve(reparameterize(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))
number_slider = Slider(10, range=0..100)
# SINGLE, LIST, TREE
number_slider_2 = Slider(2, range=0..5)

# ----
# Input dua Points yang membentuk Line dan parameter dari Number Slider terhadap Line
number_slider_3 = Slider(0.5, range=0..1)
# CONTROL: BASE LINE
pt = Point(Point(0, 0, 0))
pt_2 = Point(Point(20, 0, 0))
ln = Line(StartPoint=pt, EndPoint=pt_2)
eval = EvaluateCurve(Curve=reparameterize(ln), Parameter=number_slider_3)  # -> Point, Tangent, Angle

crv_2 = Curve(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)

# ----
# Membuat Polygon dengan parameter jumlah titik sudut dan radius
number_slider_4 = Slider(5, range=4..12)
# INCREMENT:
# CONTROL VERTICAL LINE
number_slider_5 = Slider(5, range=1..10)
polygon = Polygon(Plane="20,0,0", Radius=number_slider_5, Segments=number_slider_4, FilletRadius=0)  # -> Polygon, Length

# ----
# Duplikasi ke arah Z dengan parameter jumlah susunan/layer dan nilai inkremental/jarak antar layer
layer = Slider(10, range=4..24)
series = Series(Start=0, Step=Slider(2, range=1..16), Count=layer)
Z = UnitZ(Factor=series)
move = Move(Geometry=polygon.Polygon, Motion=Z)  # -> Geometry, Transform

domain = Domain(crv)
domain_2 = Domain(crv_2)
pt_3 = Point(Point(6, 7, 0))
dom = ConstructDomain(DomainStart=Slider(0, range=0..100), DomainEnd=Slider(10, range=0..100))
dom_2 = ConstructDomain(DomainStart=Slider(0, range=0..100), DomainEnd=Slider(1, range=0..100))
crv_3 = Curve(<curve referenced from the Rhino model>)
number_slider_6 = Slider(0.5, range=0..1)
panel = Panel(domain)
panel_2 = Panel(domain_2)
dom_3 = ConstructDomain(DomainStart=Slider(20, range=0..100), DomainEnd=Slider(100, range=0..100))
domain_3 = Domain()
viewer = ParamViewer(number_slider_2)
# SINGLE DATA
# Data bisa berupa angka, atau koordinat, atau obyek tunggal.
# Satu data ini berada pada cabang utama {0}
viewer_2 = ParamViewer(pt_3)
panel_3 = Panel(number_slider_2)
panel_4 = Panel(pt_3)
range = Range(Domain=Domain(0, 1), Steps=number_slider)
divide = DivideCurve(Curve=crv_3, Count=number_slider, Kinks=False)  # -> Points, Tangents, Parameters
dedomain = DeconstructDomain(Domain=domain_2)  # -> Start, End
random = Random(Range=dom_3, Number=Slider(5, range=0..100), Seed=Slider(64, range=0..100))
remap = RemapNumbers(Value=Slider(2, range=0..100), Source=dom, Target=dom_2)  # -> Mapped, Clipped
panel_5 = Panel(range)
panel_6 = Panel(remap.Mapped)
eval_2 = EvaluateCurve(Curve=crv, Parameter=number_slider_6)  # -> Point, Tangent, Angle
eval_3 = EvaluateCurve(Curve=crv_2, Parameter=number_slider_6)  # -> Point, Tangent, Angle
remap_2 = RemapNumbers(Value=number_slider_6, Source=domain, Target=domain_2)  # -> Mapped, Clipped
eval_4 = EvaluateCurve(Curve=crv_3, Parameter=panel_5)  # -> Point, Tangent, Angle
amp = Amplitude(Vector=divide.Tangents, Amplitude=Slider(9.6, range=0..100))
dom_4 = ConstructDomain(DomainStart=dedomain.End, DomainEnd=dedomain.Start)
panel_7 = Panel(dom_3)
panel_8 = Panel(random)

# ----
# Memetakan nilai parametrik ke dalam jumlah dan radius lingkaran.
expression = Expression(x=number_slider_3, Expression="x*10")
series_2 = Series(Start="0", Step=1, Count=expression)
cir = Circle(Plane="10,20,0", Radius=series_2)

# ----
# Membagi garis menjadi segmen dan berikan teks.
divide_2 = DivideCurve(Curve=ln, Count=10, Kinks=False)  # -> Points, Tangents, Parameters
series_3 = Series(Start=0, Step=1, Count=10)
tag = TextTag3D(Location=divide_2.Points, Text=series_3, Size=".8", Justification=7)
preview = CustomPreview(Geometry=divide_2.Points, Material=ColourSwatch(SwatchColor=RGB(0, 235, 199)))

series_4 = Series(Start=0, Step=1, Count=10)
pt_4 = Point([Point(0, 0, 0), Point(6, 0, 0), Point(12, 0, 0)])
panel_9 = Panel(dom_4)
panel_10 = Panel(remap_2.Mapped)
ln_2 = Line(StartPoint=eval_2.Point, EndPoint=eval_3.Point)

# ----
# Skalakan hasill duplikasi.
# -titik pusat skala pada masing-masing layer
# -nilai skala pada sumbu x dan y pada masing-masing layer
panel_11 = Panel("0.01 To 1")
range_2 = Range(Domain=panel_11, Steps=expr("x-1", layer))
move_2 = Move(Geometry="20,0,0", Motion=Z)  # -> Geometry, Transform
rev = ReverseList(List=range_2)
scale_nu = ScaleNU(Geometry=move.Geometry, Plane=move_2.Geometry, ScaleX=rev, ScaleY=rev, ScaleZ=1)  # -> Geometry, Transform

move_3 = Move(Geometry=divide.Points, Motion=amp)  # -> Geometry, Transform
viewer_3 = ParamViewer(series_4)
# LIST/ARRAY DATA
# Data bisa berupa KUMPULAN angka, atau koordinat, atau KUMPULAN obyek PADA SATU CABANG.
# Beberapa data ini berada pada satu cabang utama {0}.
# Berapapun banyak data, jika hanya berada pada satu cabang, dinamakan LIST.
viewer_4 = ParamViewer(pt_4)
panel_12 = Panel(series_4)
panel_13 = Panel(pt_4)
vdis = VectorDisplay(Anchor=divide.Points, Vector=amp)
intcrv = Interpolate(Vertices=move_3.Geometry, Degree=3, Periodic=False, KnotStyle=1)  # -> Curve, Length, Domain

# ----
# DATA TREE
# Data bisa berupa KUMPULAN angka, atau koordinat, atau KUMPULAN obyek PADA BEBERAPA CABANG (List-nya List)
# Beberapa data ini berada pada beberapa cabang, dengan beberapa tingkat kedalaman{0;1;dst}.
series_5 = Series(Start=0, Step=1, Count=10)
pt_5 = Point([Point(0, 0, 0), Point(6, 0, 0), Point(12, 0, 0)])
graft = GraftTree(Tree=series_5, IncludeEmptyLists=True, IncludeNullItems=True)
graft_2 = GraftTree(Tree=pt_5, IncludeEmptyLists=True, IncludeNullItems=True)
simplify = SimplifyTree(Tree=graft, Front=False)
panel_14 = Panel(simplify)
viewer_5 = ParamViewer(simplify)
viewer_6 = ParamViewer(graft_2)
panel_15 = Panel(graft_2)

dom_5 = ConstructDomain(DomainStart=Slider(-6, range=-100..100), DomainEnd=Slider(4, range=0..100))
dom_6 = ConstructDomain(DomainStart=Slider(0, range=-100..100), DomainEnd=Slider(17, range=0..100))

# ----
# CONTROL: CONE
# Parameter input sebagai parameter utama untuk control semua obyek dan relasi antar obyek
number_slider_7 = Slider(2, range=1..20)

rectangle = Rectangle(Plane=PlaneXY(0, 0, 0), XSize=dom_5, YSize=dom_6, Radius=0)  # -> Rectangle, Length

# ----
# Putar masing-masing obyek yang sudah diskalakan/layer
# -nilai sudut ditentukan per layer dan dikalikan dengan Radian
# -ditambahkan parameter y untuk mengendalikan besar sudut
number_slider_8 = Slider(20, range=1..30)
eval_5 = Evaluate(F="Rad(x*y)", x=series, y=number_slider_8)
rotate = Rotate(Geometry=scale_nu.Geometry, Angle=eval_5, Plane=move_2.Geometry)  # -> Geometry, Transform
loft = Loft(Curves=rotate.Geometry, Options={Adjust=False, Closed=False, LoftEnds=0, LoftSimp=0, LoftType=0, Rebuild=10, Refit=0.01})

# ----
# Relasi Circle atas dan Circle bawah
expression_2 = Expression(x=number_slider_7, Expression="x*2.5")
panel_16 = Panel("Circle atas")
panel_17 = Panel("Circle bawah")
cir_2 = Circle(Plane="20,20,0", Radius=number_slider_7)
cir_3 = Circle(Plane="20,20,0", Radius=expression_2)

digit_scroller = DigitScroller(Scroller_Digits=12, Scroller_Prefix="X component", Scroller_Radix=9, Scroller_Value=2)
digit_scroller_2 = DigitScroller(Scroller_Digits=12, Scroller_Prefix="Y component", Scroller_Radix=9, Scroller_Value=2)
digit_scroller_3 = DigitScroller(Scroller_Digits=12, Scroller_Prefix="Z component", Scroller_Radix=9, Scroller_Value=0)
digit_scroller_4 = DigitScroller(Scroller_Digits=12, Scroller_Prefix="X component", Scroller_Radix=9, Scroller_Value=3)
digit_scroller_5 = DigitScroller(Scroller_Digits=12, Scroller_Prefix="Y component", Scroller_Radix=9, Scroller_Value=3)
digit_scroller_6 = DigitScroller(Scroller_Digits=12, Scroller_Prefix="Z component", Scroller_Radix=9, Scroller_Value=0)
digit_scroller_7 = DigitScroller(Scroller_Digits=12, Scroller_Prefix="B", Scroller_Radix=9, Scroller_Value=3)
digit_scroller_8 = DigitScroller(Scroller_Digits=12, Scroller_Prefix="Amplitude", Scroller_Radix=9, Scroller_Value=6)
vec = VectorXYZ(XComponent=digit_scroller, YComponent=digit_scroller_2, ZComponent=digit_scroller_3)  # -> Vector, Length
vec_2 = VectorXYZ(XComponent=digit_scroller_4, YComponent=digit_scroller_5, ZComponent=digit_scroller_6)  # -> Vector, Length
# POINT & VECTOR
pt_6 = Point(Point(8, 40, 0))

# ----
# Bentuk cone dari hasil Loft antara Circle atas dan Circle bawah
# Relasi Circle atas dan tinggi cone.
expression_3 = Expression(x=expression_2, Expression="x*1.5")
Z_2 = UnitZ(Factor=expression_3)
move_4 = Move(Geometry=cir_2, Motion=Z_2)  # -> Geometry, Transform
loft_2 = Loft(
    Curves=[cir_3, move_4.Geometry],
    Options={Adjust=False, Closed=False, LoftEnds=0, LoftSimp=0, LoftType=0, Rebuild=10, Refit=0.01})

panel_18 = Panel(vec.Vector)
# Buat dua buah CURVE. Masing-masing dibagi menjadi n segmen yang sama banyak
crv_bawah = Curve(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)
crv_atas = Curve(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)
digit_scroller_9 = DigitScroller(Scroller_Digits=12, Scroller_Prefix="Number", Scroller_Radix=9, Scroller_Value=2)
digit_scroller_10 = DigitScroller(Scroller_Digits=12, Scroller_Prefix="Seed", Scroller_Radix=9, Scroller_Value=10)
digit_scroller_11 = DigitScroller(Scroller_Digits=12, Scroller_Prefix="B", Scroller_Radix=9, Scroller_Value=2)
digit_scroller_12 = DigitScroller(Scroller_Digits=12, Scroller_Prefix="Y coordinate", Scroller_Radix=9, Scroller_Value=10)
digit_scroller_13 = DigitScroller(Scroller_Digits=12, Scroller_Prefix="Count", Scroller_Radix=9, Scroller_Value=7)
# List dan Data Matching
digit_scroller_14 = DigitScroller(Scroller_Digits=12, Scroller_Prefix="Start", Scroller_Radix=9, Scroller_Value=0)
digit_scroller_15 = DigitScroller(Scroller_Digits=12, Scroller_Prefix="Step", Scroller_Radix=9, Scroller_Value=1)
digit_scroller_16 = DigitScroller(Scroller_Digits=12, Scroller_Prefix="Y coordinate", Scroller_Radix=9, Scroller_Value=1)
addition = Addition(A=vec.Vector, B=vec_2.Vector)
number_slider_9 = Slider(60, range=0..100)
multiplication = Multiplication(A=vec.Vector, B=digit_scroller_7)
amp_2 = Amplitude(Vector=vec.Vector, Amplitude=digit_scroller_8)
# List dan Modifikasi Surface
number_slider_10 = Slider(15, range=0..100)
panel_19 = Panel(addition)
panel_20 = Panel("List berupa POINTS")
# Produksi dua buah bilangan acak antara 0 ke 10
panel_21 = Panel("0 To 10")
panel_22 = Panel(multiplication)
panel_23 = Panel(amp_2)
# List dan Modifikasi Curve
# CURVE dibagi mnejadi beberapa segmen menggunakan DIVIDE CURVE
number_slider_11 = Slider(24, range=0..40)
vlen = VectorLength(Vector=multiplication)
vlen_2 = VectorLength(Vector=amp_2)
vlen_3 = VectorLength(Vector=addition)
pt_7 = Point([Point(12.91985477, 27.86897822, 0), Point(11.08421729, 32.67239945, 0), Point(12.08866906, 36.53530411, 0), Point(16.51489861, 38.38590863, 0), Point(21.14428984, 36.44084259, 0)])

# ----
# Produksi bilangan dengan Series yang digunakan untuk memetakan Point: Point pada sumbu X dan Point pada sumby Y yang merupakan fungsi Sin
number_slider_12 = Slider(11, range=10..30)
# INCREMENT:
# SINE WAVE
number_slider_13 = Slider(66, range=10..128)
series_6 = Series(Start=0, Step=1, Count=number_slider_13)
eval_6 = Evaluate(F="5*sin(Rad(x*y))", x=series_6, y=number_slider_12)
pt_8 = ConstructPoint(XCoordinate=series_6, YCoordinate=0, ZCoordinate=0)
pt_9 = ConstructPoint(XCoordinate=series_6, YCoordinate=eval_6, ZCoordinate=0)
ln_3 = Line(StartPoint=pt_8, EndPoint=pt_9)

crv_4 = Curve(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)
# Buat pola Boolean untuk DISPATCH
panel_24 = Panel("""True
False
False
True
True
False""")
divide_3 = DivideCurve(Curve=crv_bawah, Count=number_slider_9, Kinks=False)  # -> Points, Tangents, Parameters
divide_4 = DivideCurve(Curve=crv_atas, Count=number_slider_9, Kinks=False)  # -> Points, Tangents, Parameters
panel_25 = Panel(vlen)
panel_26 = Panel(vlen_2)
panel_27 = Panel(vlen_3)
# SHIFT LIST
# Menggeser nilai indeks suatu LIST
number_slider_14 = Slider(0, range=0..10)
divide_5 = DivideCurve(Curve=crv_4, Count=number_slider_11, Kinks=False)  # -> Points, Tangents, Parameters
random_2 = Random(Range=panel_21, Number=digit_scroller_9, Seed=digit_scroller_10)
# Membuat tujuh POINTS dari koordinatnya.
series_7 = Series(Start=digit_scroller_14, Step=digit_scroller_15, Count=digit_scroller_13)
# LIST disorting dengan pola menggunakan DISPATCH.
# Nilai FALSE untuk koordinat-koordinat diberikan nilai Z
panel_28 = Panel("""True
False
False
True
True
True
False""")

# ----
# CONTROL: TWISTED LINES
# Parameter tinggi offset Circle
# Parameter nilai perputaran (Radian, 0<x<1)
number_slider_15 = Slider(2.1, range=0.1..10)
panel_29 = Panel("Radius Circle")
cir_4 = Circle(Plane="0,0,0", Radius=number_slider_15)
Z_3 = UnitZ(Factor="10")
move_5 = Move(Geometry=cir_4, Motion=Z_3)  # -> Geometry, Transform
rotate_2 = Rotate(Geometry=move_5.Geometry, Angle=expr("Rad(x*360)", Slider(0.33, range=0..1)), Plane="0,0,0")  # -> Geometry, Transform

panel_30 = Panel("Balik nomor indeks")
toggle = BooleanToggle(True)
panel_31 = Panel("Geser nomor indeks")
# MEMAHAMI LIST
# LIST ITEM
# Mengekstrak data pada suatu LIST berdasarkan NOMOR INDEKS-nya.
number_slider_16 = Slider(0, range=0..10)
pt_10 = ConstructPoint(XCoordinate=series_7, YCoordinate=digit_scroller_16, ZCoordinate=0)
# SORT LIST
# Mengurutkan LIST dari nilai terkecil.
addition_2 = Addition(A=random_2, B=digit_scroller_11)
panel_32 = Panel(random_2)
shift = ShiftList(List=divide_4.Points, Shift=number_slider_10, Wrap=True)
rev_2 = ReverseList(List=divide_3.Points)
panel_33 = Panel("Membuat dua POINTS")
digit_scroller_17 = DigitScroller(Scroller_Digits=12, Scroller_Prefix="B", Scroller_Radix=9, Scroller_Value=5)
shift_2 = ShiftList(List=pt_7, Shift=number_slider_14, Wrap=toggle)
dispatch = Dispatch(List=divide_5.Points, DispatchPattern=panel_24)  # -> ListA, ListB
vdis_2 = VectorDisplay(Anchor=pt_6, Vector=vec.Vector)
vdis_3 = VectorDisplay(Anchor=pt_6, Vector=panel_22)
vdis_4 = VectorDisplay(Anchor=pt_6, Vector=amp_2)
vdis_5 = VectorDisplay(Anchor=pt_6, Vector=addition)
sort = SortList(Keys=addition_2)  # -> Keys, ValuesA
dispatch_2 = Dispatch(List=rev_2, DispatchPattern=panel_28)  # -> ListA, ListB
panel_34 = Panel(pt_10)

points = PointList(Points=shift, Size="2")

points_2 = PointList(Points=rev_2, Size="2")

# ----
# Ini adalah POINTS dengan nilai TRUE
pt_11 = Point(dispatch.ListA)
# Ini adalah POINTS dengan nilai FALSE
pt_12 = Point(dispatch.ListB)
pt_13 = ConstructPoint(XCoordinate=sort.Keys, YCoordinate=digit_scroller_12, ZCoordinate=0)
panel_35 = Panel(sort.Keys)
pdecon = Deconstruct(Point=dispatch_2.ListB)  # -> XComponent, YComponent, ZComponent
# CULL INDEX
# Menyembunyikan suatu data berdasarkan NOMOR INDEKS-nya
cull_i = CullIndex(List=shift_2, Indices=number_slider_16, Wrap=toggle)
item = ListItem(List=shift_2, Index=number_slider_16, Wrap=toggle)
pdecon_2 = Deconstruct(Point=pt_12)  # -> XComponent, YComponent, ZComponent
# Ini adalah kumpulan POINTS dengan nilai TRUE
pt_14 = Point(dispatch_2.ListA)

# ----
# POINT ORDER
# Tampilkan indeks suatu obyek berdasarkan urutan LIST-nya
number_slider_17 = Slider(1, range=0..10)
order = PointOrder(Points=shift_2)
points_3 = PointList(Points=shift_2, Size=number_slider_17)

panel_36 = Panel(pt_13)
addition_3 = Addition(A=pdecon.ZComponent, B=digit_scroller_17)
digit_scroller_18 = DigitScroller(Scroller_Digits=12, Scroller_Prefix="X component", Scroller_Radix=9, Scroller_Value=4)
digit_scroller_19 = DigitScroller(Scroller_Digits=12, Scroller_Prefix="Y component", Scroller_Radix=9, Scroller_Value=0)
digit_scroller_20 = DigitScroller(Scroller_Digits=12, Scroller_Prefix="Z component", Scroller_Radix=9, Scroller_Value=0)
digit_scroller_21 = DigitScroller(Scroller_Digits=12, Scroller_Prefix="X component", Scroller_Radix=9, Scroller_Value=0)
digit_scroller_22 = DigitScroller(Scroller_Digits=12, Scroller_Prefix="Y component", Scroller_Radix=9, Scroller_Value=0)
digit_scroller_23 = DigitScroller(Scroller_Digits=12, Scroller_Prefix="Z component", Scroller_Radix=9, Scroller_Value=4)
pt_15 = ConstructPoint(XCoordinate=pdecon_2.XComponent, YCoordinate=pdecon_2.YComponent, ZCoordinate=Slider(5, range=0..10))
cir_5 = Circle(Plane=item, Radius=1)
digit_scroller_24 = DigitScroller(Scroller_Digits=12, Scroller_Prefix="Seed", Scroller_Radix=9, Scroller_Value=-52)
pt_16 = ConstructPoint(XCoordinate=pdecon.XComponent, YCoordinate=pdecon.YComponent, ZCoordinate=addition_3)
# POINT & VECTOR OPERATION
crv_5 = Curve(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)
pt_17 = Point(Point(21, 42, 0))

# ----
# Buat garis dari sumbu X ke proyeksinya pada kurva Sin.
# -S=setiap titik pada sumbu X
# -D: adah sesuai dengan Line pada proses sebelumnya
# -L=Gunakan amplifier/pengali dengan menggunakan beberapa komponen yang hasilnya merupakan nilai yang makin lama, makin besar/ makin kecil
panel_37 = Panel("1 To 3")
num = Number(ln_3)
range_3 = Range(Domain=panel_37, Steps=expr("x-1", number_slider_13))
eval_7 = Evaluate(F="x*y", x=num, y=range_3)
line = LineSDL(Start=pt_8, Direction=ln_3, Length=eval_7)

points_4 = PointList(Points=pt_10, Size=Slider(0.7, range=0..10))

points_5 = PointList(Points=pt_13, Size=Slider(0.7, range=0..10))

long = LongestList(ListA=pt_10, ListB=pt_13, PaddingMode=2)  # -> ListA, ListB
short = ShortestList(ListA=pt_10, ListB=pt_13, TrimMode=2)  # -> ListA, ListB
# Memnbuat LINE yang menghubungkan 5 POINTS ke 2 POINTS dengan beberapa strategi DATA MATCHING
crossref = CrossReference(ListA=pt_10, ListB=pt_13, CrossMode=1)  # -> ListA, ListB
# Gabungkan kedua LIST dengan pola Boolean
weave = Weave(Pattern=panel_24, Stream0=pt_15, Stream1=pt_11, NullGaps=False)
# Gabungkan DUA LIST dengan pola
weave_2 = Weave(Pattern=panel_28, Stream0=pt_16, Stream1=pt_14, NullGaps=False)
rectangle_2 = Rectangle(Plane=cull_i, XSize=Domain(-1, 1), YSize=Domain(-2, 2), Radius=0)  # -> Rectangle, Length

# ----
# Divide Curve, Circle atas
# Divide Curve, Circle bawah
number_slider_18 = Slider(12, range=4..24)
panel_38 = Panel("Parameter jumlah segmen")
divide_6 = DivideCurve(Curve=cir_4, Count=number_slider_18, Kinks=False)  # -> Points, Tangents, Parameters
divide_7 = DivideCurve(Curve=rotate_2.Geometry, Count=number_slider_18, Kinks=False)  # -> Points, Tangents, Parameters
panel_39 = Panel("Hubungkan Point-Point segmen")
ln_4 = Line(StartPoint=divide_6.Points, EndPoint=divide_7.Points)  # -> flatten(Line)

vec_3 = VectorXYZ(XComponent=digit_scroller_18, YComponent=digit_scroller_19, ZComponent=digit_scroller_20)  # -> Vector, Length
vec_4 = VectorXYZ(XComponent=digit_scroller_21, YComponent=digit_scroller_22, ZComponent=digit_scroller_23)  # -> Vector, Length
rev_3 = ReverseList(List=pt_10)
jitter = Jitter(List=pt_10, Jitter=1, Seed=digit_scroller_24)  # -> Values, Indices
# OBYEK FINAL A
# 
# Buat LINE antara LIST 1 dan LIST 2
ln_5 = Line(StartPoint=shift, EndPoint=rev_2)
ln_6 = Line(StartPoint=shift, EndPoint=weave_2)
ln_7 = Line(StartPoint=long.ListA, EndPoint=long.ListB)
ln_8 = Line(StartPoint=short.ListA, EndPoint=short.ListB)
ln_9 = Line(StartPoint=crossref.ListA, EndPoint=crossref.ListB)
intcrv_2 = Interpolate(Vertices=weave, Degree=3, Periodic=False, KnotStyle=1)  # -> Curve, Length, Domain
xprod = CrossProduct(VectorA=vec_3.Vector, VectorB=vec_4.Vector, Unitize=False)  # -> Vector, Length
dprod = DotProduct(VectorA=vec_3.Vector, VectorB=vec_4.Vector, Unitize=Toggle(False))
angle = Angle(VectorA=vec_3.Vector, VectorB=vec_4.Vector)  # -> Angle, Reflex
disc = Discontinuity(Curve=crv_5, Level=1)  # -> Points, Parameters
deg = Degrees(Radians=angle.Angle)
vdis_6 = VectorDisplay(Anchor=pt_17, Vector=vec_3.Vector)
vdis_7 = VectorDisplay(Anchor=pt_17, Vector=vec_4.Vector)
vdis_8 = VectorDisplay(Anchor=pt_17, Vector=xprod.Vector)
panel_40 = Panel(dprod)
loft_opt = LoftOptions(Closed=Toggle(True), Adjust=False, Rebuild=0, Refit=0, Type=0)
loft_opt_2 = LoftOptions(Closed=Toggle(True), Adjust=False, Rebuild=0, Refit=0, Type=0)
panel_41 = Panel("Buat SURFACE")

# ----
# Rotasikan garis-garis terhadap sumbu YZ dengan besaran sudut yang berpola:
# -ambil nilai-nilai dari Series yang memetakan Point pada sumbu X
# -amplifikasi dengan beberapa fungsi
# -tujuan akhir adalah membuat pola rotasi interval 360 derajat
number_slider_19 = Slider(5, range=0.5..5)
series_sumbu_x = Data(series_6)
eval_8 = Evaluate(F="(x*y)", x=series_sumbu_x, y=number_slider_19)
expression_4 = Expression(x=eval_8, y=Slider(0.9, range=0.1..2), Expression="Rad(x*y)")
yz = YZPlane(Origin=Point(0, 0, 0))
rotate_3 = Rotate(Geometry=line, Angle=expression_4, Plane=yz)  # -> Geometry, Transform

panel_42 = Panel(deg)
loft_3 = Loft(Curves=ln_5, Options=loft_opt)
loft_4 = Loft(Curves=ln_6, Options=loft_opt_2)
digit_scroller_25 = DigitScroller(Scroller_Digits=12, Scroller_Prefix="Length", Scroller_Radix=9, Scroller_Value=6)

# ----
# MEMAHAMI TREE
number_slider_20 = Slider(3, range=1..12)
pt_18 = Point([Point(17.78357357, 45.31202731, 0), Point(17.78357357, 47.30962212, 0), Point(17.65040058, 49.50697642, 0)])
pt_19 = Point([Point(10.72540524, 41.58318367, 0), Point(10.79199173, 43.58077848, 0), Point(10.39247277, 45.37861381, 0), Point(10.25929978, 47.50938161, 0), Point(10.31988706, 49.64431519, 0)])
viewer_7 = ParamViewer(pt_18)
viewer_8 = ParamViewer(pt_18)
panel_43 = Panel(pt_18)
pt_20 = Point(Point(0, 20, 0))
graft_3 = GraftTree(Tree=pt_18, IncludeEmptyLists=True, IncludeNullItems=True)
panel_44 = Panel(pt_19)
cir_6 = Circle(Plane=pt_20, Radius="5")
panel_45 = Panel("Cabang Utama {0}")
panel_46 = Panel(cir_6)
ln_10 = Line(StartPoint=pt_19, EndPoint=graft_3)
divide_8 = DivideCurve(Curve=cir_6, Count=number_slider_20, Kinks=False)  # -> Points, Tangents, Parameters
panel_47 = Panel(graft_3)
viewer_9 = ParamViewer(graft_3)
viewer_10 = ParamViewer(graft_3)
cir_7 = Circle(Plane=divide_8.Points, Radius="2")
tstat = TreeStatistics(Tree=ln_10)  # -> Paths, Length, Count
panel_48 = Panel("Cabang Kedua {0,0}")
panel_49 = Panel(cir_7)
divide_9 = DivideCurve(Curve=cir_7, Count=number_slider_20, Kinks=False)  # -> Points, Tangents, Parameters
item_2 = ListItem(List=tstat.Paths, Index="1", Wrap=True)
panel_50 = Panel(tstat.Paths)
panel_51 = Panel(tstat.Length)
panel_52 = Panel(tstat.Count)
panel_53 = Panel(ln_10)
viewer_11 = ParamViewer(ln_10)
viewer_12 = ParamViewer(ln_10)
item_3 = TreeItem(Tree=ln_10, Path=item_2, Index=Slider(3, range=0..10), Wrap=True)
cir_8 = Circle(Plane=divide_9.Points, Radius="1")
graft_4 = GraftTree(Tree=ln_10, IncludeEmptyLists=True, IncludeNullItems=True)  # -> simplify(Tree)
panel_54 = Panel("Cabang Ketiga{0,0,0}")
panel_55 = Panel(cir_8)
viewer_13 = ParamViewer(graft_4)
viewer_14 = ParamViewer(graft_4)
panel_56 = Panel(graft_4)
pshift = ShiftPaths(Data=graft_4, Offset="-1")
unflatten = UnflattenTree(Tree=graft_4, Guide=ln_10)
panel_57 = Panel(pshift)
panel_58 = Panel(unflatten)

shift_3 = ShiftList(List=ln_4, Shift=1, Wrap=True)  # -> flatten(List)
graft_5 = GraftTree(Tree=ln_4, IncludeEmptyLists=True, IncludeNullItems=True)
graft_6 = GraftTree(Tree=shift_3, IncludeEmptyLists=True, IncludeNullItems=True)
panel_59 = Panel("Produksi permukaan Hiperboloid")
loft_5 = Loft(
    Curves=[graft_5, graft_6],
    Options={Adjust=False, Closed=False, LoftEnds=0, LoftSimp=0, LoftType=0, Rebuild=10, Refit=0.01})

line_2 = LineSDL(Start=disc.Points, Direction=vec_3.Vector, Length=digit_scroller_25)
number_slider_21 = Slider(12, range=0..1100)
# Buat N buah nilai random untuk X dan Y sebagai informasi POINTS
number_slider_22 = Slider(52, range=0..100)
# Obyek Surface di-set dengan Reparameterized sehingga nilai domain u dan v masing-masing {0 To 1}
srf = Surface(reparameterize(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))
# Membuat Perpendicular Frame pada kurva dengan membaginya sesuai dengan parameter N
number_slider_23 = Slider(2, range=0..100)
# PLANE
crv_6 = Curve(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)
domain² = Domain²(srf)
panel_60 = Panel(domain²)
random_3 = Random(Range=Domain(0, 1), Number=number_slider_21, Seed=Slider(17, range=0..100))
random_4 = Random(Range=Domain(0, 1), Number=number_slider_21, Seed=number_slider_22)
# Membuat N Frame pada kurva dengan sesuai dengan parameter N
pframes = PerpFrames(Curve=crv_6, Count=number_slider_23, Align=Toggle(True))  # -> Frames, Parameters
pt_21 = ConstructPoint(XCoordinate=random_3, YCoordinate=random_4, ZCoordinate=0)

# ----
# INCREMENT:
# SNAIL CURVE
# Buat Circle dengan parameter Radius.
# Bagi Circle dengan jumlah segmen sama dengan nilai parameter radius, hubungkan antara Center Circle dengan masing-masing titik segmen
number_slider_24 = Slider(25, range=1..36)
int = Integer(number_slider_24)
cir_9 = Circle(Plane="0,0,0", Radius=int)
divide_10 = DivideCurve(Curve=cir_9, Count=int, Kinks=False)  # -> Points, Tangents, Parameters
ln_11 = Line(StartPoint=cir_9, EndPoint=divide_10.Points)

frames = CurveFrames(Curve=crv_6, Count=number_slider_23)  # -> Frames, Parameters
# Petakan POINTS pada SURFACE
evalsrf = EvaluateSurface(Surface=srf, Point=pt_21)  # -> Point, Normal, UDirection, VDirection, Frame
# Buat CONE sesuai dengan jumlah dan letak FRAME/POINT
number_slider_25 = Slider(5, range=0..100)
# Jumlah obyek BOX sesuai dengan jumlah Frame
number_slider_26 = Slider(1, range=0..10)
cone = Cone(Base=evalsrf.Frame, Radius=Slider(1, range=0..100), Length=number_slider_25)  # -> Cone, Tip
box = CenterBox(Base=frames.Frames, X=Slider(2, range=0..10), Y=Slider(5, range=0..10), Z=number_slider_26)
number_slider_27 = Slider(8, range=0..100)

# ----
# Buat garis baru yang menghubungkan titik pusat Circle, dengan arah sesuai dengan setiap garis sebelumnya, dan panjang yang parametrik.
# Cara yang sama digunakan namun dengan parameter panjang garis yang berbeda untuk memproduksi kurva.
series_8 = Series(Start=0, Step=1, Count=int)
expression_5 = Expression(x=series_8, Expression="(x^2)/44")
line_3 = LineSDL(Start="0,0,0", Direction=ln_11, Length=expression_5)
move_6 = Move(Geometry="0,0,0", Motion=line_3)  # -> Geometry, Transform
intcrv_3 = Interpolate(Vertices=move_6.Geometry, Degree=3, Periodic=False, KnotStyle=1)  # -> Curve, Length, Domain
preview_2 = CustomPreview(Geometry=intcrv_3.Curve, Material=ColourSwatch(SwatchColor=RGB(88, 212, 255)))

series_9 = Series(Start=0, Step=1, Count=int)
expression_6 = Expression(x=series_9, Expression="(x^2)/26")
line_4 = LineSDL(Start="0,0,0", Direction=ln_11, Length=expression_6)
move_7 = Move(Geometry="0,0,0", Motion=line_4)  # -> Geometry, Transform
intcrv_4 = Interpolate(Vertices=move_7.Geometry, Degree=3, Periodic=False, KnotStyle=1)  # -> Curve, Length, Domain
preview_3 = CustomPreview(Geometry=intcrv_4.Curve, Material=ColourSwatch(SwatchColor=RGB(88, 212, 129)))

amp_3 = Amplitude(Vector=evalsrf.Normal, Amplitude=number_slider_27)
line_5 = LineSDL(Start=evalsrf.Point, Direction=amp_3, Length=number_slider_27)
loft_6 = Loft(
    Curves=[intcrv_3.Curve, intcrv_4.Curve],
    Options={Adjust=False, Closed=False, LoftEnds=0, LoftSimp=0, LoftType=0, Rebuild=10, Refit=0.01})
