# Grasshopper definition Surface Geometry.gh (Grasshopper 1.0.7)
# plug-ins: Bifocals

# 0.
# Surface Referensi
srf = Surface(reparameterize(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))
reference_surface = Surface(srf)  # disabled

# ----
# Bagi Surface menjadi grid
number_slider = Slider(24, range=2..24)  # disabled
number_slider_2 = Slider(12, range=2..24)  # disabled

# ----
# Aswin Indraprastha
# 
# Program Studi Arsitektur
# Sekolah Arsitektur, Perencanaan, dan Pengembangan Kebijakan
# Institut Teknologi Bandung
# 
# aswin@itb.ac.id
wires = BrepWireframe(Brep=srf, Density=-1)  # disabled
reference_surface_2 = Surface(reparameterize(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))

number_slider_3 = Slider(12, range=2..24)  # disabled
number_slider_4 = Slider(24, range=2..24)  # disabled

divide = DivideDomain²(Domain=srf, UCount=number_slider_2, VCount=number_slider)  # disabled
subsrf = Isotrim(Surface=srf, Domain=divide)  # disabled

reference_surface_3 = Surface(reparameterize(reference_surface_2))

number_slider_5 = Slider(0.3, range=0.1..0.9)  # disabled
neg = Negative(Value=number_slider_5)  # disabled
merge = Merge(Data1=number_slider_5, Data2=neg)  # disabled
panel = Panel(merge)  # disabled

number_slider_6 = Slider(12, range=2..24)  # disabled
number_slider_7 = Slider(24, range=2..24)  # disabled

sdivide = DivideSurface(Surface=reference_surface, UCount=number_slider_3, VCount=number_slider_4)  # -> Points, Normals, Parameters; disabled

panel_2 = Panel(sdivide.Points)  # disabled

debrep = DeconstructBrep(Brep=subsrf)  # -> Faces, Edges, Vertices; disabled

number_slider_8 = Slider(12, range=2..24)  # disabled
number_slider_9 = Slider(22, range=2..24)  # disabled
geo = Geometry(<brep referenced from the Rhino model>)  # disabled
srf_2 = Surface(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)  # disabled
divide_2 = DivideDomain²(Domain=reference_surface_3, UCount=Slider(12, range=2..24), VCount=Slider(22, range=2..24))
reference_surface_4 = Surface(srf)  # disabled
geo_2 = Geometry(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)  # disabled
viewer = ParamViewer(sdivide.Points)  # disabled

dedom2num = DeconstructDomain²(Domain=divide_2)  # -> UMin, UMax, VMin, VMax
merge_2 = Merge(Data1=dedom2num.UMin, Data2=dedom2num.UMax)
graph = GraphMapper(merge_2, x0=0, x1=1, y0=0, y1=1, container_name="Bezier", cpx=[0, 0, 0, 1], cpy=[0, 0.1613539457, 1, 1])
lng = ListLength(List=dedom2num.UMax)
split = SplitList(List=graph, Index=lng)  # -> ListA, ListB
dom²num = ConstructDomain²(UMin=split.ListA, UMax=split.ListB, VMin=dedom2num.VMin, VMax=dedom2num.VMax)

divide_3 = DivideDomain²(Domain=srf_2, UCount=number_slider_6, VCount=number_slider_7)  # disabled
panel_3 = Panel(divide_3)  # disabled
point01 = Point(flatten(sdivide.Points))  # disabled
point01_2 = Point(sdivide.Points)  # disabled
divide_4 = DivideDomain²(Domain=reference_surface_4, UCount=number_slider_8, VCount=number_slider_9)  # disabled
gridface = Surface(debrep.Faces)  # disabled

# ----
# Jika nilai offset adalah konstanta
# Offset setiap kotak grid
all_edges = Curve(debrep.Edges)  # disabled
number_slider_10 = Slider(0.45, range=0..1)  # disabled
join = JoinCurves(Curves=all_edges, Preserve=False)  # disabled
offsets = OffsetOnSrf(Curve=join, Distance=number_slider_10, Surface=gridface)  # disabled

subsrf_2 = Isotrim(Surface=srf_2, Domain=divide_3)  # disabled
bbox = BoundingBox(Content=geo_2, Plane=PlaneXY(0, 0, 0))  # -> Box, Box_2; disabled
subsrf_3 = Isotrim(Surface=reference_surface_4, Domain=divide_4)  # disabled
pt = Point(<point referenced from the Rhino model>)  # disabled
area = Area(Geometry=subsrf_2)  # -> Area, Centroid; disabled

# ----
# Mengulang data sepanjang input L
lng_2 = ListLength(List=point01)  # disabled
repeat = RepeatData(Data=merge, Length=lng_2)  # disabled

panel_4 = Panel(".25")  # disabled
panel_5 = Panel("2")  # disabled
morph = BoxMorph(Geometry=geo_2, Reference=bbox.Box, Target=subsrf_3)  # disabled
dist = Distance(PointA=area.Centroid, PointB=pt)  # disabled
dom = ConstructDomain(DomainStart=panel_4, DomainEnd=panel_5)  # disabled
bnd = Bounds(Numbers=dist)  # disabled

dom_2 = Domain²Components(Domain=divide_3)  # -> UComponent, VComponent; disabled

remap = RemapNumbers(Value=dist, Source=bnd, Target=dom)  # -> Mapped, Clipped; disabled

# ----
# Mengubah susunan struktur data menggunakan Flip Matrix
point01_3 = Point(sdivide.Points)  # disabled
flip = FlipMatrix(Data=point01_3)  # disabled
point02 = Point(flatten(flip))  # disabled

panel_6 = Panel("-1.2")  # disabled
crv02 = Curve(offsets)  # disabled
panel_7 = Panel(crv02)  # disabled
multiplication = Multiplication(A=remap.Mapped, B=panel_6)  # disabled

# ----
# Memindahkan titik-titik ke arah normal dengan jarak sesuai hasil Repeat Data.
multiplication_2 = Multiplication(A=flatten(sdivide.Normals), B=repeat)  # disabled
move = Move(Geometry=point01, Motion=multiplication_2)  # -> Geometry, Transform; disabled

explode = Explode(Curve=crv02, Recursive=True)  # -> Segments, Vertices; disabled
srfmorph = SurfaceMorph(Geometry=geo, Reference=geo, Surface=srf_2, UDomain=dom_2.UComponent, VDomain=dom_2.VComponent, WDomain=multiplication)  # disabled

crv03 = Curve(explode.Segments)  # disabled
panel_8 = Panel(crv03)  # disabled
simplify = SimplifyTree(Tree=crv03, Front=False)  # disabled
panel_9 = Panel(simplify)  # disabled
graft = GraftTree(Tree=simplify, IncludeEmptyLists=True, IncludeNullItems=True)  # disabled
panel_10 = Panel(graft)  # disabled

simplify_2 = SimplifyTree(Tree=all_edges, Front=False)  # disabled
panel_11 = Panel(simplify_2)  # disabled
graft_2 = GraftTree(Tree=simplify_2, IncludeEmptyLists=True, IncludeNullItems=True)  # disabled
panel_12 = Panel(graft_2)  # disabled

# ----
# Pindahkan titik-titik sesuai pola Repeat Data.
neg_2 = Negative(Value=multiplication_2)  # disabled
move_2 = Move(Geometry=point02, Motion=neg_2)  # -> Geometry, Transform; disabled

subsrf_4 = Isotrim(Surface=reference_surface_3, Domain=dom²num)
unflatten = UnflattenTree(Tree=move.Geometry, Guide=point01_2)  # disabled
unflatten_2 = UnflattenTree(Tree=move_2.Geometry, Guide=flip)  # disabled
number_slider_11 = Slider(0.2, range=0..2)  # disabled

intcrv = Interpolate(Vertices=unflatten, Degree=3, Periodic=False, KnotStyle=1)  # -> Curve, Length, Domain; disabled

intcrv_2 = Interpolate(Vertices=unflatten_2, Degree=3, Periodic=False, KnotStyle=1)  # -> Curve, Length, Domain; disabled

debrep_2 = DeconstructBrep(Brep=subsrf_4)  # -> Faces, Edges, Vertices
panel_13 = Panel(debrep_2.Vertices)
points = PointList(Points=debrep_2.Vertices, Size=".3")

pipe = Pipe(Curve=[intcrv.Curve, intcrv_2.Curve], Radius=number_slider_11, Caps=0)  # disabled

flip_2 = FlipMatrix(Data=debrep_2.Vertices)
panel_14 = Panel(flip_2)
points_2 = PointList(Points=flip_2, Size=".3")

# ----
# 1.
# Surface Bingkai
# Membuat surface bingkai.
merge_3 = Merge(Data1=graft, Data2=graft_2)  # disabled
loft = Loft(Curves=merge_3, Options={Adjust=False, Closed=False, LoftEnds=0, LoftSimp=0, LoftType=0, Rebuild=10, Refit=0.01})  # disabled

bang = ExplodeTree(Data=simplify(flip_2))  # -> Branch0, Branch1, Branch2, Branch3
panel_15 = Panel(bang.Branch0)

gridface_2 = Surface(gridface)  # disabled
panel_16 = Panel("0.5,0.5")  # disabled
# Parameter untuk menentukan ketebalan wafel
number_slider_12 = Slider(0.5, range=-1..1.1)  # disabled
evalsrf = EvaluateSurface(Surface=reparameterize(gridface_2), Point=panel_16)  # -> Point, Normal, UDirection, VDirection, Frame; disabled
point01_4 = Point(evalsrf.Point)  # disabled
multiplication_3 = Multiplication(A=evalsrf.Normal, B=number_slider_12)  # disabled
number_slider_13 = Slider(0.6, range=0.1..0.9)  # disabled
# 2.
# Surface Wafel
scale = Scale(Geometry=crv03, Center=point01_4, Factor=number_slider_13)  # -> Geometry, Transform; disabled
move_3 = Move(Geometry=scale.Geometry, Motion=multiplication_3)  # -> Geometry, Transform; disabled

ln = Line(StartPoint=bang.Branch0, EndPoint=bang.Branch2)
ln_2 = Line(StartPoint=bang.Branch1, EndPoint=bang.Branch3)
points_3 = PointList(Points=bang.Branch0, Size=".3")
grid_surface_isotrim = Surface(subsrf_4)
join_2 = JoinCurves(Curves=[ln, ln_2], Preserve=False)
cp = ControlPoints(Curve=join_2)  # -> Points, Weights, Knots
evalsrf_2 = EvaluateSurface(Surface=grid_surface_isotrim, Point=".5,.5")  # -> Point, Normal, UDirection, VDirection, Frame
prune = PruneTree(Tree=cp.Points, Minimum="2", Maximum=0)
multiplication_4 = Multiplication(A=evalsrf_2.Normal, B="-.5")

number_slider_14 = Slider(0.1, range=0.1..0.48)  # disabled
# Jika nilai offset variabel atau menggunakan jarak terhadap atraktor.
number_slider_15 = Slider(0.45, range=0.01..0.45)  # disabled

attractor_point = Point(Point(17, -5.642655442, 2.039302955))  # disabled
dist_2 = Distance(PointA=point01_4, PointB=attractor_point)  # -> flatten(Distance); disabled
dom_3 = ConstructDomain(DomainStart=number_slider_14, DomainEnd=number_slider_15)  # disabled
bnd_2 = Bounds(Numbers=dist_2)  # disabled
remap_2 = RemapNumbers(Value=dist_2, Source=bnd_2, Target=dom_3)  # -> graft(Mapped), Clipped; disabled

# ----
# Jika nilai offset adalah variabel terhadap jarak dengan titik atraktor
data = Data(remap_2.Mapped)  # disabled

intcrv_3 = Interpolate(Vertices=prune, Degree=3, Periodic=False, KnotStyle=1)  # -> Curve, Length, Domain
extr = Extrude(Base=intcrv_3.Curve, Direction=multiplication_4)
panel_17 = Panel(dist_2)  # disabled
curve03 = Curve(crv03)  # disabled
crv04 = Curve(move_3.Geometry)  # disabled
panel_18 = Panel(curve03)  # disabled
panel_19 = Panel(crv04)  # disabled
merge_4 = Merge(Data1=graft(curve03), Data2=graft(crv04))  # disabled
item = ListItem(List=crv04, Index=0, Wrap=True)  # -> Item, Item1, Item2, Item3; disabled
loft_2 = Loft(Curves=merge_4, Options={Adjust=False, Closed=False, LoftEnds=0, LoftSimp=0, LoftType=0, Rebuild=10, Refit=0.01})  # disabled
edgesrf = EdgeSurface(CurveA=item.Item, CurveB=item.Item1, CurveC=item.Item2, CurveD=item.Item3)  # disabled
panel_20 = Panel("Hasil Akhir")  # disabled
merge_5 = Merge(Data1=loft, Data2=loft_2, Data3=edgesrf)  # disabled
