# Grasshopper definition Surface Geometry2.gh (Grasshopper 1.0.7)
# plug-ins: Bifocals, LunchBox, Weaverbird

panel = Panel("10")  # disabled
crv = Curve(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)
crv_2 = Curve(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)
crv_3 = Curve(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)
# Teknik Membuat Surface
crv_4 = Curve(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)  # disabled
Z = UnitZ(Factor=panel)  # disabled
extr = Extrude(Base=crv_4, Direction=Z)  # disabled
loft = Loft(
    Curves=[crv, crv_2, crv_3],
    Options={Adjust=False, Closed=False, LoftEnds=0, LoftSimp=0, LoftType=0, Rebuild=10, Refit=0.01})
crv_5 = Curve(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)  # disabled
crv_6 = Curve(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)  # disabled
crv_7 = Curve(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)  # disabled
crv_8 = Curve(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)  # disabled
edgesrf = EdgeSurface(CurveA=crv_7, CurveB=crv_8)  # disabled
boundary = BoundarySurfaces(Edges=[crv_5, crv_6])  # disabled

crv_9 = Curve(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)
crv_10 = Curve(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)
# KONSTRUKSI SURFACE
# 
# 1. Gunakan Edge Surface untuk membuat Surface dari empat Curves yang saling berhubungan di Rhino
# 2. Reparameterized surface
# 3. Gunakan Divide Domain 2 untuk membuat grid.
# 4. Gunakan Isotrim untuk membagi grid face.
crv_11 = Curve(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)
crv_12 = Curve(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)
# EDIT SALAH SATU FACE
# 
# 1. Ekstrak surface hasil Isotrim, misalnya pada indeks 0.
# 2. Ekstrak grid face dengan Deconstruct Brep untuk menghasilkan titik-titik vertices.
# 3. Untuk informasi index number, gunakan PointList.
# 4. Extract titik-titik vertices berdasarkan nomor indeksnya dan gunakan Line untuk membuat garis
number_slider = Slider(4, range=2..16)
edgesrf_2 = EdgeSurface(CurveA=crv_9, CurveB=crv_12, CurveC=crv_10, CurveD=crv_11)
crv_13 = Curve(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)  # disabled
# Aswin Indraprastha
# 
# Program Studi Arsitektur
# Sekolah Arsitektur, Perencanaan, dan Pengembangan Kebijakan
# Institut Teknologi Bandung
# 
# aswin@itb.ac.id
# BASIC SURFACE GEOMETRY
crv_14 = Curve(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)  # disabled
crv_15 = Curve(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)  # disabled
crv_16 = Curve(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)  # disabled
srf = Surface(edgesrf_2)
edgesrf_3 = EdgeSurface(CurveA=crv_14, CurveB=crv_15, CurveC=crv_13, CurveD=crv_16)  # disabled
divide = DivideDomain²(Domain=srf, UCount=Slider(4, range=2..16), VCount=number_slider)
srf_2 = Surface(reparameterize(edgesrf_3))  # disabled

panel_2 = Panel("3")  # disabled
revsrf = ReverseSurfaceDirection(Surface=reparameterize(srf_2), ReverseOption=panel_2)  # disabled

# ----
# Memetakan Titik Pada Surface, berikut Vektor Normalnya
md_slider = MDSlider(
    SliderMode=0,
    slider_value=Point(0.5829058624, 0.5377294029, 0.5),
    x_domain=Domain(0, 1),
    y_domain=Domain(0, 1),
    z_domain=Domain(0, 1))  # disabled
evalsrf = EvaluateSurface(Surface=srf_2, Point=md_slider)  # -> Point, Normal, UDirection, VDirection, Frame; disabled
iso = IsoCurve(Surface=srf_2, UVPoint=md_slider)  # -> UIsocurve, VIsocurve; disabled
panel_3 = Panel("12")  # disabled
multiplication = Multiplication(A=evalsrf.Normal, B=panel_3)  # disabled
vdis = VectorDisplay(Anchor=evalsrf.Point, Vector=multiplication)  # disabled

# ----
# Tes arah vektor normal dari suatu Surface. Flip digunakan untuk membalik vektor normal
srf_3 = Surface(reparameterize(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))  # disabled
subsrf = Isotrim(Surface=srf, Domain=divide)
panel_4 = Panel("8")  # disabled
panel_5 = Panel("8")  # disabled

# ----
# 1. Tentukan Rangka Batas
# Bagi Surface menjadi grid (face), lalu explode menjadi Edges, dan setiap edge dibuat penebalan dengan Pipe.
panel_6 = Panel(subsrf)
debrep = DeconstructBrep(Brep=subsrf)  # -> Faces, Edges, Vertices
panel_7 = Panel(debrep.Edges)
pipe = Pipe(Curve=debrep.Edges, Radius=Slider(0.1, range=0.1..0.75), Caps=0)

sdivide = DivideSurface(Surface=srf_2, UCount=panel_4, VCount=panel_5)  # -> Points, Normals, Parameters; disabled
panel_8 = Panel("2")  # disabled
multiplication_2 = Multiplication(A=sdivide.Normals, B=panel_8)  # disabled
vdis_2 = VectorDisplay(Anchor=sdivide.Points, Vector=multiplication_2)  # disabled

pt = Point(Point(9, 6, 1))  # disabled
srf_cp = SurfaceClosestPoint(Point=pt, Surface=srf_2)  # -> Point, UVPoint, Distance; disabled
pt_2 = Point(srf_cp.Point)  # disabled

divide_2 = DivideDomain²(Domain=srf_2, UCount=panel_4, VCount=panel_5)  # disabled
subsrf_2 = Isotrim(Surface=srf_2, Domain=divide_2)  # disabled

divide_3 = DivideDomain²(Domain=srf_2, UCount=panel_4, VCount=panel_5)  # disabled
md_slider_2 = MDSlider(
    SliderMode=0,
    slider_value=Point(0.4817073171, 0.4728508926, 0.5),
    x_domain=Domain(0, 1),
    y_domain=Domain(0, 1),
    z_domain=Domain(0, 1))  # disabled
subsrf_3 = Isotrim(Surface=srf_2, Domain=divide_3)  # disabled
panel_9 = Panel("0")  # disabled
item = ListItem(List=subsrf_3, Index=panel_9, Wrap=True)  # disabled
panel_10 = Panel(subsrf_3)  # disabled
srf_4 = Surface(reparameterize(item))  # disabled
evalsrf_2 = EvaluateSurface(Surface=srf_4, Point=md_slider_2)  # -> Point, Normal, UDirection, VDirection, Frame; disabled
debrep_2 = DeconstructBrep(Brep=srf_4)  # -> Faces, Edges, Vertices; disabled
panel_11 = Panel(".6")  # disabled
points = PointList(Points=debrep_2.Vertices, Size=panel_11)  # disabled

flip = Flip(Surface=srf_3)  # -> Surface, Result; disabled

# ----
# Menentukan Titik Pada Surface
# Menentukan titik dan vektor normal pada Surface dengan Evaluate Surface dan MD Slider
md_slider_3 = MDSlider(
    SliderMode=0,
    slider_value=Point(0.6260645411, 0.3237198539, 0.5),
    x_domain=Domain(0, 1),
    y_domain=Domain(0, 1),
    z_domain=Domain(0, 1))  # disabled
evalsrf_3 = EvaluateSurface(Surface=flip.Surface, Point=md_slider_3)  # -> Point, Normal, UDirection, VDirection, Frame; disabled
panel_12 = Panel("5")  # disabled
multiplication_3 = Multiplication(A=evalsrf_3.Normal, B=panel_12)  # disabled
vdis_3 = VectorDisplay(Anchor=evalsrf_3.Point, Vector=multiplication_3)  # disabled

# ----
# Membagu Surface menjadi grid (face)
# Membuat IsoCurve
# Atas Suatu Titik Pada Surface
number_slider_2 = Slider(8, range=2..24)  # disabled
# Membagi Surface menjadi Grid Face
number_slider_3 = Slider(4, range=2..24)  # disabled
divide_4 = DivideDomain²(Domain=flip.Surface, UCount=number_slider_3, VCount=number_slider_2)  # disabled
subsrf_4 = Isotrim(Surface=flip.Surface, Domain=divide_4)  # -> reparameterize(Surface); disabled

# ----
# Memproyeksikan Titik Pada Surface
# Surface Closest Point akan menentukan titik pada Surface yang tegak lurus dengan suatu titik referensi.
pt_3 = Point(Point(23, 14, 5))  # disabled
srf_cp_2 = SurfaceClosestPoint(Point=pt_3, Surface=srf_3)  # -> Point, UVPoint, Distance; disabled
ln = Line(StartPoint=srf_cp_2.Point, EndPoint=pt_3)  # disabled

# ----
# 2. Tentukan Rangka Diagonal
# Ekstrak Vertices menggunakan Index, lalu hubungkan nomor Index (0-2) dan (1-3)sehingga membentuk diagrid.
panel_13 = Panel("0")
item_2 = ListItem(List=debrep.Vertices, Index=panel_13, Wrap=True)
item_3 = ListItem(List=debrep.Vertices, Index="1", Wrap=True)
item_4 = ListItem(List=debrep.Vertices, Index="2", Wrap=True)
item_5 = ListItem(List=debrep.Vertices, Index="3", Wrap=True)
ln_2 = Line(StartPoint=item_2, EndPoint=item_4)
ln_3 = Line(StartPoint=item_3, EndPoint=item_5)
merge = Merge(Data1=ln_2, Data2=ln_3)
pipe_2 = Pipe(Curve=merge, Radius=Slider(0.07, range=0.001..0.75), Caps=0)

# ----
# IsoCurve akan men-generasi dua kurva (IsoCurve) yang memetakan titik pada suatu Surface
iso_2 = IsoCurve(Surface=srf_3, UVPoint=md_slider_3)  # -> UIsocurve, VIsocurve; disabled
crv_17 = Curve(iso_2.VIsocurve)  # disabled
crv_18 = Curve(iso_2.UIsocurve)  # disabled

panel_14 = Panel("0")  # disabled
item_6 = ListItem(List=subsrf_4, Index=panel_14, Wrap=True)  # disabled

# ----
# Mengekstrak hanya Edges pada bagian boundary
edges = BrepEdges(Brep=flip.Surface)  # -> Naked, Interior, NonManifold; disabled
# Rangka Batas Bagian Atas
number_slider_4 = Slider(0.15, range=0.1..0.75)  # disabled
pipe_3 = Pipe(Curve=edges.Naked, Radius=number_slider_4, Caps=0)  # disabled

debrep_3 = DeconstructBrep(Brep=subsrf_4)  # -> Faces, Edges, Vertices; disabled

# ----
# Mengekstrak semua Edges pada Grid Face
number_slider_5 = Slider(0.18, range=0.1..0.75)  # disabled
pipe_4 = Pipe(Curve=debrep_3.Edges, Radius=number_slider_5, Caps=0)  # disabled

panel_15 = Panel(".5,.5")  # disabled
evalsrf_4 = EvaluateSurface(Surface=debrep_3.Faces, Point=panel_15)  # -> Point, Normal, UDirection, VDirection, Frame; disabled
# Pada setiap Grid Face (yang sudah di-reparameterized), tentukan koordinat pusatnya (uv=0.5,0.5), lalu buat garis tegak lurus dari setiap titik pusat Grid Face, tentukan endpoiint dari setiap garis tersebut.
number_slider_6 = Slider(3, range=0..10)  # disabled
line = LineSDL(Start=evalsrf_4.Point, Direction=evalsrf_4.Normal, Length=number_slider_6)  # disabled
end = EndPoints(Curve=line)  # -> Start, End; disabled

panel_16 = Panel("2")  # disabled

panel_17 = Panel("0")  # disabled
panel_18 = Panel("1")  # disabled
# Membuat diagrid dengan nomor indeks
panel_19 = Panel("3")  # disabled
panel_20 = Panel("2")  # disabled
item_7 = ListItem(List=debrep_3.Vertices, Index=panel_17, Wrap=True)  # disabled
item_8 = ListItem(List=debrep_3.Vertices, Index=panel_18, Wrap=True)  # disabled
item_9 = ListItem(List=debrep_3.Vertices, Index=panel_19, Wrap=True)  # disabled
item_10 = ListItem(List=debrep_3.Vertices, Index=panel_20, Wrap=True)  # disabled
ln_4 = Line(StartPoint=item_7, EndPoint=item_10)  # disabled
ln_5 = Line(StartPoint=item_8, EndPoint=item_9)  # disabled
merge_2 = Merge(Data1=ln_4, Data2=ln_5)  # disabled

points_2 = PointList(Points=debrep_3.Vertices, Size=panel_16)  # disabled

# ----
# Konfigurasikan setiap titik menjadi satu list (Flatten Tree)
flatten = FlattenTree(Tree=end.End, Path="{0}")  # disabled
panel_21 = Panel(flatten)  # disabled

# ----
# Rangka Dalam Bagian Atas
pline = PolyLine(Vertices=debrep_3.Vertices, Closed=False)  # disabled
panel_22 = Panel(".15")  # disabled
pipe_5 = Pipe(Curve=pline, Radius=panel_22, Caps=0)  # disabled

# ----
# Rangka Truss
ln_6 = Line(StartPoint=end.End, EndPoint=debrep_3.Vertices)  # disabled
panel_23 = Panel(".1")  # disabled
pipe_6 = Pipe(Curve=ln_6, Radius=panel_23, Caps=0)  # disabled

# ----
# Bagi list menjadi dua
panel_24 = Panel("8")  # disabled
partition = PartitionList(List=flatten, Size=panel_24)  # disabled

panel_25 = Panel("Garis-garis memanjang")  # disabled
panel_26 = Panel("Garis-garis melintang")  # disabled

flip_2 = FlipMatrix(Data=partition)  # disabled
pline_2 = PolyLine(Vertices=flip_2, Closed=False)  # disabled

pline_3 = PolyLine(Vertices=partition, Closed=False)  # disabled

# ----
# Rangka Bagian Bawah
merge_3 = Merge(Data1=pline_3, Data2=pline_2)  # disabled
panel_27 = Panel(".15")  # disabled
pipe_7 = Pipe(Curve=merge_3, Radius=panel_27, Caps=0)  # disabled

# ----
# ARC RIVER CULTURE PAVILION
# ASYMPTOTE ARCHITECT
image = ImageSampler(
    FilePath="D:\OneDrive - Institut Teknologi Bandung\0-ASWIN\PENDIDIKAN\SEMESTER II 2020-2021\ALGO\M10\ARC-Aymptote1b.png",
    Filter="Colour",
    Interpolate=False,
    Umax=1,
    Umin=0,
    Vmax=1,
    Vmin=0,
    Wrap=1)

# ----
# Elips Dasar
number_slider_7 = Slider(14, range=1..100)  # disabled
number_slider_8 = Slider(24, range=1..100)  # disabled

ellipse = Ellipse(Plane=PlaneXY(0, 0, 0), Radius1=number_slider_7, Radius2=number_slider_8)  # -> Ellipse, Focus1, Focus2; disabled
# Buat Elips. Buat Rectanhgle berdasarkan diameter panjang dan lebar Elips. Pada sisi panjang, bagi kurva menjadi beberapa segmen.
rec = Rectangle(ellipse.Ellipse)  # disabled
explode = Explode(Curve=rec, Recursive=True)  # -> Segments, Vertices; disabled
number_slider_9 = Slider(20, range=0..100)  # disabled
item_11 = ListItem(List=explode.Segments, Index=0, Wrap=True)  # -> Item, Item1, Item2, Item3; disabled
crv_19 = Curve(item_11.Item)  # disabled
crv_20 = Curve(item_11.Item3)  # disabled
divide_5 = DivideCurve(Curve=crv_20, Count=number_slider_9, Kinks=False)  # -> Points, Tangents, Parameters; disabled

# ----
# Kelengkungan Utama
number_slider_10 = Slider(5.5, range=0..100)  # disabled
number_slider_11 = Slider(18, range=0..100)  # disabled
dom = ConstructDomain(DomainStart=number_slider_10, DomainEnd=number_slider_11)  # disabled

image_2 = ImageSampler(
    FilePath="D:\OneDrive - Institut Teknologi Bandung\0-ASWIN\PENDIDIKAN\SEMESTER II 2020-2021\ALGO\M10\ARC-Aymptote2.jpg",
    Filter="Colour",
    Interpolate=False,
    Umax=1,
    Umin=0,
    Vmax=1,
    Vmin=0,
    Wrap=1)

# ----
# Profil
# Kelengkungan
range = Range(Domain=Domain(0, 1), Steps=number_slider_9)  # disabled
graph = GraphMapper(
    range,
    x0=0,
    x1=1,
    y0=0,
    y1=1,
    container_name="Bezier",
    cpx=[0, 0.6304348111, 0.7800717354, 1],
    cpy=[0.4108692408, 0.06521737576, 0.5094197989, 0.8913043737])  # disabled
# Dari titik-titik segmen di kurva panjang, duplikasi ke arah Z dengan pola dari Graph Mapper yang akan menjadi profil kelengkungan utama.
bnd = Bounds(Numbers=graph)  # disabled
remap = RemapNumbers(Value=graph, Source=bnd, Target=dom)  # -> reverse(Mapped), Clipped; disabled
Z_2 = UnitZ(Factor=remap.Mapped)  # disabled
# Profil Kurva
# Kelengkungan
move = Move(Geometry=divide_5.Points, Motion=Z_2)  # -> Geometry, Transform; disabled

intcrv = Interpolate(Vertices=move.Geometry, Degree=3, Periodic=False, KnotStyle=1)  # -> Curve, Length, Domain; disabled

# ----
# Extrude kurva kelengkungan searah kurva pendek (lebar ellips) dan potong dengan bentuk ELipse menggunakan Project
crv_21 = Curve(reverse(crv_19))  # disabled
amp = Amplitude(Vector=crv_21, Amplitude=crv_21)  # disabled
extr_2 = Extrude(Base=intcrv.Curve, Direction=amp)  # disabled
# 1. MEMBUAT SURFACE DASAR 1
crv_22 = Curve(ellipse.Ellipse)  # disabled
# Kurva
# Elips
# Atas
project = Project(Curve=crv_22, Brep=extr_2, Direction=Vector(0, 0, 1))  # disabled

number_slider_12 = Slider(9, range=1..100)  # disabled
# Buat ELipse kedua dengan titik pusat yang sama dengan Elips pertama namun dengan besar berbeda
number_slider_13 = Slider(12, range=1..100)  # disabled

# ----
# Elips
# Bawah
# Menentukan garis bantu antara Kurva Elips Atas dan Elips Bawah.
ellipse_2 = Ellipse(Plane=PlaneXY(0, 0, 0), Radius1=number_slider_12, Radius2=number_slider_13)  # -> Ellipse, Focus1, Focus2; disabled

number_slider_14 = Slider(4, range=0..10)  # disabled
divide_6 = DivideCurve(Curve=project, Count=number_slider_14, Kinks=False)  # -> Points, Tangents, Parameters; disabled
divide_7 = DivideCurve(Curve=ellipse_2.Ellipse, Count=number_slider_14, Kinks=False)  # -> Points, Tangents, Parameters; disabled
item_12 = ListItem(List=divide_7.Points, Index=0, Wrap=True)  # -> Item, Item1, Item2, Item3; disabled
item_13 = ListItem(List=divide_6.Points, Index=0, Wrap=True)  # -> Item, Item1, Item2, Item3; disabled
pt_4 = Point(item_12.Item1)  # disabled
pt_5 = Point(item_12.Item3)  # disabled
pt_6 = Point(item_13.Item1)  # disabled
pt_7 = Point(item_13.Item3)  # disabled
ln_7 = Line(StartPoint=pt_6, EndPoint=pt_5)  # disabled
ln_8 = Line(StartPoint=pt_7, EndPoint=pt_4)  # disabled

number_slider_15 = Slider(-2, range=-10..10)  # disabled
# Derajat Kelengkungan
# Profil Lengkung
# Vertikal
number_slider_16 = Slider(-3, range=-10..10)  # disabled

midpt = CurveMiddle(Curve=[ln_7, ln_8])  # disabled
neg = Negative(Value=number_slider_16)  # disabled
Y = UnitY(Factor=[number_slider_15, neg])  # disabled
move_2 = Move(Geometry=midpt, Motion=Y)  # -> Geometry, Transform; disabled
item_14 = ListItem(List=move_2.Geometry, Index=0, Wrap=True)  # -> Item, Item1; disabled
# Profil Lengkung
# Vertikal 1
arc = Arc3Pt(PointA=pt_6, PointB=item_14.Item, PointC=pt_5)  # -> Arc, Plane, Radius; disabled
# Profil Lengkung
# Vertikal 2
arc_2 = Arc3Pt(PointA=pt_7, PointB=item_14.Item1, PointC=pt_4)  # -> Arc, Plane, Radius; disabled

# ----
# Pusat Rotasi
# Relatif Terhadap
# Kurva Elips Atas
panel_28 = Panel("Kurva Elips Atas")  # disabled
number_slider_17 = Slider(0.25, range=0..1)  # disabled
# Ketinggian Atap
number_slider_18 = Slider(0.9, range=0..1)  # disabled
# Sudut Putar
number_slider_19 = Slider(2.5, range=0..100)  # disabled
# 3. MEMBUAT GEOMETRI ATAP
crv_23 = Curve(project)  # disabled

# ----
# Membuat geometri atap dengan memanipulasi kurva Elips atas menggunakan Perpendicular Frame untuk menentukan sumbu putar, dan Rotate
pframe = PerpFrame(Curve=reparameterize(crv_23), Parameter=number_slider_17)  # disabled
scale = Scale(Geometry=crv_23, Center=pframe, Factor=number_slider_18)  # -> Geometry, Transform; disabled
rotate = Rotate(Geometry=scale.Geometry, Angle=expr("-x", degrees(number_slider_19)), Plane=pframe)  # -> Geometry, Transform; disabled

merge_4 = Merge(Data1=arc.Arc, Data2=arc_2.Arc)  # disabled
# Surface Dasar1
flip_3 = FlipCurve(Curve=ellipse_2.Ellipse)  # -> Curve, Flag; disabled
# Pusat Rotasi
# Relatif Terhadap
# Kurva Atap 1
number_slider_20 = Slider(0.75, range=0..1)  # disabled
# Ketinggian Atap
# Sudut Putar
number_slider_21 = Slider(0.75, range=0..1)  # disabled
number_slider_22 = Slider(2.5, range=0..100)  # disabled

swp2 = Sweep2(Rail1=project, Rail2=flip_3.Curve, Sections=arc_2.Arc, SameHeight=False)  # disabled

crv_24 = Curve(rotate.Geometry)  # disabled
pframe_2 = PerpFrame(Curve=reparameterize(crv_24), Parameter=number_slider_20)  # disabled
# Berbasis kurva lapisan atap 1, geometri atap 2 dibentuk.
scale_2 = Scale(Geometry=crv_24, Center=pframe_2, Factor=number_slider_21)  # -> Geometry, Transform; disabled
rotate_2 = Rotate(Geometry=scale_2.Geometry, Angle=expr("-x", degrees(number_slider_22)), Plane=pframe_2)  # -> Geometry, Transform; disabled

# ----
# Lapisan Atap 1
loft_2 = Loft(
    Curves=[crv_23, rotate.Geometry],
    Options={Adjust=False, Closed=False, LoftEnds=0, LoftSimp=0, LoftType=0, Rebuild=10, Refit=0.01})  # disabled

# ----
# Jumlah Pola Panel
# Add-On: Lunchbox untuk membuat panel Diamond
number_slider_23 = Slider(120, range=0..200)  # disabled
# 2. MEMBUAT POLA PANEL DURIAN
diamond = DiamondPanels(Surface=swp2, UDivisions=number_slider_23, VDivisions=10)  # -> DiamondPanels, TriPanels; disabled

# ----
# Nilai Offset
# Terhadap Lapisan Atap 1
number_slider_24 = Slider(-0.5, range=-5..10)  # disabled
number_slider_25 = Slider(0.4, range=-5..10)  # disabled

# ----
# Offset terhadap kurva lapisan atap 1
vec = VectorXYZ(XComponent=0, YComponent=number_slider_24, ZComponent=number_slider_25)  # -> Vector, Length; disabled
move_3 = Move(Geometry=rotate_2.Geometry, Motion=vec.Vector)  # -> Geometry, Transform; disabled

# ----
# Gunakan Evaluate Surface (Reparameterize) untuk menentukan titik tengah setiap panel, dan pindahkan titik tengah ini ke luar sesuai ventor normal
# Tebal
# Extrude Panel
number_slider_26 = Slider(0.8, range=0..10)  # disabled

md_slider_4 = MDSlider(SliderMode=0, slider_value=Point(0.5, 0.5, 0.5), x_domain=Domain(0, 1), y_domain=Domain(0, 1), z_domain=Domain(0, 1))  # disabled
evalsrf_5 = EvaluateSurface(Surface=reparameterize([diamond.DiamondPanels, diamond.TriPanels]), Point=md_slider_4)  # -> Point, Normal, UDirection, VDirection, Frame; disabled
multiplication_4 = Multiplication(A=evalsrf_5.Normal, B=number_slider_26)  # disabled
move_4 = Move(Geometry=evalsrf_5.Point, Motion=multiplication_4)  # -> Geometry, Transform; disabled

# ----
# Lapisan Atap 2
loft_3 = Loft(
    Curves=[crv_24, move_3.Geometry],
    Options={Adjust=False, Closed=False, LoftEnds=0, LoftSimp=0, LoftType=0, Rebuild=10, Refit=0.01})  # disabled
# Pusat Rotasi
# Relatif Terhadap
# Kurva Atap 2
number_slider_27 = Slider(0.75, range=0..1)  # disabled
# Ketinggian Atap
number_slider_28 = Slider(0.77, range=0..1)  # disabled
# Sudut Putar
number_slider_29 = Slider(4.36, range=0..100)  # disabled

# ----
# Extrude setiap edge pada panel terhadap point untuk membuat bentuk runcing
crv_25 = Curve([diamond.DiamondPanels, diamond.TriPanels])  # disabled
# Panel
# Runcing
extr_3 = ExtrudePoint(Base=crv_25, Point=move_4.Geometry)  # disabled

crv_26 = Curve(move_3.Geometry)  # disabled
pframe_3 = PerpFrame(Curve=reparameterize(crv_26), Parameter=number_slider_27)  # disabled
scale_3 = Scale(Geometry=crv_26, Center=pframe_3, Factor=number_slider_28)  # -> Geometry, Transform; disabled
rotate_3 = Rotate(Geometry=scale_3.Geometry, Angle=degrees(number_slider_29), Plane=pframe_3)  # -> Geometry, Transform; disabled

# ----
# Nilai Offset
# Terhadap Lapisan Atap 2
number_slider_30 = Slider(-2.3, range=-5..10)  # disabled
number_slider_31 = Slider(1.1, range=-5..10)  # disabled

# ----
# Gunakan CatMull-Clark Subdivision dari Weaverbird untuk membuat obyek runcing menjadi lebih halus
smesh = SimpleMesh(Brep=extr_3)  # disabled
panel_29 = Panel("3")  # disabled
panel_30 = Panel("0")  # disabled
# Panel
# Lebih Halus
wbcatmullclark = WeaverbirdsCatmullClarkSubdivision(MeshCurves=smesh, Level=panel_29, SmoothNakedEdges=panel_30)  # disabled

vec_2 = VectorXYZ(XComponent=0, YComponent=number_slider_30, ZComponent=expr("-x", number_slider_31))  # -> Vector, Length; disabled
move_5 = Move(Geometry=rotate_3.Geometry, Motion=vec_2.Vector)  # -> Geometry, Transform; disabled
# Nilai Tinggi
# Lapisan Atap 4
number_slider_32 = Slider(6.7, range=0..10)  # disabled
# Lapisan Atap 3
loft_4 = Loft(
    Curves=[crv_26, move_5.Geometry],
    Options={Adjust=False, Closed=False, LoftEnds=0, LoftSimp=0, LoftType=0, Rebuild=10, Refit=0.01})  # disabled

# ----
# Proyeksikan kurva Elips lapisan atap 3 terhadap bidang datar dengan ketinggian ditentukan secara parametrik pada sumbu Z
pt_8 = ConstructPoint(XCoordinate=0, YCoordinate=0, ZCoordinate=number_slider_32)  # disabled
xy = XYPlane(Origin=pt_8)  # disabled
project_2 = Project(Geometry=move_5.Geometry, Plane=xy)  # -> Geometry, Transform; disabled

# ----
# Lapisan Atap 4
loft_5 = Loft(
    Curves=[move_5.Geometry, project_2.Geometry],
    Options={Adjust=False, Closed=False, LoftEnds=0, LoftSimp=0, LoftType=0, Rebuild=10, Refit=0.01})  # disabled

# ----
# Buat Surface pada kurva lantai
crv_27 = Curve(ellipse_2.Ellipse)  # disabled
boundary_2 = BoundarySurfaces(Edges=crv_27)  # disabled

# ----
# Surface Lantai
boundary_3 = BoundarySurfaces(Edges=project_2.Geometry)  # disabled
# Surface Panel
wbjoin = WeaverbirdsJoinMeshesAndWeld(Mesh=flatten(wbcatmullclark), Weld=False)  # disabled
# Surface Atap
merge_5 = Merge(Data1=loft_2, Data2=loft_3, Data3=loft_4, Data4=loft_5, Data5=boundary_3)  # disabled
